# Grasshopper definition Cable Driven Mechanisms.gh (Grasshopper 1.0.8)
# plug-ins: Pufferfish

# ----
# Double Station
brep = Brep(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)
preview = CustomPreview(Geometry=brep, Material=ColourSwatch(SwatchColor=RGBA(34, 52, 181, 101)))

# ----
# Print Bed Preview
# Station
brep_2 = Brep(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)
preview_2 = CustomPreview(Geometry=brep_2, Material=ColourSwatch(SwatchColor=RGBA(34, 52, 181, 101)))

# ----
# Clearance:
# no printing or weaving
brep_3 = Brep(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)
preview_3 = CustomPreview(Geometry=brep_3, Material=ColourSwatch(SwatchColor=RGBA(181, 34, 34, 16)))

# ----
# Clearance:
# no weaving
brep_4 = Brep(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)
preview_4 = CustomPreview(Geometry=brep_4, Material=ColourSwatch(SwatchColor=RGBA(0, 178, 181, 16)))

# ----
# Print bed
crv = Curve([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])

# ----
# Custom GCode can cause damage to the printer
# when not careful, use at your own risk.
# 
# Always check whether the toolpaths are within
# bounds of the build volume to avoid issues with
# your printer.
# 
# Thank you!
# Example Geometry
# Bending Geometry
brep_5 = Brep([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])

# ----
# Straight curve
crv_2 = Curve(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)

# ----
# Channel radius
# (at least 2x needle radius)
number_slider = Slider(1.8, range=0..10)

# ----
# Input curve
# Create planar curve where the yarn should be placed,
# going right through your cable driven object,
# with he ends of the curve inside the fixed end and puller
# 
# Import this curve here
crv_3 = Curve(crv_2)

# ----
# Input
# Variables
# Input Geometry
# Model your cable-driven object and input here
brep_6 = Brep(brep_5)

# ----
# Yarn depositor needle tip
# offset from nozzle
needle_z_offset = Slider(23.75, range=0..100)
needle_y_offset = Slider(40, range=0..100)

# ----
# Create main channel
pipe = Pipe(Curve=crv_3, Radius=number_slider, Caps=0)
cap = CapHoles(Brep=pipe)

# ----
# Create weaving path
# Station anchor
pt = Point(Point(40, 40.5, 0))

# ----
# Construct weaving path
end = EndPoints(Curve=crv_3)  # -> Start, End
Z = UnitZ(Factor=number_slider)
merge = Merge(Data1=end.Start, Data2=end.End)
neg = Negative(Value=Z)
move = Move(Geometry=merge, Motion=neg)  # -> Geometry, Transform
cir = Circle(Plane=merge, Radius=Slider(3.9, range=0..10))
crv_cp = CurveClosestPoint(Point=pt, Curve=cir)  # -> Point, Parameter, Distance
seam = Seam(Curve=cir, Seam=crv_cp.Parameter)
eval = EvaluateCurve(Curve=cir, Parameter=crv_cp.Parameter)  # -> Point, Tangent, Angle
ccx = CurveCurve(CurveA=crv_3, CurveB=seam)  # -> flatten(Points), flatten(ParamsA), ParamsB
shatter = Shatter(Curve=crv_3, Parameters=ccx.ParamsA)
len = Length(Curve=shatter)
arc = ArcSED(Start=crv_cp.Point, End=ccx.Points, Direction=eval.Tangent)  # -> Arc, Plane, Radius
sort = SortList(Keys=len, ValuesA=shatter)  # -> Keys, ValuesA
lastdex = LastIndex(List=sort.ValuesA)
eval_2 = EvaluateCurve(Curve=reparameterize(arc.Arc), Parameter="1")  # -> Point, Tangent, Angle
item = ListItem(List=sort.ValuesA, Index=lastdex, Wrap=True)
unit = UnitVector(Vector=eval_2.Tangent)

# ----
# Station anchor
pt_2 = Point(pt)

# ----
# Station anchor
pt_3 = Point(pt_2)

# ----
# Linear movement
crv_4 = Curve(item)

# ----
# Circle movements
crv_5 = Curve(seam)

# ----
# Arc movements
crv_6 = Curve(arc.Arc)

# ----
# Base Geometry
brep_7 = Brep(brep_6)

needle_z_offset_2 = Slider(24.5, range=0..100)  # disabled
needle_y_offset_2 = Slider(41.5, range=0..100)  # disabled

filament_diameter = Slider(1.75, range=0..4)
layer_heigth = Slider(0.4, range=0..20)
line_width = Slider(0.4, range=0..1)
C = Slider(42, range=0..1000)
flow = Flow(layer_height=layer_heigth, line_width=line_width, multiplier=C, filament_diameter=filament_diameter)

# ----
# Lift Z to pillar top height + needle offset
speed_mm_s = Slider(20, range=0..200)  # disabled
pillars_max_height = Panel()  # disabled
needle_z_offset_3 = Panel(needle_z_offset_2)  # disabled
clearance_mm = Slider(2, range=0..10)  # disabled
number_slider_2 = Slider(60, range=0..100)  # disabled
addition = Addition(A=pillars_max_height, B=needle_z_offset_3)  # disabled
mm_min = Multiplication(A=speed_mm_s, B=number_slider_2)  # disabled
addition_2 = Addition(A=addition, B=clearance_mm)  # disabled
Z_2 = Text(" Z")  # disabled
g1 = Text("G1 ")  # disabled
F = Text("F")  # disabled
concat = Concatenate(FragmentH=g1, FragmentG=F, FragmentL=mm_min, FragmentE=Z_2, FragmentF=addition_2)  # disabled
# Pick Up + clearance lifts: ; Start of pick up gcode v2
# G1 F16000 X25 Y74 ; to pickup start XY
# G1 F3000 Z37 ; to pickup start Z
# G1 F8000 X25 Y4 Z37  ; move to needle
# G1 F8000 X6 Y4 Z37  ; lock in to needle
# G1 F8000 X6 Y74 Z37  ; pull away
# ; end of pick up gcode v2
z_to_pillar_top_needle_offset = Panel(concat)  # disabled

filament_diameter_2 = Slider(1.75, range=0..4)
layer_heigth_2 = Slider(0.4, range=0..20)
line_width_2 = Slider(0.4, range=0..1)
flow_2 = Flow(layer_height=layer_heigth_2, line_width=line_width_2, multiplier=C, filament_diameter=filament_diameter_2)

# ----
# Create GCode
# XY to start point
speed_mm_s_2 = Slider(25, range=0..500)
pt_4 = Point(pt_2)
pdecon = Deconstruct(Point=pt_4)  # -> XComponent, YComponent, ZComponent
needle_y_offset_3 = Panel(needle_y_offset)
addition_3 = Addition(A=pdecon.YComponent, B=needle_y_offset_3)
mm_min_2 = Multiplication(A=speed_mm_s_2, B=Slider(60, range=0..100))
g1_2 = Text("G1 ")
X = Text(" X")
F_2 = Text("F")
Y = Text(" Y")
concat_2 = Concatenate(
    FragmentH=g1_2,
    FragmentG=F_2,
    FragmentL=mm_min_2,
    FragmentA=X,
    FragmentB=pdecon.XComponent,
    FragmentC=Y,
    FragmentD=addition_3)
xy_to_weaving_start = Panel(concat_2)

# ----
# Park + wipe
park_blue_cable_driven = Panel("""; Start of park gcode blue
G91 ; relative positioning
G1 F500 Z5 ; Z offset
G90; absolute positioning
G1 F6000 X42.5  ; approach X
G1 F6000 Y26  ; approach Y
G1 F500 Z37 ; approach Z
G1 F4000 X42.5 Y6 Z37  ; move to station
G1 F4000 X61.5 Y6 Z37  ; decouple needle
G1 F4000 X61.5 Y26 Z37  ; pull away

M83   ; relative extrusion
; end of park gcode v2""")
wipe = Panel("""; nozzle wipe G92 E0 ; zero extruder G1 E-0.5 F300 ; retract filament
G1 X55 Y262.5 F15000 ; nozzle wipe position start
G1 Z0.4; nozzle down (matching default z height when original wipe happens)
G1 X20 Y262.5 F15000 ; first wipe
G1 X20 Y262 F15000 ; Y down G1 X65 Y262 F15000 ; wipe
G1 X65 Y261.5 F15000 ; Y down G1 X20 Y261.5 F15000 ; wipe
G1 X20 Y261 F15000 ; Y down G1 X65 Y261 F15000 ; wipe
G1 X65 Y260.5 F15000 ; Y down G1 X20 Y260.5 F15000 ; wipe
G1 X20 Y260 F15000 ; Y down G1 X65 Y260 F15000 ; wipe
; end of park + wipe code""")

# ----
# pickup
pick_up_blue_cable_driven = Panel("""; Start of pick up gcode blue
G91 ; relative positioning
G1 F500 Z35 ; Z offset
G90; absolute positioning
G1 F6000 X61.5 Y26 ; to pickup start XY
G1 F500 Z37 ; to pickup start Z
G1 F4000 X61.5 Y6 Z37  ; move to needle
G1 F4000 X42.5 Y6 Z37  ; lock in to needle
G1 F4000 X42.5 Y26 Z37  ; pull away
G91 ; relative positioning
G1 F500 Z35 ; Z offset
G90; absolute positioning
; end of pick up gcode v2""")

pdecon_2 = Deconstruct(Point=pt_3)  # -> XComponent, YComponent, ZComponent

pdecon_3 = Deconstruct(Point=pt_2)  # -> XComponent, YComponent, ZComponent

# ----
# Holes in anchor
number_slider_3 = Slider(5, range=0..10)
multiplication = Multiplication(A=Z, B="2")

# ----
# Anchor pillars circles
channel_radius = Panel(number_slider)
number_slider_4 = Slider(1.8, range=0..10)
multiplication_2 = Multiplication(A=channel_radius, B="2")
dom = ConstructDomain(DomainStart=Slider(1.4, range=0..10), DomainEnd=number_slider_4)

# ----
# 1st Blob point
number_slider_5 = Slider(0.96, range=0..1)

# ----
# last Blob point
number_slider_6 = Slider(0.98, range=0..1)

# ----
# Entry & exit channels
# 1st channel (to boolean)
number_slider_7 = Slider(1.4, range=0..10)

Z_3 = UnitZ(Factor=number_slider_7)

Z_4 = UnitZ(Factor=number_slider_7)

# ----
# Move to side
pillar_radius = Panel(number_slider_4)
neg_2 = Negative(Value=pillar_radius)
multiplication_3 = Multiplication(A=unit, B=pillar_radius)

move_2 = Move(Geometry=move.Geometry, Motion=multiplication_3)  # -> Geometry, Transform
# Create geometry modifications
cir_2 = Circle(Plane=move_2.Geometry, Radius=number_slider_3)
extr = Extrude(Base=cir_2, Direction=multiplication)
cap_2 = CapHoles(Brep=extr)
brep_8 = Brep(cap_2)

move_3 = Move(Geometry=crv_5, Motion=multiplication_3)  # -> Geometry, Transform
move_4 = Move(Geometry=crv_6, Motion=multiplication_3)  # -> Geometry, Transform
dispatch = Dispatch(List=move_3.Geometry, DispatchPattern=[True, False])  # -> ListA, ListB
dispatch_2 = Dispatch(List=move_4.Geometry, DispatchPattern=[True, False])  # -> ListA, ListB
merge_2 = Merge(
    Data1=flatten(dispatch.ListA),
    Data2=flatten(dispatch.ListA),
    Data3=flatten(dispatch_2.ListA),
    Data4=flatten(crv_4),
    Data5=flatten(dispatch_2.ListB),
    Data6=flatten(dispatch.ListB),
    Data7=flatten(dispatch.ListB))

# ----
# Weaving path
crv_7 = Curve(merge_2)

number_slider_8 = Slider(25, range=0..100)  # disabled
divide = DivideCurve(Curve=crv_7, Count=number_slider_8, Kinks=False)  # -> Points, Tangents, Parameters; disabled

# ----
# Circle 1
crv_8 = Curve(dispatch.ListA)

# ----
# Circle 2
crv_9 = Curve(dispatch.ListB)

divide_2 = DivideCurve(Curve=crv_8, Count=Slider(25, range=0..5000), Kinks=False)  # -> Points, Tangents, Parameters

# ----
# Divide weaving curve into points
number_slider_9 = Slider(25, range=0..100)
divide_3 = DivideCurve(Curve=crv_7, Count=number_slider_9, Kinks=False)  # -> Points, Tangents, Parameters

divide_4 = DivideCurve(Curve=crv_9, Count=Slider(25, range=0..5000), Kinks=False)  # -> Points, Tangents, Parameters

pline = PolyLine(Vertices=divide_2.Points, Closed=True)
explode = Explode(Curve=pline, Recursive=True)  # -> Segments, Vertices

lastdex_2 = LastIndex(List=flatten(divide_3.Points))
item_2 = ListItem(List=flatten(divide_3.Points), Index=lastdex_2, Wrap=True)

# ----
# last weaving point
pt_5 = Point(item_2)

pdecon_4 = Deconstruct(Point=pt_5)  # -> XComponent, YComponent, ZComponent
pt_6 = ConstructPoint(XCoordinate=pdecon_2.XComponent, YCoordinate=pdecon_2.YComponent, ZCoordinate=pdecon_4.ZComponent)
ln = Line(StartPoint=pt_6, EndPoint=pt_5)

eval_3 = EvaluateCurve(Curve=reparameterize(ln), Parameter=number_slider_6)  # -> Point, Tangent, Angle
move_5 = Move(Geometry=eval_3.Point, Motion=Z_4)  # -> Geometry, Transform

# ----
# last channel (to boolean)
pipe_2 = Pipe(Curve=ln, Radius=number_slider_7, Caps=0)
cap_3 = CapHoles(Brep=pipe_2)

pline_2 = PolyLine(Vertices=divide_4.Points, Closed=True)
explode_2 = Explode(Curve=pline_2, Recursive=True)  # -> Segments, Vertices

len_2 = Length(Curve=explode.Segments)
multiplication_4 = Multiplication(A=len_2, B=flow)

# ----
# XY to anchor hole
# Close anchor hole
item_3 = ListItem(List=divide_2.Points, Index=0, Wrap=True)
speed_mm_s_3 = Slider(35, range=0..500)
pdecon_5 = Deconstruct(Point=item_3)  # -> XComponent, YComponent, ZComponent
mm_min_3 = Multiplication(A=speed_mm_s_3, B=Slider(60, range=0..100))
X_2 = Text(" X")
g1_3 = Text("G1 ")
F_3 = Text("F")
Y_2 = Text(" Y")
concat_3 = Concatenate(
    FragmentH=g1_3,
    FragmentG=F_3,
    FragmentL=mm_min_3,
    FragmentA=X_2,
    FragmentB=pdecon_5.XComponent,
    FragmentC=Y_2,
    FragmentD=pdecon_5.YComponent)
xy_to_blob = Panel(concat_3)

len_3 = Length(Curve=explode_2.Segments)
multiplication_5 = Multiplication(A=len_3, B=flow_2)

# ----
# 2nd Blob point
pt_7 = Point(move_5.Geometry)

# ----
# XY to anchor hole (2)
# Close 2nd anchor hole
item_4 = ListItem(List=divide_4.Points, Index=0, Wrap=True)
speed_mm_s_4 = Slider(35, range=0..500)
pdecon_6 = Deconstruct(Point=item_4)  # -> XComponent, YComponent, ZComponent
mm_min_4 = Multiplication(A=speed_mm_s_4, B=Slider(60, range=0..100))
g1_4 = Text("G1 ")
X_3 = Text(" X")
F_4 = Text("F")
Y_3 = Text(" Y")
concat_4 = Concatenate(
    FragmentH=g1_4,
    FragmentG=F_4,
    FragmentL=mm_min_4,
    FragmentA=X_3,
    FragmentB=pdecon_6.XComponent,
    FragmentC=Y_3,
    FragmentD=pdecon_6.YComponent)
xy_to_blob_2 = Panel(concat_4)

# ----
# XY to weaving start
item_5 = ListItem(List=flatten(divide_3.Points), Index=0, Wrap=True)
speed_mm_s_5 = Slider(25, range=0..500)
pdecon_7 = Deconstruct(Point=item_5)  # -> XComponent, YComponent, ZComponent
needle_y_offset_4 = Panel(needle_y_offset)
addition_4 = Addition(A=pdecon_7.YComponent, B=needle_y_offset_4)
mm_min_5 = Multiplication(A=speed_mm_s_5, B=Slider(60, range=0..100))
g1_5 = Text("G1 ")
X_4 = Text(" X")
F_5 = Text("F")
Y_4 = Text(" Y")
concat_5 = Concatenate(
    FragmentH=g1_5,
    FragmentG=F_5,
    FragmentL=mm_min_5,
    FragmentA=X_4,
    FragmentB=pdecon_7.XComponent,
    FragmentC=Y_4,
    FragmentD=addition_4)
xy_to_weaving_start_2 = Panel(concat_5)

# ----
# 1st weaving point
pt_8 = Point(item_5)

pdecon_8 = Deconstruct(Point=pt_8)  # -> XComponent, YComponent, ZComponent
pt_9 = ConstructPoint(XCoordinate=pdecon_3.XComponent, YCoordinate=pdecon_3.YComponent, ZCoordinate=pdecon_8.ZComponent)
ln_2 = Line(StartPoint=pt_9, EndPoint=pt_8)

eval_4 = EvaluateCurve(Curve=reparameterize(ln_2), Parameter=number_slider_5)  # -> Point, Tangent, Angle
move_6 = Move(Geometry=eval_4.Point, Motion=Z_3)  # -> Geometry, Transform

pipe_3 = Pipe(Curve=ln_2, Radius=number_slider_7, Caps=0)
cap_4 = CapHoles(Brep=pipe_3)

merge_3 = Merge(Data1=cap_4, Data2=cap_3, Data3=cap)
brep_9 = Brep(merge_3)

# ----
# 1st Blob point
pt_10 = Point(move_6.Geometry)

speed_mm_s_6 = Slider(15, range=0..100)
needle_y_offset_5 = Panel(needle_y_offset)
needle_z_offset_4 = Panel(needle_z_offset)
pdecon_9 = Deconstruct(Point=divide_3.Points)  # -> XComponent, YComponent, ZComponent
addition_5 = Addition(A=pdecon_9.YComponent, B=needle_y_offset_5)
addition_6 = Addition(A=pdecon_9.ZComponent, B=needle_z_offset_4)
# Weave
mm_min_6 = Multiplication(A=speed_mm_s_6, B=Slider(60, range=0..100))
Z_5 = Text(" Z")
g1_6 = Text("G1 ")
F_6 = Text("F")
X_5 = Text(" X")
Y_5 = Text(" Y")
concat_6 = Concatenate(
    FragmentH=g1_6,
    FragmentG=F_6,
    FragmentL=mm_min_6,
    FragmentA=X_5,
    FragmentB=pdecon_9.XComponent,
    FragmentC=Y_5,
    FragmentD=addition_5,
    FragmentE=Z_5,
    FragmentF=addition_6)
weaving_sequence = Panel(concat_6)

# ----
# XY to blob
speed_mm_s_7 = Slider(35, range=0..500)
pdecon_10 = Deconstruct(Point=pt_10)  # -> XComponent, YComponent, ZComponent
mm_min_7 = Multiplication(A=speed_mm_s_7, B=Slider(60, range=0..100))
g1_7 = Text("G1 ")
X_6 = Text(" X")
F_7 = Text("F")
Y_6 = Text(" Y")
concat_7 = Concatenate(
    FragmentH=g1_7,
    FragmentG=F_7,
    FragmentL=mm_min_7,
    FragmentA=X_6,
    FragmentB=pdecon_10.XComponent,
    FragmentC=Y_6,
    FragmentD=pdecon_10.YComponent)
xy_to_blob_3 = Panel(concat_7)

# ----
# Lift Z and blob
speed_mm_s_8 = Slider(0.3, range=0..200)
z_blob_point = Panel(pdecon_10.ZComponent)
blob_extrusion = Slider(15, range=0..100)
mm_min_8 = Multiplication(A=speed_mm_s_8, B=Slider(60, range=0..100))
blob = Panel("G92 E0 ;   Reset Extruder")
blob_2 = Panel("""G92 E0 ;   Reset Extruder
; End of 1st blob""")
g1_8 = Text("G1 ")
F_8 = Text("F")
Z_6 = Text(" Z")
E = Text(" E")
concat_8 = Concatenate(
    FragmentH=g1_8,
    FragmentG=F_8,
    FragmentL=mm_min_8,
    FragmentE=Z_6,
    FragmentF=z_blob_point,
    FragmentA=E,
    FragmentB=blob_extrusion)
merge_4 = Merge(Data1=blob, Data2=concat_8, Data3=blob_2)
z_to_blob = Panel(merge_4)

# ----
# Lift Z to weaving start
speed_mm_s_9 = Slider(15, range=0..200)
z_1st_point = Panel(pdecon_8.ZComponent)
needle_z_offset_5 = Panel(needle_z_offset)
addition_7 = Addition(A=z_1st_point, B=needle_z_offset_5)
mm_min_9 = Multiplication(A=speed_mm_s_9, B=Slider(60, range=0..100))
g1_9 = Text("G1 ")
F_9 = Text("F")
Z_7 = Text(" Z")
concat_9 = Concatenate(FragmentH=g1_9, FragmentG=F_9, FragmentL=mm_min_9, FragmentE=Z_7, FragmentF=addition_7)
z_to_weaving_start = Panel(concat_9)

# ----
# Lift Z to blob
speed_mm_s_10 = Slider(15, range=0..200)
z_blob_point_2 = Panel(pdecon_10.ZComponent)
mm_min_10 = Multiplication(A=speed_mm_s_10, B=Slider(60, range=0..100))
g1_10 = Text("G1 ")
F_10 = Text("F")
Z_8 = Text(" Z")
concat_10 = Concatenate(FragmentH=g1_10, FragmentG=F_10, FragmentL=mm_min_10, FragmentE=Z_8, FragmentF=z_blob_point_2)
z_to_blob_2 = Panel(concat_10)

# ----
# Lower Z to blob
speed_mm_s_11 = Slider(15, range=0..200)
z_lower_blob_point = Panel(pdecon_8.ZComponent)
mm_min_11 = Multiplication(A=speed_mm_s_11, B=Slider(60, range=0..100))
g1_11 = Text("G1 ")
F_11 = Text("F")
Z_9 = Text(" Z")
concat_11 = Concatenate(FragmentH=g1_11, FragmentG=F_11, FragmentL=mm_min_11, FragmentE=Z_9, FragmentF=z_lower_blob_point)
z_to_blob_3 = Panel(concat_11)

# ----
# XY to blob (2)
speed_mm_s_12 = Slider(35, range=0..500)
pdecon_11 = Deconstruct(Point=pt_7)  # -> XComponent, YComponent, ZComponent
mm_min_12 = Multiplication(A=speed_mm_s_12, B=Slider(60, range=0..100))
X_7 = Text(" X")
g1_12 = Text("G1 ")
F_12 = Text("F")
Y_7 = Text(" Y")
concat_12 = Concatenate(
    FragmentH=g1_12,
    FragmentG=F_12,
    FragmentL=mm_min_12,
    FragmentA=X_7,
    FragmentB=pdecon_11.XComponent,
    FragmentC=Y_7,
    FragmentD=pdecon_11.YComponent)
xy_to_blob_4 = Panel(concat_12)

# ----
# Lift Z and blob (2)
z_blob_point_3 = Panel(pdecon_11.ZComponent)
mm_min_13 = Multiplication(A=speed_mm_s_8, B=Slider(60, range=0..100))
blob_3 = Panel("G92 E0 ;   Reset Extruder")
blob_4 = Panel("""G92 E0 ;   Reset Extruder
; End of 2nd yarn insertion""")
g1_13 = Text("G1 ")
F_13 = Text("F")
Z_10 = Text(" Z")
E_2 = Text(" E")
concat_13 = Concatenate(
    FragmentH=g1_13,
    FragmentG=F_13,
    FragmentL=mm_min_13,
    FragmentE=Z_10,
    FragmentF=z_blob_point_3,
    FragmentA=E_2,
    FragmentB=blob_extrusion)
merge_5 = Merge(Data1=blob_3, Data2=concat_13, Data3=blob_4)
z_to_blob_4 = Panel(merge_5)

speed_mm_s_13 = Slider(0.3, range=0..100)
pdecon_12 = Deconstruct(Point=explode.Vertices)  # -> XComponent, YComponent, ZComponent
addition_8 = Addition(A=pdecon_12.ZComponent, B=0.27)
mm_min_14 = Multiplication(A=speed_mm_s_13, B=Slider(60, range=0..100))
Z_11 = Text(" Z")
g1_14 = Text("G1 ")
F_14 = Text("F")
X_8 = Text(" X")
Y_8 = Text(" Y")
E_3 = Text(" E")
concat_14 = Concatenate(
    FragmentH=g1_14,
    FragmentG=F_14,
    FragmentL=mm_min_14,
    FragmentA=X_8,
    FragmentB=pdecon_12.XComponent,
    FragmentC=Y_8,
    FragmentD=pdecon_12.YComponent,
    FragmentE=Z_11,
    FragmentF=addition_8,
    FragmentJ=E_3,
    FragmentK=multiplication_4)
panel = Panel(concat_14)

# ----
# Fix 2nd channel
# Lift Z to blob (2)
speed_mm_s_14 = Slider(15, range=0..200)
z_blob_point_4 = Panel(pdecon_11.ZComponent)
mm_min_15 = Multiplication(A=speed_mm_s_14, B=Slider(60, range=0..100))
g1_15 = Text("G1 ")
F_15 = Text("F")
Z_12 = Text(" Z")
concat_15 = Concatenate(FragmentH=g1_15, FragmentG=F_15, FragmentL=mm_min_15, FragmentE=Z_12, FragmentF=z_blob_point_4)
z_to_blob_5 = Panel(concat_15)

# ----
# Lower Z to blob (2)
speed_mm_s_15 = Slider(15, range=0..200)
z_lower_blob_point_2 = Panel(pdecon_4.ZComponent)
mm_min_16 = Multiplication(A=speed_mm_s_15, B=Slider(60, range=0..100))
g1_16 = Text("G1 ")
F_16 = Text("F")
Z_13 = Text(" Z")
concat_16 = Concatenate(FragmentH=g1_16, FragmentG=F_16, FragmentL=mm_min_16, FragmentE=Z_13, FragmentF=z_lower_blob_point_2)
z_to_blob_6 = Panel(concat_16)

pdecon_13 = Deconstruct(Point=explode_2.Vertices)  # -> XComponent, YComponent, ZComponent
addition_9 = Addition(A=pdecon_13.ZComponent, B=0.27)
mm_min_17 = Multiplication(A=speed_mm_s_13, B=Slider(60, range=0..100))
g1_17 = Text("G1 ")
F_17 = Text("F")
X_9 = Text(" X")
Y_9 = Text(" Y")
Z_14 = Text(" Z")
E_4 = Text(" E")
concat_17 = Concatenate(
    FragmentH=g1_17,
    FragmentG=F_17,
    FragmentL=mm_min_17,
    FragmentA=X_9,
    FragmentB=pdecon_13.XComponent,
    FragmentC=Y_9,
    FragmentD=pdecon_13.YComponent,
    FragmentE=Z_14,
    FragmentF=addition_9,
    FragmentJ=E_4,
    FragmentK=multiplication_5)
panel_2 = Panel(concat_17)

# ----
# Final custom GCode
merge_6 = Merge(
    Data1=flatten(pick_up_blue_cable_driven),
    Data2=flatten(xy_to_weaving_start),
    Data3=flatten(z_to_weaving_start),
    Data4=flatten(xy_to_weaving_start_2),
    Data5=flatten(weaving_sequence),
    Data6=flatten(xy_to_weaving_start),
    Data7=flatten(park_blue_cable_driven),
    Data8=flatten(wipe),
    Data9=flatten(z_to_blob_2),
    Data10=flatten(xy_to_blob_3),
    Data11=flatten(z_to_blob_3),
    Data12=flatten(z_to_blob),
    Data13=flatten(xy_to_blob),
    Data14=flatten(panel),
    Data15=flatten(z_to_blob_5),
    Data16=flatten(xy_to_blob_4),
    Data17=flatten(z_to_blob_6),
    Data18=flatten(z_to_blob_4),
    Data19=flatten(xy_to_blob_2),
    Data20=flatten(panel_2),
    Data21=flatten(z_to_blob_5))
cable_driven = Panel(merge_6)

# ----
# Boolean base geometry
sdiff = SolidDifference(BrepsA=brep_7, BrepsB=brep_9)
sdiff_2 = SolidDifference(BrepsA=sdiff, BrepsB=brep_8)

# ----
# Anchors
z_hop_mm = Slider(2, range=-10..200)  # disabled
number_slider_10 = Slider(0, range=0..100)  # disabled
number_slider_11 = Slider(10, range=0..100)  # disabled
starting_z_height_mm = Panel(number_slider_10)  # disabled

# ----
# Weaving
# Pick Up v4: ; Start of pick up gcode v2
# G1 F16000 X25 Y74 Z37  ; approach
# G1 F8000 X25 Y4 Z37  ; move to needle
# G1 F8000 X6 Y4 Z37  ; lock in to needle
# G1 F8000 X6 Y74 Z37  ; pull away
# ; end of pick up gcode v2
simplify = SimplifyTree(Tree=divide.Points, Front=False)  # disabled

# ----
# XY to weaving start
item_6 = ListItem(List=flatten(simplify), Index=0, Wrap=True)  # disabled
speed_mm_s_16 = Slider(200, range=0..500)  # disabled
pdecon_14 = Deconstruct(Point=item_6)  # -> XComponent, YComponent, ZComponent; disabled
number_slider_12 = Slider(60, range=0..100)  # disabled
needle_y_offset_6 = Panel(needle_y_offset_2)  # disabled
addition_10 = Addition(A=pdecon_14.YComponent, B=needle_y_offset_6)  # disabled
mm_min_18 = Multiplication(A=speed_mm_s_16, B=number_slider_12)  # disabled
g1_18 = Text("G1 ")  # disabled
X_10 = Text(" X")  # disabled
F_18 = Text("F")  # disabled
Y_10 = Text(" Y")  # disabled
concat_18 = Concatenate(
    FragmentH=g1_18,
    FragmentG=F_18,
    FragmentL=mm_min_18,
    FragmentA=X_10,
    FragmentB=pdecon_14.XComponent,
    FragmentC=Y_10,
    FragmentD=addition_10)  # disabled
xy_to_weaving_start_3 = Panel(concat_18)  # disabled

# ----
# Weaving path
speed_mm_s_17 = Slider(25, range=0..100)  # disabled
needle_y_offset_7 = Panel(needle_y_offset_2)  # disabled
needle_z_offset_6 = Panel(needle_z_offset_2)  # disabled
pdecon_15 = Deconstruct(Point=simplify)  # -> XComponent, YComponent, ZComponent; disabled
number_slider_13 = Slider(60, range=0..100)  # disabled
addition_11 = Addition(A=pdecon_15.YComponent, B=needle_y_offset_7)  # disabled
addition_12 = Addition(A=pdecon_15.ZComponent, B=needle_z_offset_6)  # disabled
mm_min_19 = Multiplication(A=speed_mm_s_17, B=number_slider_13)  # disabled
F_19 = Text("F")  # disabled
g1_19 = Text("G1 ")  # disabled
X_11 = Text(" X")  # disabled
Y_11 = Text(" Y")  # disabled
Z_15 = Text(" Z")  # disabled
concat_19 = Concatenate(
    FragmentH=g1_19,
    FragmentG=F_19,
    FragmentL=mm_min_19,
    FragmentA=X_11,
    FragmentB=pdecon_15.XComponent,
    FragmentC=Y_11,
    FragmentD=addition_11,
    FragmentE=Z_15,
    FragmentF=addition_12)  # disabled
weaving_sequence_2 = Panel(concat_19)  # disabled

toggle = BooleanToggle(False)  # disabled

layer_heigth_3 = Slider(0.4, range=0..20)
line_width_3 = Slider(0.6, range=0..1)  # disabled
filament_diameter_3 = Slider(1.75, range=0..4)  # disabled

layer_height = Panel(layer_heigth_3)
division = Division(A=multiplication_2, B=layer_height)
division_2 = Division(A=layer_height, B="2")
subtraction = Subtraction(A=division, B="1")
range = Range(Domain=dom, Steps=subtraction)

addition_13 = Addition(A=division, B="1")

series = Series(Start=0, Step=layer_height, Count=addition_13)
Z_16 = UnitZ(Factor=series)
move_7 = Move(Geometry=graft(move.Geometry), Motion=Z_16)  # -> Geometry, Transform
cir_3 = Circle(Plane=move_7.Geometry, Radius=range)

pdecon_16 = Deconstruct(Point=flatten(move_7.Geometry))  # -> XComponent, YComponent, ZComponent
sort_2 = SortList(Keys=pdecon_16.ZComponent)  # -> Keys, ValuesA
lastdex_3 = LastIndex(List=sort_2.Keys)
item_7 = ListItem(List=sort_2.Keys, Index=lastdex_3, Wrap=True)

move_8 = Move(Geometry=cir_3, Motion=graft(multiplication_3))  # -> Geometry, Transform

# ----
# Anchor pillars
crv_10 = Curve(move_8.Geometry)

simplify_2 = SimplifyTree(Tree=crv_10, Front=False)

# ----
# Anchors to bake & union
loft = Loft(Curves=simplify_2, Options={Adjust=False, Closed=False, LoftEnds=0, LoftSimp=0, LoftType=0, Rebuild=10, Refit=0.01})
cap_5 = CapHoles(Brep=loft)

merge_7 = Merge(Data1=flatten(cap_5), Data2=flatten(sdiff_2))
sunion = SolidUnion(Breps=merge_7)

# ----
# Anchor pillars by layer
flip = FlipMatrix(Data=simplify_2)

# ----
# Lift Z to pillar top height
speed_mm_s_18 = Slider(20, range=0..200)  # disabled
pillars_max_height_2 = Panel(item_7)  # disabled
clearance_mm_2 = Slider(2, range=0..10)  # disabled
number_slider_14 = Slider(60, range=0..100)  # disabled
mm_min_20 = Multiplication(A=speed_mm_s_18, B=number_slider_14)  # disabled
addition_14 = Addition(A=pillars_max_height_2, B=clearance_mm_2)  # disabled
Z_17 = Text(" Z")  # disabled
F_20 = Text("F")  # disabled
g1_20 = Text("G1 ")  # disabled
concat_20 = Concatenate(FragmentH=g1_20, FragmentG=F_20, FragmentL=mm_min_20, FragmentE=Z_17, FragmentF=addition_14)  # disabled
z_to_pillar_top = Panel(concat_20)  # disabled

# ----
# Instructions
# Geometry modifications
# Bake and export the modified geometry below
brep_10 = Brep(sunion)

# ----
# Slice Object
# (make sure the plaement in the slicer is the same
#  as that in rhino by copying the rhino coordinates of the midpoint)
# Copy coordinates
# Insert GCode
# (insert the custom Gcode in the slicer at a layer
# where ~3/4 of the channels have been printed)
import_rhino_geometry_as_rg_combined_box = Python3Script(breps=brep_10)  # -> out, a_out; "import Rhino.Geometry as rg combined_box = rg.BoundingBox.Empty for brep in breps: box = brep.GetBoundingBox(True) combined_box = rg.BoundingBox.Union(combined_box, box) a_out = combined_box.Center"; inputs breps: list of Brep
# ---------- import_rhino_geometry_as_rg_combined_box: Python ----------
import Rhino.Geometry as rg

combined_box = rg.BoundingBox.Empty

for brep in breps:
    box = brep.GetBoundingBox(True)
    combined_box = rg.BoundingBox.Union(combined_box, box)

a_out = combined_box.Center
# ---------- end import_rhino_geometry_as_rg_combined_box ----------
pt_11 = Point(import_rhino_geometry_as_rg_combined_box.a_out)
pdecon_17 = Deconstruct(Point=pt_11)  # -> XComponent, YComponent, ZComponent
panel_3 = Panel(pdecon_17.XComponent)
panel_4 = Panel(pdecon_17.ZComponent)
panel_5 = Panel(pdecon_17.YComponent)

divide_5 = DivideCurve(Curve=simplify_2, Count=number_slider_11, Kinks=False)  # -> Points, Tangents, Parameters; disabled
trim = TrimTree(Tree=divide_5.Points, Depth=1)  # disabled

pline_3 = PolyLine(Vertices=trim, Closed=toggle)  # disabled
explode_3 = Explode(Curve=pline_3, Recursive=True)  # -> Segments, Vertices; disabled

split = SplitList(List=explode_3.Vertices, Index=1)  # -> ListA, ListB; disabled

# ----
# Circles starting points
simplify_3 = SimplifyTree(Tree=split.ListA, Front=False)  # disabled

# ----
# Circles printing points
simplify_4 = SimplifyTree(Tree=split.ListB, Front=False)  # disabled

# ----
# Travel to first point
speed_mm_s_19 = Slider(200, range=0..1000)  # disabled
pdecon_18 = Deconstruct(Point=simplify_3)  # -> XComponent, YComponent, ZComponent; disabled
number_slider_15 = Slider(60, range=0..100)  # disabled
addition_15 = Addition(A=pdecon_18.ZComponent, B=starting_z_height_mm)  # disabled
addition_16 = Addition(A=addition_15, B=z_hop_mm)  # disabled
mm_min_21 = Multiplication(A=speed_mm_s_19, B=number_slider_15)  # disabled
Z_18 = Text(" Z")  # disabled
X_12 = Text(" X")  # disabled
Y_12 = Text(" Y")  # disabled
g1_21 = Text("G1 ")  # disabled
F_21 = Text("F")  # disabled
concat_21 = Concatenate(
    FragmentH=g1_21,
    FragmentG=F_21,
    FragmentL=mm_min_21,
    FragmentA=X_12,
    FragmentB=pdecon_18.XComponent,
    FragmentC=Y_12,
    FragmentD=pdecon_18.YComponent,
    FragmentE=Z_18,
    FragmentF=addition_16)  # disabled
travel_to_the_first_point = Panel(concat_21)  # disabled

# ----
# Start 210, 50, middle homing: ; --- Start G-code for Bambu A1 (No AMS) ---
# 
# ; Home and prepare printer
# G21             ; Set units to milimetres
# M82             ; Absolute extrusion
# G90             ; Use absolute positioning
# G28 Z             ; Home Z
# G0 Z140 F1000             ; Lift Z to 140mm to avoid station
# G28 X Y             ; Home X & Y
# 
# ; Heat up bed and nozzle gradually
# M140 S50         ; Start heating bed to 50°C (non-blocking)
# M104 S210        ; Start heating hotend to 210°C (non-blocking)
# M190 S50         ; Wait for bed to reach 50°C
# M109 S210        ; Wait for hotend to reach 210°C
# 
# M106 S128        ; Set part cooling fan to 50% speed (max is S255)
# 
# ; --- Wipe Strip / Priming Line ---
# G92 E0           ; Reset extruder
# G1 X50 Y251 F8000  ; Move to purge XY
# G1 Z0.3 F1000     ; Move close to bed
# 
# G1 X150 Y251 E15 F1000 ; Draw purge line up along Y axis
# G1 F1000 Z1 E13     ; Retract extruder
# G92 E0           ; Reset extruder again
# 
# ; --- Prep for printing ---
# 
# G0 X128 Y128 F10000 ; Move to print start position
# 
# ; --- End of Start G-code ---
# Start 230, 50, middle homing: ; --- Start G-code for Bambu A1 (No AMS) ---
# 
# ; Home and prepare printer
# G21             ; Set units to milimetres
# M82             ; Absolute extrusion
# G90             ; Use absolute positioning
# G28 Z             ; Home Z
# G0 Z140 F1000             ; Lift Z to 140mm to avoid station
# G28 X Y             ; Home X & Y
# 
# ; Heat up bed and nozzle gradually
# M140 S50         ; Start heating bed to 50°C (non-blocking)
# M104 S230        ; Start heating hotend to 230°C (non-blocking)
# M190 S50         ; Wait for bed to reach 50°C
# M109 S230        ; Wait for hotend to reach 230°C
# 
# M106 S128        ; Set part cooling fan to 50% speed (max is S255)
# 
# ; --- Wipe Strip / Priming Line ---
# G92 E0           ; Reset extruder
# G1 X50 Y251 F8000  ; Move to purge XY
# G1 Z0.3 F1000     ; Move close to bed
# 
# G1 X150 Y251 E15 F1000 ; Draw purge line up along Y axis
# G1 F1000 Z1 E13     ; Retract extruder
# G92 E0           ; Reset extruder again
# 
# ; --- Prep for printing ---
# 
# G0 X128 Y128 F10000 ; Move to print start position
# 
# ; --- End of Start G-code ---
# End protocol: ; --- End G-code for Bambu A1 (No AMS) ---
# 
# M83               ; Relative extrusion mode
# G0 E-3.0 F3000    ; Retract filament to relieve pressure
# G92 E0       ; Reset extruder
# 
# ; Move print head up and away
# G0 Z50 F1000 ; Lift nozzle up
# G0 X128 Y128 Z150 F2000 ; Move to middle
# 
# ; Turn off fans and heaters
# M106 S0           ; Turn off part cooling fan
# M104 S0           ; Turn off hotend
# M140 S0           ; Turn off bed
# 
# ; Disable steppers
# G4 S5           ; Wait 5 sec
# M84               ; Disable all stepper motors
# 
# ; --- End of End G-code ---
number_slider_16 = Slider(1, range=0..10)  # disabled
# pickup
pick_up_clearance_lifts_slow = Panel("""; Start of pick up gcode v2
G1 F1000 X25 Y74 ; to pickup start XY
G1 F1000 Z37 ; to pickup start Z
G1 F1000 X25 Y4 Z37  ; move to needle
G1 F1000 X6 Y4 Z37  ; lock in to needle
G1 F1000 X6 Y74 Z37  ; pull away
; end of pick up gcode v2""")  # disabled
# park
# Park + wipe: ; Start of park + wipe gcode
# G1 F4000 X6 Y74  ; XY to park start
# G1 F1000 Z37 Z to park start
# G1 F8000 X6 Y4 Z37  ; move to station
# G1 F8000 X25 Y4 Z37  ; decouple needle
# G1 F8000 X25 Y74 Z37  ; pull away
# 
# ; nozzle wipe G92 E0 ; zero extruder G1 E-0.5 F300 ; retract filament
# G1 F1000 Z100 ; lift Z
# G1 X55 Y262.5 F15000 ; nozzle wipe position start
# G1 Z0.4; nozzle down (matching default z height when original wipe happens)
# G1 X20 Y262.5 F15000 ; first wipe
# G1 X20 Y262 F15000 ; Y down G1 X65 Y262 F15000 ; wipe
# G1 X65 Y261.5 F15000 ; Y down G1 X20 Y261.5 F15000 ; wipe
# G1 X20 Y261 F15000 ; Y down G1 X65 Y261 F15000 ; wipe
# G1 X65 Y260.5 F15000 ; Y down G1 X20 Y260.5 F15000 ; wipe
# G1 X20 Y260 F15000 ; Y down G1 X65 Y260 F15000 ; wipe
# ; X-cross wipe Start G1 X20 Y262.5 F15000 ; starting position G1 X20 Y260 F15000 ; down \ wipe G1 X65 Y262.5 F15000 ; / wipe G1 X65 Y260 F15000 ; down G1 X20 Y262.5 F15000 ; \ wipe G1 X20 Y260 F15000 ; down G1 X65 Y262.5 F15000 ; / wipe G1 X65 Y260 F15000 ; down
# ; end of park + wipe code
park_wipe_slow = Panel("""; Start of park + wipe gcode
G1 F1000 X6 Y74  ; XY to park start
G1 F1000 Z37 Z to park start
G1 F1000 X6 Y4 Z37  ; move to station
G1 F1000 X25 Y4 Z37  ; decouple needle
G1 F1000 X25 Y74 Z37  ; pull away

; nozzle wipe G92 E0 ; zero extruder G1 E-0.5 F300 ; retract filament
G1 F1000 Z100 ; lift Z
G1 X55 Y262.5 F15000 ; nozzle wipe position start
G1 Z0.4; nozzle down (matching default z height when original wipe happens)
G1 X20 Y262.5 F15000 ; first wipe
G1 X20 Y262 F15000 ; Y down G1 X65 Y262 F15000 ; wipe
G1 X65 Y261.5 F15000 ; Y down G1 X20 Y261.5 F15000 ; wipe
G1 X20 Y261 F15000 ; Y down G1 X65 Y261 F15000 ; wipe
G1 X65 Y260.5 F15000 ; Y down G1 X20 Y260.5 F15000 ; wipe
G1 X20 Y260 F15000 ; Y down G1 X65 Y260 F15000 ; wipe
; end of park + wipe code""")  # disabled
panel_6 = Panel("M82   ; Absolute extrusion")  # disabled
panel_7 = Panel("M83   ; Relative extrusion")  # disabled

flow_3 = Flow(layer_height=layer_heigth_3, line_width=line_width_3, multiplier=number_slider_16, filament_diameter=filament_diameter_3)  # disabled

len_4 = Length(Curve=explode_3.Segments)  # disabled
multiplication_6 = Multiplication(A=len_4, B=flow_3)  # disabled

panel_8 = Panel(flow_3)  # disabled

speed_mm_s_20 = Slider(5, range=0..100)  # disabled
pdecon_19 = Deconstruct(Point=simplify_4)  # -> XComponent, YComponent, ZComponent; disabled
ma = MassAddition(Input=multiplication_6)  # -> Result, PartialResults; disabled
number_slider_17 = Slider(60, range=0..100)  # disabled
simplify_5 = SimplifyTree(Tree=ma.PartialResults, Front=False)  # disabled
addition_17 = Addition(A=pdecon_19.ZComponent, B=starting_z_height_mm)  # disabled
mm_min_22 = Multiplication(A=speed_mm_s_20, B=number_slider_17)  # disabled
g1_22 = Text("G1 ")  # disabled
F_22 = Text("F")  # disabled
X_13 = Text(" X")  # disabled
Y_13 = Text(" Y")  # disabled
Z_19 = Text(" Z")  # disabled
E_5 = Text(" E")  # disabled
concat_22 = Concatenate(
    FragmentH=g1_22,
    FragmentG=F_22,
    FragmentL=mm_min_22,
    FragmentA=X_13,
    FragmentB=pdecon_19.XComponent,
    FragmentC=Y_13,
    FragmentD=pdecon_19.YComponent,
    FragmentE=Z_19,
    FragmentF=addition_17,
    FragmentJ=E_5,
    FragmentK=simplify_5)  # disabled
panel_9 = Panel(concat_22)  # disabled

# ----
# E of last point in circle
lastdex_4 = LastIndex(List=simplify_5)  # disabled
item_8 = ListItem(List=simplify_5, Index=lastdex_4, Wrap=True)  # disabled

# ----
# Z of last point in circle
lastdex_5 = LastIndex(List=addition_17)  # disabled
item_9 = ListItem(List=addition_17, Index=lastdex_5, Wrap=True)  # disabled

# ----
# Retraction move
retract_peed_mm_s = Slider(50, range=0..100)  # disabled
extrusion_retraction_mm = Slider(1, range=0..5)  # disabled
number_slider_18 = Slider(60, range=0..100)  # disabled
mm_min_23 = Multiplication(A=retract_peed_mm_s, B=number_slider_18)  # disabled
addition_18 = Addition(A=item_9, B=z_hop_mm)  # disabled
subtraction_2 = Subtraction(A=item_8, B=extrusion_retraction_mm)  # disabled
g1_23 = Text("G1 ")  # disabled
F_23 = Text(" Z")  # disabled
F_24 = Text("F")  # disabled
text = Text(" E")  # disabled
concat_23 = Concatenate(
    FragmentA=g1_23,
    FragmentB=F_24,
    FragmentC=mm_min_23,
    FragmentF=F_23,
    FragmentG=addition_18,
    FragmentD=text,
    FragmentE=subtraction_2)  # disabled
retraction_z_hop = Panel(concat_23)  # disabled

# ----
# Drop Z and re-prime filament
speed_mm_s_21 = Slider(20, range=0..100)  # disabled
lng = ListLength(List=simplify_3)  # disabled
pdecon_20 = Deconstruct(Point=simplify_3)  # -> XComponent, YComponent, ZComponent; disabled
number_slider_19 = Slider(60, range=0..100)  # disabled
addition_19 = Addition(A=pdecon_20.ZComponent, B=starting_z_height_mm)  # disabled
mm_min_24 = Multiplication(A=speed_mm_s_21, B=number_slider_19)  # disabled
g1_24 = Text("G1 ")  # disabled
F_25 = Text("F")  # disabled
E_6 = Text(" E")  # disabled
Z_20 = Text(" Z")  # disabled
panel_10 = Panel("G92 E0       ;Reset extruder")  # disabled
concat_24 = Concatenate(
    FragmentH=g1_24,
    FragmentG=F_25,
    FragmentL=mm_min_24,
    FragmentE=Z_20,
    FragmentF=addition_19,
    FragmentA=E_6,
    FragmentB=extrusion_retraction_mm)  # disabled
z_drop_reprime = Panel(concat_24)  # disabled
repeat = RepeatData(Data=panel_10, Length=lng)  # disabled
simplify_6 = SimplifyTree(Tree=repeat, Front=False)  # disabled
merge_8 = Merge(Data1=simplify_6, Data2=z_drop_reprime, Data3=simplify_6)  # disabled
z_drop_reprime_reset = Panel(merge_8)  # disabled

merge_9 = Merge(
    Data1=flatten(z_to_pillar_top),
    Data2=flatten(pick_up_clearance_lifts_slow),
    Data3=flatten(z_to_pillar_top_needle_offset),
    Data4=flatten(xy_to_weaving_start_3),
    Data5=flatten(weaving_sequence_2),
    Data6=flatten(z_to_pillar_top_needle_offset),
    Data7=flatten(park_wipe_slow),
    Data8=flatten(z_to_pillar_top))  # disabled
carpet_texture_full_gcode = Panel(merge_9)  # disabled

merge_10 = Merge(Data1=travel_to_the_first_point, Data2=z_drop_reprime_reset, Data3=panel_9, Data4=retraction_z_hop)  # disabled
panel_11 = Panel(merge_10)  # disabled

merge_11 = Merge(Data1=flatten(panel_6), Data2=flatten(panel_11), Data3=flatten(carpet_texture_full_gcode), Data4=flatten(panel_7))  # disabled
final_gcode = Panel(merge_11)  # disabled

# ==== cluster Flow
filament_diameter = ClusterInput()
layer_height = ClusterInput()
line_width = ClusterInput()
multiplier = ClusterInput()
division = Division(FilamentDiameter=filament_diameter, B=2)
multiplication = Multiplication(LayerHeight=layer_height, LineWidth=line_width, Multiplier=multiplier)
sqr = Square(Value=division)
pi = Pi(Factor=sqr)
division_2 = Division(A=multiplication, B=pi)
R = ClusterOutput(division_2)
