# Grasshopper definition Loop-based Spacer Fabrics.gh (Grasshopper 1.0.8)
# plug-ins: Pufferfish

# ----
# Double Station
brep = Brep(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)
preview = CustomPreview(Geometry=brep, Material=ColourSwatch(SwatchColor=RGBA(34, 52, 181, 101)))

# ----
# 1) Place weaver tool precisely in the middle of the
# print bed and fix in place using strong magnets before printing.
# 
# 2) Before starting the print, position print head all the
# way to the back of the plate to prevent it bumping
# into the weaver tool during homing.
# 
# 
# 
# Custom GCode can cause damage to the printer
# when not careful, use at your own risk.
# Always check whether the toolpaths are within
# bounds of the build volume to avoid issues with
# your printer.
# 
# Thank you!
# Print Bed Preview
# Station
brep_2 = Brep(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)
preview_2 = CustomPreview(Geometry=brep_2, Material=ColourSwatch(SwatchColor=RGBA(34, 52, 181, 101)))

# ----
# Weaver Tool
brep_3 = Brep([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])
preview_3 = CustomPreview(Geometry=brep_3, Material=ColourSwatch(SwatchColor=RGBA(84, 0, 181, 16)))

# ----
# Clearance:
# no printing or weaving
brep_4 = Brep(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)
preview_4 = CustomPreview(Geometry=brep_4, Material=ColourSwatch(SwatchColor=RGBA(181, 34, 34, 16)))

# ----
# Clearance:
# no weaving
brep_5 = Brep(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)
preview_5 = CustomPreview(Geometry=brep_5, Material=ColourSwatch(SwatchColor=RGBA(0, 178, 181, 16)))

# ----
# Print bed
crv = Curve([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])

# ----
# Enable image-based extrusion
# Homogenous = false
# Image = true
toggle = BooleanToggle(False)

# ----
# Speeds
print_speed_mm_s = Slider(5, range=0..100)
weaving_speed_mm_s = Slider(25, range=0..100)

# ----
# Print Parameters
filament_diameter = Slider(1.75, range=0..4)
layer_heigth = Slider(0.2, range=0..20)
line_width = Slider(0.4, range=0..1)

# ----
# Yarn depositor needle tip
# offset from nozzle
needle_z_offset = Slider(12.5, range=0..100)
# FilaLoom Specifics
needle_y_offset = Slider(40, range=0..100)

# ----
# Print path
crv_2 = Curve([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])

# ----
# Weaving path
crv_3 = Curve(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)

# ----
# Weaving path
number_slider = Slider(40, range=25..40)
Z = UnitZ(Factor=number_slider)
# Paths
move = Move(Geometry=crv_3, Motion=Z)  # -> Geometry, Transform

# ----
# Sort warps
midpt = CurveMiddle(Curve=crv_2)
pdecon = Deconstruct(Point=midpt)  # -> XComponent, YComponent, ZComponent
sort = SortList(Keys=pdecon.XComponent, ValuesA=crv_2)  # -> Keys, ValuesA
crv_4 = Curve(reparameterize(sort.ValuesA))

Z_2 = UnitZ(Factor=Slider(40, range=25..40))
move_2 = Move(Geometry=crv_2, Motion=Z_2)  # -> Geometry, Transform

# ----
# Weaving path high
crv_5 = Curve(move.Geometry)

# ----
# Print path high
crv_6 = Curve(move_2.Geometry)

# ----
# flip every 2nd warp
panel = Panel("""0
1""")
dispatch = Dispatch(List=flatten(crv_4), DispatchPattern=panel)  # -> ListA, ListB
flip = FlipCurve(Curve=dispatch.ListA)  # -> Curve, Flag
weave = Weave(Pattern=[0, 1], Stream0=dispatch.ListB, Stream1=flip.Curve, NullGaps=False)

# ----
# Print path sorted
crv_7 = Curve(weave)

# ----
# Divide warp curves into points
number_slider_2 = Slider(100, range=0..100)
divide = DivideCurve(Curve=crv_7, Count=number_slider_2, Kinks=False)  # -> Points, Tangents, Parameters

# ----
# Z-hop
z_hop_mm = Slider(0.05, range=0..200)

# ----
# Divide weaving curves into points
number_slider_3 = Slider(4000, range=0..10000)
divide_2 = DivideCurve(Curve=crv_5, Count=number_slider_3, Kinks=False)  # -> Points, Tangents, Parameters

# ----
# Weaving path
needle_y_offset_2 = Panel(needle_y_offset)
needle_z_offset_2 = Panel(needle_z_offset)
pdecon_2 = Deconstruct(Point=divide_2.Points)  # -> XComponent, YComponent, ZComponent
addition = Addition(A=pdecon_2.YComponent, B=needle_y_offset_2)
addition_2 = Addition(A=pdecon_2.ZComponent, B=needle_z_offset_2)
mm_min = Multiplication(A=weaving_speed_mm_s, B=Slider(60, range=0..100))
g1 = Text("G1 ")
F = Text("F")
X = Text(" X")
Y = Text(" Y")
Z_3 = Text(" Z")
concat = Concatenate(
    FragmentH=g1,
    FragmentG=F,
    FragmentL=mm_min,
    FragmentA=X,
    FragmentB=pdecon_2.XComponent,
    FragmentC=Y,
    FragmentD=addition,
    FragmentE=Z_3,
    FragmentF=addition_2)
weaving_sequence = Panel(concat)

# ----
# Y to weaving start
item = ListItem(List=flatten(divide_2.Points), Index=0, Wrap=True)
speed_mm_s = Slider(75, range=0..500)
pdecon_3 = Deconstruct(Point=item)  # -> XComponent, YComponent, ZComponent
needle_y_offset_3 = Panel(needle_y_offset)
addition_3 = Addition(A=pdecon_3.YComponent, B=needle_y_offset_3)
mm_min_2 = Multiplication(A=speed_mm_s, B=Slider(60, range=0..100))
Y_2 = Text(" Y")
g1_2 = Text("G1 ")
F_2 = Text("F")
concat_2 = Concatenate(FragmentH=g1_2, FragmentG=F_2, FragmentL=mm_min_2, FragmentC=Y_2, FragmentD=addition_3)
xy_to_weaving_start = Panel(concat_2)

# ----
# X to weaving start
item_2 = ListItem(List=flatten(divide_2.Points), Index=0, Wrap=True)
speed_mm_s_2 = Slider(75, range=0..500)
pdecon_4 = Deconstruct(Point=item_2)  # -> XComponent, YComponent, ZComponent
mm_min_3 = Multiplication(A=speed_mm_s_2, B=Slider(60, range=0..100))
X_2 = Text(" X")
g1_3 = Text("G1 ")
F_3 = Text("F")
concat_3 = Concatenate(FragmentH=g1_3, FragmentG=F_3, FragmentL=mm_min_3, FragmentA=X_2, FragmentB=pdecon_4.XComponent)
xy_to_weaving_start_2 = Panel(concat_3)

pline = PolyLine(Vertices=divide.Points, Closed=False)
explode = Explode(Curve=pline, Recursive=True)  # -> Segments, Vertices

# ----
# park + wipe
park_blue_semi_weaving_anchor_wrap = Panel("""; Start of park gcode blue
G1 F1000 Y250  ; Pull Y away
G1 F1000 X42.5  ; Pull X away
G1 F1000 Y76  ; approach Y
G1 F500 Z37 ; approach Z
G1 F4000 X60  ; wrap X
G1 F4000 Y26  ; approach Y
G1 F4000 X42.5  ; approach X
G1 F4000 X42.5 Y6 Z37  ; move to station
G1 F4000 X61.5 Y6 Z37  ; decouple needle
G1 F4000 X61.5 Y26 Z37  ; pull away
; end of park gcode v2""")
wipe = Panel("""; nozzle wipe G92 E0 ; zero extruder G1 E-0.5 F300 ; retract filament
G1 F500 Z45 ; Z clearance
G1 X55 Y262.5 F15000 ; nozzle wipe position start
G1 Z0.4; nozzle down (matching default z height when original wipe happens)
G1 X20 Y262.5 F15000 ; first wipe
G1 X20 Y262 F15000 ; Y down G1 X65 Y262 F15000 ; wipe
G1 X65 Y261.5 F15000 ; Y down G1 X20 Y261.5 F15000 ; wipe
G1 X20 Y261 F15000 ; Y down G1 X65 Y261 F15000 ; wipe
G1 X65 Y260.5 F15000 ; Y down G1 X20 Y260.5 F15000 ; wipe
G1 X20 Y260 F15000 ; Y down G1 X65 Y260 F15000 ; wipe
G1 F500 Z45 ; Z clearance
; end of park + wipe code""")

# ----
# Create GCode
# pickup
pick_up_blue_planar_weaving = Panel("""; Start of pick up gcode blue
G91 ; relative positioning
G1 F500 Z35 ; Z offset
G90; absolute positioning
G1 F6000 X61.5 Y26 ; to pickup start XY
G1 F500 Z37 ; to pickup start Z
G1 F4000 X61.5 Y6 Z37  ; move to needle
G1 F4000 X42.5 Y6 Z37  ; lock in to needle
G1 F4000 X42.5 Y76 Z37  ; pull away
; end of pick up gcode v2""")

# ----
# Read first
# Input Variables
# Extrusion multiplier
# Adjust to tune loop height
# Image Extrusion
C = Slider(30, range=0..1000)

# ----
# Set 2nd loop height (lower value)
C_2 = Slider(20, range=0..1000)

# ----
# Calculate loop heights
flow = Flow(layer_height=layer_heigth, line_width=line_width, multiplier=C_2, filament_diameter=filament_diameter)
panel_2 = Panel(flow)

# ----
# Calculate TPU
panel_3 = Panel("20")

# ----
# Calculate PLA
panel_4 = Panel("24")

# ----
# Add Extrusion Gradient
# (Optional)
srf = Surface(reparameterize(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))
extrusion_multiplier = Panel(C_2)
extrusion_multiplier_2 = Panel(C)
srf_cp = SurfaceClosestPoint(Point=explode.Vertices, Surface=srf)  # -> Point, UVPoint, Distance
panel_5 = Panel("image")
dom = ConstructDomain(DomainStart=extrusion_multiplier, DomainEnd=extrusion_multiplier_2)

# ----
# Set image
image = ImageSampler(srf_cp.UVPoint, Filter="Value", Interpolate=False, Umax=1, Umin=0, Vmax=1, Vmin=0, Wrap=1)

bnd = Bounds(Numbers=image)
remap = RemapNumbers(Value=image, Source=bnd, Target=dom)  # -> Mapped, Clipped

# ----
# Switch between
py3 = Python3Script(single=C, double=remap.Mapped, sel=toggle)  # -> a_out; inputs single: list, double: list, sel: Boolean
# ---------- py3: Python ----------
a_out = list(double if sel else single)
# ---------- end py3 ----------
simplify = SimplifyTree(Tree=py3, Front=False)

# ----
# Printing
starting_z_height = Panel(number_slider)
split = SplitList(List=explode.Vertices, Index=1)  # -> ListA, ListB
simplify_2 = SimplifyTree(Tree=split.ListA, Front=False)
flow_2 = Flow(layer_height=layer_heigth, line_width=line_width, multiplier=simplify, filament_diameter=filament_diameter)
panel_6 = Panel(flow_2)
simplify_3 = SimplifyTree(Tree=split.ListB, Front=False)

len = Length(Curve=explode.Segments)
multiplication = Multiplication(A=len, B=flow_2)

speed_mm_s_3 = Slider(50, range=0..200)
pdecon_5 = Deconstruct(Point=simplify_2)  # -> XComponent, YComponent, ZComponent
addition_4 = Addition(A=pdecon_5.ZComponent, B=starting_z_height)
addition_5 = Addition(A=addition_4, B=z_hop_mm)
mm_min_4 = Multiplication(A=speed_mm_s_3, B=Slider(60, range=0..100))
Z_4 = Text(" Z")
X_3 = Text(" X")
Y_3 = Text(" Y")
g1_4 = Text("G1 ")
F_4 = Text("F")
concat_4 = Concatenate(
    FragmentH=g1_4,
    FragmentG=F_4,
    FragmentL=mm_min_4,
    FragmentA=X_3,
    FragmentB=pdecon_5.XComponent,
    FragmentC=Y_3,
    FragmentD=pdecon_5.YComponent,
    FragmentE=Z_4,
    FragmentF=addition_5)
travel_to_the_first_point = Panel(concat_4)

# ----
# print
pdecon_6 = Deconstruct(Point=simplify_3)  # -> XComponent, YComponent, ZComponent
ma = MassAddition(Input=multiplication)  # -> Result, PartialResults
simplify_4 = SimplifyTree(Tree=ma.PartialResults, Front=False)
addition_6 = Addition(A=pdecon_6.ZComponent, B=starting_z_height)
mm_min_5 = Multiplication(A=print_speed_mm_s, B=Slider(60, range=0..100))
g1_5 = Text("G1 ")
F_5 = Text("F")
X_4 = Text(" X")
Y_4 = Text(" Y")
Z_5 = Text(" Z")
E = Text(" E")
concat_5 = Concatenate(
    FragmentH=g1_5,
    FragmentG=F_5,
    FragmentL=mm_min_5,
    FragmentA=X_4,
    FragmentB=pdecon_6.XComponent,
    FragmentC=Y_4,
    FragmentD=pdecon_6.YComponent,
    FragmentE=Z_5,
    FragmentF=addition_6,
    FragmentJ=E,
    FragmentK=simplify_4)
panel_7 = Panel(concat_5)

lastdex = LastIndex(List=simplify_4)
item_3 = ListItem(List=simplify_4, Index=lastdex, Wrap=True)

lastdex_2 = LastIndex(List=addition_6)
item_4 = ListItem(List=addition_6, Index=lastdex_2, Wrap=True)

retract_peed_mm_s = Slider(30, range=0..100)
extrusion_retraction_mm = Slider(1, range=0..5)
mm_min_6 = Multiplication(A=retract_peed_mm_s, B=Slider(60, range=0..100))
addition_7 = Addition(A=item_4, B=z_hop_mm)
subtraction = Subtraction(A=item_3, B=extrusion_retraction_mm)
F_6 = Text(" Z")
text = Text(" E")
F_7 = Text("F")
g1_6 = Text("G1 ")
concat_6 = Concatenate(
    FragmentA=g1_6,
    FragmentB=F_7,
    FragmentC=mm_min_6,
    FragmentF=F_6,
    FragmentG=addition_7,
    FragmentD=text,
    FragmentE=subtraction)
retraction_z_hop = Panel(concat_6)

speed_mm_s_4 = Slider(25, range=0..100)
lng = ListLength(List=simplify_2)
pdecon_7 = Deconstruct(Point=simplify_2)  # -> XComponent, YComponent, ZComponent
addition_8 = Addition(A=pdecon_7.ZComponent, B=starting_z_height)
mm_min_7 = Multiplication(A=speed_mm_s_4, B=Slider(60, range=0..100))
g1_7 = Text("G1 ")
F_8 = Text("F")
E_2 = Text(" E")
Z_6 = Text(" Z")
concat_7 = Concatenate(
    FragmentH=g1_7,
    FragmentG=F_8,
    FragmentL=mm_min_7,
    FragmentE=Z_6,
    FragmentF=addition_8,
    FragmentA=E_2,
    FragmentB=extrusion_retraction_mm)
z_drop_reprime = Panel(concat_7)
repeat = RepeatData(Data="G92 E0       ;Reset extruder", Length=lng)
simplify_5 = SimplifyTree(Tree=repeat, Front=False)
merge = Merge(Data1=simplify_5, Data2=z_drop_reprime, Data3=simplify_5)
z_drop_reprime_reset = Panel(merge)

merge_2 = Merge(Data1=travel_to_the_first_point, Data2=z_drop_reprime_reset, Data3=panel_7, Data4=retraction_z_hop)
panel_8 = Panel(merge_2)

panel_9 = Panel(flow_2)
merge_3 = Merge(Data1=panel_9, Data2=panel_2)

multiplication_2 = Multiplication(A=merge_3, B=panel_3)
addition_9 = Addition(A=multiplication_2, B="7")

multiplication_3 = Multiplication(A=merge_3, B=panel_4)
addition_10 = Addition(A=multiplication_3, B="8")

panel_10 = Panel(addition_10)
panel_11 = Panel(addition_9)
split_2 = SplitList(List=panel_10, Index="1")  # -> ListA, ListB
split_3 = SplitList(List=panel_11, Index="1")  # -> ListA, ListB
loop_height_mm = Panel(split_2.ListA)
_2nd_loop_height_mm = Panel(split_2.ListB)
loop_height_mm_2 = Panel(split_3.ListA)
_2nd_loop_height_mm_2 = Panel(split_3.ListB)

tpu_loop_height_mm = Panel(loop_height_mm_2)

tpu_2nd_loop_height_mm = Panel(_2nd_loop_height_mm_2)

# ----
# Lift Z to weaving height + needle offset
speed_mm_s_5 = Slider(20, range=0..200)
needle_z_offset_3 = Panel(needle_z_offset)
clearance_mm = Slider(2, range=0..10)
mm_min_8 = Multiplication(A=speed_mm_s_5, B=Slider(60, range=0..100))
Z_7 = Text(" Z")
g1_8 = Text("G1 ")
F_9 = Text("F")

# ----
# Weaving
item_5 = ListItem(List=flatten(divide_2.Points), Index=0, Wrap=True)
pdecon_8 = Deconstruct(Point=item_5)  # -> XComponent, YComponent, ZComponent

addition_11 = Addition(A=pdecon_8.ZComponent, B=needle_z_offset_3)
addition_12 = Addition(A=addition_11, B=clearance_mm)
concat_8 = Concatenate(FragmentH=g1_8, FragmentG=F_9, FragmentL=mm_min_8, FragmentE=Z_7, FragmentF=addition_12)
z_to_pillar_top_needle_offset = Panel(concat_8)

merge_4 = Merge(
    Data2=flatten(pick_up_blue_planar_weaving),
    Data3=flatten(z_to_pillar_top_needle_offset),
    Data4=flatten(xy_to_weaving_start_2),
    Data5=flatten(xy_to_weaving_start),
    Data6=flatten(weaving_sequence),
    Data7=flatten(z_to_pillar_top_needle_offset),
    Data8=flatten(park_blue_semi_weaving_anchor_wrap),
    Data9=flatten(wipe))
weaving = Panel(merge_4)

# ----
# Final GCode
start_230_30 = Panel("""; --- Start G-code for Bambu A1 (No AMS) ---

; Home and prepare printer
G21             ; Set units to milimetres
M82             ; Absolute extrusion
G90             ; Use absolute positioning
G28 Z             ; Home Z
G0 Z120 F500             ; Lift Z to 120mm to avoid station
G28 X Y             ; Home X & Y

; Heat up bed and nozzle gradually
M140 S30         ; Start heating bed to 30°C (non-blocking)
M104 S220        ; Start heating hotend to 220°C (non-blocking)
M190 S30         ; Wait for bed to reach 30°C
M109 S220        ; Wait for hotend to reach 220°C

M106 S128        ; Set part cooling fan to 50% speed (max is S255)

; --- Wipe Strip / Priming Line ---
G92 E0           ; Reset extruder
G1 X50 Y251 F10000  ; Move to purge XY
G1 Z0.3 F500     ; Move close to bed

G1 X150 Y251 E15 F1000 ; Draw purge line up along Y axis
G1 F500 Z1 E13     ; Retract extruder
G92 E0           ; Reset extruder again

; --- Prep for printing ---

G0 X128 Y128 F10000 ; Move to print start position

; --- End of Start G-code ---""")
end_protocol = Panel("""; --- End G-code for Bambu A1 (No AMS) ---

M83               ; Relative extrusion mode
G0 E-3.0 F3000    ; Retract filament to relieve pressure
G92 E0       ; Reset extruder

; Move print head up and away
G91 ; all axes to relative
G0 Z10 F1000 ; Lift nozzle up 10mm

; Turn off fans and heaters
M106 S0           ; Turn off part cooling fan
M104 S0           ; Turn off hotend
M140 S0           ; Turn off bed

; Disable steppers
G4 S5           ; Wait 5 sec
M84               ; Disable all stepper motors

; --- End of End G-code ---""")
merge_5 = Merge(Data1=flatten(start_230_30), Data2=flatten(weaving), Data3=flatten(panel_8), Data4=flatten(end_protocol))
final_gcode = Panel(merge_5)

# ==== cluster Flow
filament_diameter = ClusterInput()
layer_height = ClusterInput()
line_width = ClusterInput()
multiplier = ClusterInput()
division = Division(FilamentDiameter=filament_diameter, B=2)
multiplication = Multiplication(LayerHeight=layer_height, LineWidth=line_width, Multiplier=multiplier)
sqr = Square(Value=division)
pi = Pi(Factor=sqr)
division_2 = Division(A=multiplication, B=pi)
R = ClusterOutput(division_2)
