# Grasshopper definition Planar Semi-Woven Textiles.gh (Grasshopper 1.0.8)
# plug-ins: Pufferfish

# ----
# Tween warp
# Print Bed Preview
number_slider = Slider(35, range=0..100)
crv = Curve(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)
dom = ConstructDomain(DomainStart=0, DomainEnd=1)
crv_2 = Curve(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)
range = Range(Domain=dom, Steps=number_slider)
tweencrv = TweenCurve(CurveA=crv, CurveB=crv_2, Factor=range, BlendType=0)

# ----
# Double Station
brep = Brep(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)
preview = CustomPreview(Geometry=brep, Material=ColourSwatch(SwatchColor=RGBA(34, 52, 181, 101)))

# ----
# Station
brep_2 = Brep(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)
preview_2 = CustomPreview(Geometry=brep_2, Material=ColourSwatch(SwatchColor=RGBA(34, 52, 181, 101)))

# ----
# Clearance:
# no printing or weaving
brep_3 = Brep(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)
preview_3 = CustomPreview(Geometry=brep_3, Material=ColourSwatch(SwatchColor=RGBA(181, 34, 34, 16)))

# ----
# Clearance:
# no weaving
brep_4 = Brep(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)
preview_4 = CustomPreview(Geometry=brep_4, Material=ColourSwatch(SwatchColor=RGBA(0, 178, 181, 16)))

# ----
# Print bed
crv_3 = Curve([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])

# ----
# Swirvy, 5mm
crv_4 = Curve([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])

# ----
# Example warps
# Straight, 5mm
crv_5 = Curve([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])

# ----
# Zigzag
crv_6 = Curve([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])

# ----
# Custom GCode can cause damage to the printer
# when not careful, use at your own risk.
# 
# Always check whether the toolpaths are within
# bounds of the build volume to avoid issues with
# your printer.
# 
# Thank you!
# Example outlines
# Blob
crv_7 = Curve(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)

# ----
# Circle
crv_8 = Curve(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)

# ----
# Square
crv_9 = Curve(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)

# ----
# Amount of top & bottom layers
# FilaLoom Specifics
amount_of_top_bottom_layers = Slider(1, range=0..10)

# ----
# Weft distance
# (=anchor diameter)
warp_distance = Slider(5, range=0..10)

# ----
# Speeds
anchors_print_speed_mm_s = Slider(8, range=0..100)
bottom_layers_print_speed_mm_s = Slider(12, range=0..100)
top_layers_print_speed_mm_s = Slider(8, range=0..100)
weaving_speed_mm_s = Slider(25, range=0..100)

# ----
# Print Parameters
starting_z_height_mm = Slider(0.1, range=0..200)
filament_diameter = Slider(1.75, range=0..4)
layer_heigth = Slider(0.4, range=0..20)
line_width = Slider(0.8, range=0..1)

# ----
# Yarn depositor needle tip
# offset from nozzle
needle_z_offset = Slider(12.5, range=0..100)
needle_y_offset = Slider(40, range=0..100)

# ----
# Input Variables
# Body
# Input outline
crv_10 = Curve(crv_8)

# ----
# Input warp
crv_11 = Curve(tweencrv)

# ----
# Panel curve
crv_12 = Curve(flatten(crv_10))

# ----
# Guide curve
crv_13 = Curve(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)

# ----
# Sort warps
midpt = CurveMiddle(Curve=crv_11)
pdecon = Deconstruct(Point=midpt)  # -> XComponent, YComponent, ZComponent
sort = SortList(Keys=pdecon.XComponent, ValuesA=crv_11)  # -> Keys, ValuesA
crv_14 = Curve(reparameterize(sort.ValuesA))

# ----
# Z-hop
z_hop_mm = Slider(0, range=-10..200)

# ----
# Extrusion multiplier
C = Slider(0.9, range=0..1000)

# ----
# Extrusion multiplier top layers
C_2 = Slider(2.2, range=0..1000)

# ----
# Z-hop
z_hop_mm_2 = Slider(0.05, range=0..200)

# ----
# Extrusion multiplier bottom layers
number_slider_2 = Slider(1.3, range=1..10)

flow = Flow(layer_height=layer_heigth, line_width=line_width, multiplier=C, filament_diameter=filament_diameter)
panel = Panel(flow)

# ----
# Create GCode
toggle = BooleanToggle(True)

filament_diameter_2 = Slider(1.75, range=0..4)
flow_2 = Flow(layer_height=layer_heigth, line_width=line_width, multiplier=C_2, filament_diameter=filament_diameter)

flow_3 = Flow(layer_height=layer_heigth, line_width=line_width, multiplier=number_slider_2, filament_diameter=filament_diameter)
panel_2 = Panel(flow_3)

panel_3 = Panel(flow_2)

# ----
# park + wipe
park_blue_semi_weaving_anchor_wrap = Panel("""; Start of park gcode blue
G1 F1000 Y250  ; Pull Y away
G1 F1000 X42.5  ; Pull X away
G1 F1000 Y76  ; approach Y
G1 F500 Z37 ; approach Z
G1 F4000 X60  ; wrap X
G1 F4000 Y26  ; approach Y
G1 F4000 X42.5  ; approach X
G1 F4000 X42.5 Y6 Z37  ; move to station
G1 F4000 X61.5 Y6 Z37  ; decouple needle
G1 F4000 X61.5 Y26 Z37  ; pull away
; end of park gcode v2""")
wipe = Panel("""; nozzle wipe G92 E0 ; zero extruder G1 E-0.5 F300 ; retract filament
G1 X55 Y262.5 F15000 ; nozzle wipe position start
G1 Z0.4; nozzle down (matching default z height when original wipe happens)
G1 X20 Y262.5 F15000 ; first wipe
G1 X20 Y262 F15000 ; Y down G1 X65 Y262 F15000 ; wipe
G1 X65 Y261.5 F15000 ; Y down G1 X20 Y261.5 F15000 ; wipe
G1 X20 Y261 F15000 ; Y down G1 X65 Y261 F15000 ; wipe
G1 X65 Y260.5 F15000 ; Y down G1 X20 Y260.5 F15000 ; wipe
G1 X20 Y260 F15000 ; Y down G1 X65 Y260 F15000 ; wipe
; end of park + wipe code""")

# ----
# pickup
pick_up_blue_planar_weaving = Panel("""; Start of pick up gcode blue
G91 ; relative positioning
G1 F500 Z35 ; Z offset
G90; absolute positioning
G1 F6000 X61.5 Y26 ; to pickup start XY
G1 F500 Z37 ; to pickup start Z
G1 F4000 X61.5 Y6 Z37  ; move to needle
G1 F4000 X42.5 Y6 Z37  ; lock in to needle
G1 F4000 X42.5 Y76 Z37  ; pull away
; end of pick up gcode v2""")

# ----
# Create Points at Y
yarn_distance = Panel(warp_distance)
division = Division(A="256", B=yarn_distance)
int = Integer(division)
xz = XZPlane(Origin=Point(0, 0, 0))
series = Series(Start=0, Step=yarn_distance, Count=int)
Y = UnitY(Factor=series)
move = Move(Geometry=xz, Motion=Y)  # -> Geometry, Transform

# ----
# Anchor outer diameter
number_slider_3 = Slider(1.25, range=0..10)
multiplication = Multiplication(A=yarn_distance, B=number_slider_3)

# ----
# Anchor radii
panel_4 = Panel("2")
division_2 = Division(A=warp_distance, B=panel_4)
division_3 = Division(A=multiplication, B="2")
dom_2 = ConstructDomain(DomainStart=division_2, DomainEnd=division_3)

# ----
# Min. to max. circle radius
domain = Domain(dom_2)

# ----
# Points for anchors
panel_5 = Panel("2")
division_4 = Division(A=yarn_distance, B=panel_5)
Y_2 = UnitY(Factor=division_4)
move_2 = Move(Geometry=move.Geometry, Motion=Y_2)  # -> Geometry, Transform

# ----
# Weaving path
flip = FlipCurve(Curve=crv_12, Guide=crv_13)  # -> Curve, Flag
panel_6 = Panel("""0
1""")

pcx = CurvePlane(Curve=flip.Curve, Plane=move_2.Geometry)  # -> Points, ParamsC, ParamsP

pcx_2 = CurvePlane(Curve=flip.Curve, Plane=move.Geometry)  # -> Points, ParamsC, ParamsP

dispatch = Dispatch(List=pcx_2.Points, DispatchPattern=[True, False])  # -> ListA, ListB

# ----
# Yarn lay-out
ln = Line(StartPoint=dispatch.ListA, EndPoint=dispatch.ListB)

# ----
# Cull branches with n<2
py3 = Python3Script(x=pcx.Points)  # -> out, a; inputs x: tree
# ---------- py3: Python ----------
import rhinoscriptsyntax as rs
from Grasshopper import DataTree
from Grasshopper.Kernel.Data import GH_Path

output = DataTree[object]()

for i, branch in enumerate(x.Branches):
    if len(branch) > 1:
        output.AddRange(branch, x.Path(i))

a = output
# ---------- end py3 ----------

pdecon_2 = Deconstruct(Point=py3.a)  # -> XComponent, YComponent, ZComponent
sort_2 = SortList(Keys=pdecon_2.XComponent, ValuesA=py3.a)  # -> Keys, ValuesA

# ----
# Interchangeing points
clean = CleanTree(RemoveNulls=True, RemoveInvalid=True, RemoveEmpty=True, Tree=sort_2.ValuesA)
lastdex = LastIndex(List=clean)
item = ListItem(List=clean, Index="0", Wrap=True)  # -> flatten(Item)
item_2 = ListItem(List=clean, Index=lastdex, Wrap=True)  # -> flatten(Item)
panel_7 = Panel("""1
0""")

# ----
# Cut warp in outline shape
panel_8 = Panel("0.5")

# ----
# Create arcs
panel_9 = Panel("270")
rad = Radians(Degrees=panel_9)
anchor_diameter = Panel(multiplication)

# ----
# Create anchor circles
layer_height = Panel(layer_heigth)
brim_layers = Panel(amount_of_top_bottom_layers)
multiplication_2 = Multiplication(A=brim_layers, B=layer_height)

dispatch_2 = Dispatch(List=item_2, DispatchPattern=panel_7)  # -> ListA, ListB
dispatch_3 = Dispatch(List=item, DispatchPattern=panel_7)  # -> ListA, ListB

weave = Weave(Pattern=panel_7, Stream0=dispatch_2.ListB, Stream1=dispatch_3.ListA, NullGaps=False)  # -> graft(Weave)

# ----
# Create travel lines
merge = Merge(Data1=dispatch_2.ListA, Data2=dispatch_3.ListB)
pdecon_3 = Deconstruct(Point=merge)  # -> XComponent, YComponent, ZComponent
sort_3 = SortList(Keys=pdecon_3.YComponent, ValuesA=merge)  # -> Keys, ValuesA
shift = ShiftList(List=sort_3.ValuesA, Shift=1, Wrap=False)
ln_2 = Line(StartPoint=shift, EndPoint=sort_3.ValuesA)

crv_cp = CurveClosestPoint(Point=flatten(weave), Curve=flip.Curve)  # -> Point, Parameter, Distance
eval = EvaluateCurve(Curve=flip.Curve, Parameter=crv_cp.Parameter)  # -> Point, Tangent, Angle
rotate = Rotate(Geometry=eval.Tangent, Angle=rad, Plane=PlaneXY(0, 0, 0))  # -> Geometry, Transform
unit = UnitVector(Vector=rotate.Geometry)
multiplication_3 = Multiplication(A=unit, B=anchor_diameter)
move_3 = Move(Geometry=flatten(weave), Motion=multiplication_3)  # -> Geometry, Transform
lastdex_2 = LastIndex(List=move_3.Geometry)
merge_2 = Merge(Data1=lastdex_2, Data2="0")
cull_i = CullIndex(List=move_3.Geometry, Indices=merge_2, Wrap=True)
shift_2 = ShiftList(List=sort_3.ValuesA, Shift="2", Wrap=False)
arc = Arc3Pt(PointA=sort_3.ValuesA, PointB=cull_i, PointC=shift_2)  # -> Arc, Plane, Radius
lastdex_3 = LastIndex(List=arc.Arc)
subtraction = Subtraction(A=lastdex_3, B="1")
merge_3 = Merge(Data1=lastdex_3, Data2=subtraction)

# ----
# Weaving arcs
cull_i_2 = CullIndex(List=arc.Arc, Indices=merge_3, Wrap=True)

# ----
# flip every 2nd warp
panel_10 = Panel("""0
1""")

# ----
# Create brims
brim_offset = Panel(division_4)
line_width_2 = Panel(line_width)
division_5 = Division(A=brim_offset, B=line_width_2)
int_2 = Integer(division_5)
addition = Addition(A=int_2, B=Slider(1, range=0..1))
series_2 = Series(Start=0, Step=line_width_2, Count=addition)
# Brim
cull_i_3 = CullIndex(List=series_2, Indices=0, Wrap=True)
crv_15 = Curve(flatten(crv_10))
neg = Negative(Value=cull_i_3)
rev = ReverseList(List=neg)
merge_4 = Merge(Data1=flatten(rev), Data2=flatten(series_2))
offset = OffsetCurve(Curve=crv_15, Distance=merge_4, Corners=1)  # -> flatten(Curve)

# ----
# Inner outline curve
item_3 = ListItem(List=offset, Index=0, Wrap=True)

ccx = CurveCurve(CurveA=item_3, CurveB=crv_14)  # -> Points, ParamsA, ParamsB
simplify = SimplifyTree(Tree=ccx.ParamsB, Front=False)
shatter = Shatter(Curve=graft(crv_14), Parameters=simplify)
eval_2 = EvaluateCurve(Curve=reparameterize(shatter), Parameter=panel_8)  # -> Point, Tangent, Angle
incurve = PointInCurve(Point=eval_2.Point, Curve=item_3)  # -> Relationship, Point
cull = CullPattern(List=shatter, CullPattern=incurve.Relationship)

dispatch_4 = Dispatch(List=flatten(cull), DispatchPattern=panel_10)  # -> ListA, ListB
# Warp
flip_2 = FlipCurve(Curve=dispatch_4.ListA)  # -> Curve, Flag
weave_2 = Weave(Pattern=[0, 1], Stream0=dispatch_4.ListB, Stream1=flip_2.Curve, NullGaps=False)

# ----
# Create top & bottom warp layers
amount_of_anchor_layers = Slider(5, range=0..10)
layer_height_2 = Panel(layer_heigth)
addition_2 = Addition(A=amount_of_top_bottom_layers, B=amount_of_anchor_layers)
x_minus_one = XMinusOne(NumberX=addition_2)
multiplication_4 = Multiplication(A=layer_height_2, B=x_minus_one)
addition_3 = Addition(B=multiplication_4)
series_3 = Series(Start=0, Step=layer_height_2, Count=amount_of_top_bottom_layers)
series_4 = Series(Start=addition_3, Step=layer_height_2, Count=amount_of_top_bottom_layers)
Z = UnitZ(Factor=series_3)  # -> graft(UnitVector)
Z_2 = UnitZ(Factor=series_4)  # -> graft(UnitVector)
move_4 = Move(Geometry=flatten(weave_2), Motion=Z)  # -> Geometry, Transform
move_5 = Move(Geometry=flatten(weave_2), Motion=Z_2)  # -> Geometry, Transform

anchor_layers = Panel(amount_of_anchor_layers)
series_5 = Series(Start=multiplication_2, Step=layer_height, Count=anchor_layers)
subtraction_2 = Subtraction(A=anchor_layers, B="1")
Z_3 = UnitZ(Factor=series_5)
move_6 = Move(Geometry=weave, Motion=Z_3)  # -> Geometry, Transform
range_2 = Range(Domain=domain, Steps=subtraction_2)
cir = Circle(Plane=move_6.Geometry, Radius=range_2)

# ----
# Points by pillar
pt = Point(move_6.Geometry)

# ----
# Anchor circles by anchor
crv_16 = Curve(cir)

# ----
# Anchors
flip_3 = FlipMatrix(Data=pt)
simplify_2 = SimplifyTree(Tree=crv_16, Front=False)

# ----
# Points by layer
pt_2 = Point(flip_3)

# ----
# Anchor circles by layer
flip_4 = FlipMatrix(Data=simplify_2)

# ----
# Adjust circle seams
shift_3 = ShiftList(List=pt_2, Shift=1, Wrap=True)
vec2pt = Vector2Pt(PointA=pt_2, PointB=shift_3, Unitize=False)  # -> Vector, Length
unit_2 = UnitVector(Vector=vec2pt.Vector)
neg_2 = Negative(Value=unit_2)
move_7 = Move(Geometry=pt_2, Motion=neg_2)  # -> Geometry, Transform
crv_cp_2 = CurveClosestPoint(Point=move_7.Geometry, Curve=flip_4)  # -> Point, Parameter, Distance
seam = Seam(Curve=flip_4, Seam=crv_cp_2.Parameter)

# ----
# Retraction travel points
eval_3 = EvaluateCurve(Curve=flip_4, Parameter=crv_cp_2.Parameter)  # -> graft(Point), Tangent, Angle
multiplication_5 = Multiplication(A=neg_2, B=Slider(10, range=0..50))  # -> graft(Result)
move_8 = Move(Geometry=eval_3.Point, Motion=multiplication_5)  # -> Geometry, Transform
simplify_3 = SimplifyTree(Tree=move_8.Geometry, Front=False)

move_9 = Move(Geometry=flatten(offset), Motion=Z_2)  # -> Geometry, Transform
move_10 = Move(Geometry=flatten(offset), Motion=Z)  # -> Geometry, Transform

# ----
# Anchor pillars adjusted seams
simplify_4 = SimplifyTree(Tree=seam, Front=False)
flip_5 = FlipMatrix(Data=simplify_4)

# ----
# Top warp
simplify_5 = SimplifyTree(Tree=move_5.Geometry, Front=False)

# ----
# Bottom warp
simplify_6 = SimplifyTree(Tree=move_4.Geometry, Front=False)

# ----
# Bottom brim
simplify_7 = SimplifyTree(Tree=move_10.Geometry, Front=False)

# ----
# Top brim
simplify_8 = SimplifyTree(Tree=move_9.Geometry, Front=False)

# ----
# Divide circles into points
number_slider_4 = Slider(10, range=0..100)
divide = DivideCurve(Curve=flip_5, Count=number_slider_4, Kinks=False)  # -> Points, Tangents, Parameters
trim = TrimTree(Tree=divide.Points, Depth=1)

# ----
# Divide brim curves into points
number_slider_5 = Slider(100, range=0..100)
divide_2 = DivideCurve(Curve=simplify_8, Count=number_slider_5, Kinks=False)  # -> Points, Tangents, Parameters

# ----
# Divide warp curves into points
number_slider_6 = Slider(100, range=0..100)
divide_3 = DivideCurve(Curve=simplify_5, Count=number_slider_6, Kinks=False)  # -> Points, Tangents, Parameters

pline = PolyLine(Vertices=trim, Closed=Toggle(False))
explode = Explode(Curve=pline, Recursive=True)  # -> Segments, Vertices

pline_2 = PolyLine(Vertices=divide_3.Points, Closed=False)
explode_2 = Explode(Curve=pline_2, Recursive=True)  # -> Segments, Vertices

len = Length(Curve=explode.Segments)
multiplication_6 = Multiplication(A=len, B=flow)

# ----
# Fixation circles
pt_3 = Point(flatten(weave))
lastdex_4 = LastIndex(List=sort_3.ValuesA)
lastdex_5 = LastIndex(List=pt_3)
subtraction_3 = Subtraction(A=lastdex_4, B="1")
item_4 = ListItem(List=pt_3, Index="0", Wrap=True)
item_5 = ListItem(List=sort_3.ValuesA, Index="1", Wrap=True)
item_6 = ListItem(List=pt_3, Index=lastdex_5, Wrap=True)
item_7 = ListItem(List=sort_3.ValuesA, Index=subtraction_3, Wrap=True)
dist = Distance(PointA=item_4, PointB=item_5)
dist_2 = Distance(PointA=item_6, PointB=item_7)
cir_2 = Circle(Plane=item_4, Radius=dist)
cir_3 = Circle(Plane=item_6, Radius=dist_2)
lastdex_6 = LastIndex(List=shift)
item_8 = ListItem(List=shift, Index=0, Wrap=True)
item_9 = ListItem(List=shift, Index=lastdex_6, Wrap=True)
crv_cp_3 = CurveClosestPoint(Point=item_8, Curve=cir_2)  # -> Point, Parameter, Distance
crv_cp_4 = CurveClosestPoint(Point=item_9, Curve=cir_3)  # -> Point, Parameter, Distance

# ----
# Starting circle
seam_2 = Seam(Curve=cir_2, Seam=crv_cp_3.Parameter)

# ----
# Ending circle
seam_3 = Seam(Curve=cir_3, Seam=crv_cp_4.Parameter)

flip_6 = FlipCurve(Curve=seam_2)  # -> Curve, Flag

weave_3 = Weave(Pattern=panel_6, Stream0=ln_2, Stream1=cull_i_2, NullGaps=False)
clean_2 = CleanTree(RemoveNulls=True, RemoveInvalid=True, RemoveEmpty=False, Tree=weave_3)
merge_5 = Merge(Data1=flatten(flip_6.Curve), Data2=flatten(clean_2), Data3=flatten(seam_3))

# ----
# weaving path
crv_17 = Curve(merge_5)

# ----
# Divide weaving curves into points
number_slider_7 = Slider(200, range=0..10000)
divide_4 = DivideCurve(Curve=crv_17, Count=number_slider_7, Kinks=False)  # -> Points, Tangents, Parameters

# ----
# Y to weaving start
item_10 = ListItem(List=flatten(divide_4.Points), Index=0, Wrap=True)
speed_mm_s = Slider(75, range=0..500)
pdecon_4 = Deconstruct(Point=item_10)  # -> XComponent, YComponent, ZComponent
needle_y_offset_2 = Panel(needle_y_offset)
addition_4 = Addition(A=pdecon_4.YComponent, B=needle_y_offset_2)
mm_min = Multiplication(A=speed_mm_s, B=Slider(60, range=0..100))
Y_3 = Text(" Y")
g1 = Text("G1 ")
F = Text("F")
concat = Concatenate(FragmentH=g1, FragmentG=F, FragmentL=mm_min, FragmentC=Y_3, FragmentD=addition_4)
xy_to_weaving_start = Panel(concat)

# ----
# X to weaving start
item_11 = ListItem(List=flatten(divide_4.Points), Index=0, Wrap=True)
speed_mm_s_2 = Slider(75, range=0..500)
pdecon_5 = Deconstruct(Point=item_11)  # -> XComponent, YComponent, ZComponent
mm_min_2 = Multiplication(A=speed_mm_s_2, B=Slider(60, range=0..100))
X = Text(" X")
g1_2 = Text("G1 ")
F_2 = Text("F")
concat_2 = Concatenate(FragmentH=g1_2, FragmentG=F_2, FragmentL=mm_min_2, FragmentA=X, FragmentB=pdecon_5.XComponent)
xy_to_weaving_start_2 = Panel(concat_2)

# ----
# Weaving path
needle_y_offset_3 = Panel(needle_y_offset)
needle_z_offset_2 = Panel(needle_z_offset)
pdecon_6 = Deconstruct(Point=divide_4.Points)  # -> XComponent, YComponent, ZComponent
addition_5 = Addition(A=pdecon_6.YComponent, B=needle_y_offset_3)
addition_6 = Addition(A=pdecon_6.ZComponent, B=needle_z_offset_2)
mm_min_3 = Multiplication(A=weaving_speed_mm_s, B=Slider(60, range=0..100))
g1_3 = Text("G1 ")
F_3 = Text("F")
X_2 = Text(" X")
Y_4 = Text(" Y")
Z_4 = Text(" Z")
concat_3 = Concatenate(
    FragmentH=g1_3,
    FragmentG=F_3,
    FragmentL=mm_min_3,
    FragmentA=X_2,
    FragmentB=pdecon_6.XComponent,
    FragmentC=Y_4,
    FragmentD=addition_5,
    FragmentE=Z_4,
    FragmentF=addition_6)
weaving_sequence = Panel(concat_3)

# ----
# Anchors
starting_z_height_mm_2 = Panel(starting_z_height_mm)
split = SplitList(List=explode.Vertices, Index=1)  # -> ListA, ListB

# ----
# Circles starting points
simplify_9 = SimplifyTree(Tree=split.ListA, Front=False)

# ----
# Circles printing points
simplify_10 = SimplifyTree(Tree=split.ListB, Front=False)

# ----
# Travel to first point
speed_mm_s_3 = Slider(75, range=0..1000)
pdecon_7 = Deconstruct(Point=simplify_9)  # -> XComponent, YComponent, ZComponent
addition_7 = Addition(A=pdecon_7.ZComponent, B=starting_z_height_mm_2)
addition_8 = Addition(A=addition_7, B=z_hop_mm)
mm_min_4 = Multiplication(A=speed_mm_s_3, B=Slider(60, range=0..100))
Z_5 = Text(" Z")
X_3 = Text(" X")
Y_5 = Text(" Y")
g1_4 = Text("G1 ")
F_4 = Text("F")
concat_4 = Concatenate(
    FragmentH=g1_4,
    FragmentG=F_4,
    FragmentL=mm_min_4,
    FragmentA=X_3,
    FragmentB=pdecon_7.XComponent,
    FragmentC=Y_5,
    FragmentD=pdecon_7.YComponent,
    FragmentE=Z_5,
    FragmentF=addition_8)
travel_to_the_first_point = Panel(concat_4)

# ----
# Perpendicular retraction travel
speed_mm_s_4 = Slider(150, range=0..1000)
pdecon_8 = Deconstruct(Point=simplify_3)  # -> XComponent, YComponent, ZComponent
addition_9 = Addition(A=pdecon_8.ZComponent, B=starting_z_height_mm_2)
addition_10 = Addition(A=addition_9, B=z_hop_mm)
mm_min_5 = Multiplication(A=speed_mm_s_4, B=Slider(60, range=0..100))
Z_6 = Text(" Z")
X_4 = Text(" X")
Y_6 = Text(" Y")
g1_5 = Text("G1 ")
F_5 = Text("F")
concat_5 = Concatenate(
    FragmentH=g1_5,
    FragmentG=F_5,
    FragmentL=mm_min_5,
    FragmentA=X_4,
    FragmentB=pdecon_8.XComponent,
    FragmentC=Y_6,
    FragmentD=pdecon_8.YComponent,
    FragmentE=Z_6,
    FragmentF=addition_10)
perpendicular_retraction_travel = Panel(concat_5)

pdecon_9 = Deconstruct(Point=simplify_10)  # -> XComponent, YComponent, ZComponent
ma = MassAddition(Input=multiplication_6)  # -> Result, PartialResults
simplify_11 = SimplifyTree(Tree=ma.PartialResults, Front=False)
addition_11 = Addition(A=pdecon_9.ZComponent, B=starting_z_height_mm_2)
mm_min_6 = Multiplication(A=anchors_print_speed_mm_s, B=Slider(60, range=0..100))
g1_6 = Text("G1 ")
F_6 = Text("F")
X_5 = Text(" X")
Y_7 = Text(" Y")
Z_7 = Text(" Z")
E = Text(" E")
concat_6 = Concatenate(
    FragmentH=g1_6,
    FragmentG=F_6,
    FragmentL=mm_min_6,
    FragmentA=X_5,
    FragmentB=pdecon_9.XComponent,
    FragmentC=Y_7,
    FragmentD=pdecon_9.YComponent,
    FragmentE=Z_7,
    FragmentF=addition_11,
    FragmentJ=E,
    FragmentK=simplify_11)
panel_11 = Panel(concat_6)

lastdex_7 = LastIndex(List=simplify_11)
item_12 = ListItem(List=simplify_11, Index=lastdex_7, Wrap=True)

lastdex_8 = LastIndex(List=addition_11)
item_13 = ListItem(List=addition_11, Index=lastdex_8, Wrap=True)

# ----
# Retraction move
retract_peed_mm_s = Slider(50, range=0..100)
extrusion_retraction_mm = Slider(1.5, range=0..5)
mm_min_7 = Multiplication(A=retract_peed_mm_s, B=Slider(60, range=0..100))
addition_12 = Addition(A=item_13, B=z_hop_mm)
subtraction_4 = Subtraction(A=item_12, B=extrusion_retraction_mm)
g1_7 = Text("G1 ")
F_7 = Text("F")
F_8 = Text(" Z")
text = Text(" E")
concat_7 = Concatenate(
    FragmentA=g1_7,
    FragmentB=F_7,
    FragmentC=mm_min_7,
    FragmentF=F_8,
    FragmentG=addition_12,
    FragmentD=text,
    FragmentE=subtraction_4)
retraction_z_hop = Panel(concat_7)

# ----
# Drop Z and re-prime filament
speed_mm_s_5 = Slider(20, range=0..100)
lng = ListLength(List=simplify_9)
pdecon_10 = Deconstruct(Point=simplify_9)  # -> XComponent, YComponent, ZComponent
addition_13 = Addition(A=pdecon_10.ZComponent, B=starting_z_height_mm_2)
mm_min_8 = Multiplication(A=speed_mm_s_5, B=Slider(60, range=0..100))
g1_8 = Text("G1 ")
F_9 = Text("F")
E_2 = Text(" E")
Z_8 = Text(" Z")
concat_8 = Concatenate(
    FragmentH=g1_8,
    FragmentG=F_9,
    FragmentL=mm_min_8,
    FragmentE=Z_8,
    FragmentF=addition_13,
    FragmentA=E_2,
    FragmentB=extrusion_retraction_mm)
z_drop_reprime = Panel(concat_8)
repeat = RepeatData(Data="G92 E0       ;Reset extruder", Length=lng)
simplify_12 = SimplifyTree(Tree=repeat, Front=False)
merge_6 = Merge(Data1=simplify_12, Data2=z_drop_reprime, Data3=simplify_12)
z_drop_reprime_reset = Panel(merge_6)

merge_7 = Merge(Data1=travel_to_the_first_point, Data2=z_drop_reprime_reset, Data3=panel_11, Data4=retraction_z_hop)
panel_12 = Panel(merge_7)

# ----
# Top weft
starting_z_height = Panel(starting_z_height_mm)
split_2 = SplitList(List=explode_2.Vertices, Index=1)  # -> ListA, ListB
simplify_13 = SimplifyTree(Tree=split_2.ListA, Front=False)

flow_4 = Flow(layer_height=layer_heigth, line_width=line_width, multiplier=C_2, filament_diameter=filament_diameter)
simplify_14 = SimplifyTree(Tree=split_2.ListB, Front=False)

len_2 = Length(Curve=explode_2.Segments)
multiplication_7 = Multiplication(A=len_2, B=flow_4)

speed_mm_s_6 = Slider(50, range=0..200)
pdecon_11 = Deconstruct(Point=simplify_13)  # -> XComponent, YComponent, ZComponent
addition_14 = Addition(A=pdecon_11.ZComponent, B=starting_z_height)
addition_15 = Addition(A=addition_14, B=z_hop_mm_2)
mm_min_9 = Multiplication(A=speed_mm_s_6, B=Slider(60, range=0..100))
Z_9 = Text(" Z")
X_6 = Text(" X")
Y_8 = Text(" Y")
F_10 = Text("F")
g1_9 = Text("G1 ")
concat_9 = Concatenate(
    FragmentH=g1_9,
    FragmentG=F_10,
    FragmentL=mm_min_9,
    FragmentA=X_6,
    FragmentB=pdecon_11.XComponent,
    FragmentC=Y_8,
    FragmentD=pdecon_11.YComponent,
    FragmentE=Z_9,
    FragmentF=addition_15)
travel_to_the_first_point_2 = Panel(concat_9)

# ----
# print
pdecon_12 = Deconstruct(Point=simplify_14)  # -> XComponent, YComponent, ZComponent
ma_2 = MassAddition(Input=multiplication_7)  # -> Result, PartialResults
simplify_15 = SimplifyTree(Tree=ma_2.PartialResults, Front=False)
addition_16 = Addition(A=pdecon_12.ZComponent, B=starting_z_height)
mm_min_10 = Multiplication(A=top_layers_print_speed_mm_s, B=Slider(60, range=0..100))
g1_10 = Text("G1 ")
F_11 = Text("F")
X_7 = Text(" X")
Y_9 = Text(" Y")
Z_10 = Text(" Z")
E_3 = Text(" E")
concat_10 = Concatenate(
    FragmentH=g1_10,
    FragmentG=F_11,
    FragmentL=mm_min_10,
    FragmentA=X_7,
    FragmentB=pdecon_12.XComponent,
    FragmentC=Y_9,
    FragmentD=pdecon_12.YComponent,
    FragmentE=Z_10,
    FragmentF=addition_16,
    FragmentJ=E_3,
    FragmentK=simplify_15)
panel_13 = Panel(concat_10)

lastdex_9 = LastIndex(List=simplify_15)
item_14 = ListItem(List=simplify_15, Index=lastdex_9, Wrap=True)

lastdex_10 = LastIndex(List=addition_16)
item_15 = ListItem(List=addition_16, Index=lastdex_10, Wrap=True)

retract_peed_mm_s_2 = Slider(30, range=0..100)
extrusion_retraction_mm_2 = Slider(1, range=0..5)
mm_min_11 = Multiplication(A=retract_peed_mm_s_2, B=Slider(60, range=0..100))
addition_17 = Addition(A=item_15, B=z_hop_mm_2)
F_12 = Text(" Z")
text_2 = Text(" E")
subtraction_5 = Subtraction(A=item_14, B=extrusion_retraction_mm_2)
g1_11 = Text("G1 ")
F_13 = Text("F")
concat_11 = Concatenate(
    FragmentA=g1_11,
    FragmentB=F_13,
    FragmentC=mm_min_11,
    FragmentF=F_12,
    FragmentG=addition_17,
    FragmentD=text_2,
    FragmentE=subtraction_5)
retraction_z_hop_2 = Panel(concat_11)

speed_mm_s_7 = Slider(25, range=0..100)
lng_2 = ListLength(List=simplify_13)
pdecon_13 = Deconstruct(Point=simplify_13)  # -> XComponent, YComponent, ZComponent
addition_18 = Addition(A=pdecon_13.ZComponent, B=starting_z_height)
mm_min_12 = Multiplication(A=speed_mm_s_7, B=Slider(60, range=0..100))
g1_12 = Text("G1 ")
F_14 = Text("F")
Z_11 = Text(" Z")
E_4 = Text(" E")
concat_12 = Concatenate(
    FragmentH=g1_12,
    FragmentG=F_14,
    FragmentL=mm_min_12,
    FragmentE=Z_11,
    FragmentF=addition_18,
    FragmentA=E_4,
    FragmentB=extrusion_retraction_mm_2)
z_drop_reprime_2 = Panel(concat_12)
repeat_2 = RepeatData(Data="G92 E0       ;Reset extruder", Length=lng_2)
simplify_16 = SimplifyTree(Tree=repeat_2, Front=False)
merge_8 = Merge(Data1=simplify_16, Data2=z_drop_reprime_2, Data3=simplify_16)
z_drop_reprime_reset_2 = Panel(merge_8)

merge_9 = Merge(Data1=travel_to_the_first_point_2, Data2=z_drop_reprime_reset_2, Data3=panel_13, Data4=retraction_z_hop_2)
panel_14 = Panel(merge_9)

# ----
# Top brim
starting_z_height_mm_3 = Panel(starting_z_height)
z_hop = Panel(z_hop_mm_2)

pline_3 = PolyLine(Vertices=divide_2.Points, Closed=Toggle(True))
explode_3 = Explode(Curve=pline_3, Recursive=True)  # -> Segments, Vertices

len_3 = Length(Curve=explode_3.Segments)
multiplication_8 = Multiplication(A=len_3, B=flow_2)

# ----
# printing points
simplify_17 = SimplifyTree(Tree=explode_3.Vertices, Front=False)

pdecon_14 = Deconstruct(Point=simplify_17)  # -> XComponent, YComponent, ZComponent
ma_3 = MassAddition(Input=multiplication_8)  # -> Result, PartialResults
simplify_18 = SimplifyTree(Tree=ma_3.PartialResults, Front=False)
addition_19 = Addition(A=pdecon_14.ZComponent, B=starting_z_height_mm_3)
mm_min_13 = Multiplication(A=top_layers_print_speed_mm_s, B=Slider(60, range=0..100))
g1_13 = Text("G1 ")
F_15 = Text("F")
X_8 = Text(" X")
Y_10 = Text(" Y")
Z_12 = Text(" Z")
E_5 = Text(" E")
concat_13 = Concatenate(
    FragmentH=g1_13,
    FragmentG=F_15,
    FragmentL=mm_min_13,
    FragmentA=X_8,
    FragmentB=pdecon_14.XComponent,
    FragmentC=Y_10,
    FragmentD=pdecon_14.YComponent,
    FragmentE=Z_12,
    FragmentF=addition_19,
    FragmentJ=E_5,
    FragmentK=simplify_18)
panel_15 = Panel(concat_13)

lastdex_11 = LastIndex(List=simplify_18)
item_16 = ListItem(List=simplify_18, Index=lastdex_11, Wrap=True)

lastdex_12 = LastIndex(List=addition_19)
item_17 = ListItem(List=addition_19, Index=lastdex_12, Wrap=True)

# ----
# Retraction move
retract_peed_mm_s_3 = Slider(25, range=0..100)
extrusion_retraction_mm_3 = Slider(0.05, range=0..5)
mm_min_14 = Multiplication(A=retract_peed_mm_s_3, B=Slider(60, range=0..100))
addition_20 = Addition(A=item_17, B=z_hop)
subtraction_6 = Subtraction(A=item_16, B=extrusion_retraction_mm_3)
g1_14 = Text("G1 ")
F_16 = Text("F")
F_17 = Text(" Z")
text_3 = Text(" E")
concat_14 = Concatenate(
    FragmentA=g1_14,
    FragmentB=F_16,
    FragmentC=mm_min_14,
    FragmentF=F_17,
    FragmentG=addition_20,
    FragmentD=text_3,
    FragmentE=subtraction_6)
retraction_z_hop_3 = Panel(concat_14)

# ----
# Bottom brim
starting_z_height_mm_4 = Panel(starting_z_height)
z_hop_2 = Panel(z_hop_mm_2)
divide_5 = DivideCurve(Curve=simplify_7, Count=number_slider_5, Kinks=False)  # -> Points, Tangents, Parameters

pline_4 = PolyLine(Vertices=divide_5.Points, Closed=toggle)
explode_4 = Explode(Curve=pline_4, Recursive=True)  # -> Segments, Vertices

len_4 = Length(Curve=explode_4.Segments)
multiplication_9 = Multiplication(A=len_4, B=flow_3)

# ----
# Bottom weft
divide_6 = DivideCurve(Curve=simplify_6, Count=number_slider_6, Kinks=False)  # -> Points, Tangents, Parameters

pline_5 = PolyLine(Vertices=divide_6.Points, Closed=False)
explode_5 = Explode(Curve=pline_5, Recursive=True)  # -> Segments, Vertices

split_3 = SplitList(List=explode_5.Vertices, Index=1)  # -> ListA, ListB
simplify_19 = SimplifyTree(Tree=split_3.ListA, Front=False)

flow_5 = Flow(layer_height=layer_heigth, line_width=line_width, multiplier=number_slider_2, filament_diameter=filament_diameter)
simplify_20 = SimplifyTree(Tree=split_3.ListB, Front=False)
panel_16 = Panel(flow_5)

len_5 = Length(Curve=explode_5.Segments)
multiplication_10 = Multiplication(A=len_5, B=flow_5)

speed_mm_s_8 = Slider(100, range=0..200)
pdecon_15 = Deconstruct(Point=simplify_19)  # -> XComponent, YComponent, ZComponent
addition_21 = Addition(A=pdecon_15.ZComponent, B=starting_z_height)
addition_22 = Addition(A=addition_21, B=z_hop_mm_2)
mm_min_15 = Multiplication(A=speed_mm_s_8, B=Slider(60, range=0..100))
X_9 = Text(" X")
Y_11 = Text(" Y")
Z_13 = Text(" Z")
F_18 = Text("F")
g1_15 = Text("G1 ")
concat_15 = Concatenate(
    FragmentH=g1_15,
    FragmentG=F_18,
    FragmentL=mm_min_15,
    FragmentA=X_9,
    FragmentB=pdecon_15.XComponent,
    FragmentC=Y_11,
    FragmentD=pdecon_15.YComponent,
    FragmentE=Z_13,
    FragmentF=addition_22)
travel_to_the_first_point_3 = Panel(concat_15)

# ----
# Print
pdecon_16 = Deconstruct(Point=simplify_20)  # -> XComponent, YComponent, ZComponent
ma_4 = MassAddition(Input=multiplication_10)  # -> Result, PartialResults
addition_23 = Addition(A=pdecon_16.ZComponent, B=starting_z_height)
simplify_21 = SimplifyTree(Tree=ma_4.PartialResults, Front=False)
mm_min_16 = Multiplication(A=bottom_layers_print_speed_mm_s, B=Slider(60, range=0..100))
E_6 = Text(" E")
Z_14 = Text(" Z")
g1_16 = Text("G1 ")
F_19 = Text("F")
X_10 = Text(" X")
Y_12 = Text(" Y")
concat_16 = Concatenate(
    FragmentH=g1_16,
    FragmentG=F_19,
    FragmentL=mm_min_16,
    FragmentA=X_10,
    FragmentB=pdecon_16.XComponent,
    FragmentC=Y_12,
    FragmentD=pdecon_16.YComponent,
    FragmentE=Z_14,
    FragmentF=addition_23,
    FragmentJ=E_6,
    FragmentK=simplify_21)
panel_17 = Panel(concat_16)

lastdex_13 = LastIndex(List=simplify_21)
item_18 = ListItem(List=simplify_21, Index=lastdex_13, Wrap=True)

lastdex_14 = LastIndex(List=addition_23)
item_19 = ListItem(List=addition_23, Index=lastdex_14, Wrap=True)

retract_peed_mm_s_4 = Slider(30, range=0..100)
extrusion_retraction_mm_4 = Slider(1, range=0..5)
mm_min_17 = Multiplication(A=retract_peed_mm_s_4, B=Slider(60, range=0..100))
addition_24 = Addition(A=item_19, B=z_hop_mm_2)
F_20 = Text(" Z")
text_4 = Text(" E")
subtraction_7 = Subtraction(A=item_18, B=extrusion_retraction_mm_4)
g1_17 = Text("G1 ")
F_21 = Text("F")
concat_17 = Concatenate(
    FragmentA=g1_17,
    FragmentB=F_21,
    FragmentC=mm_min_17,
    FragmentF=F_20,
    FragmentG=addition_24,
    FragmentD=text_4,
    FragmentE=subtraction_7)
retraction_z_hop_4 = Panel(concat_17)

speed_mm_s_9 = Slider(25, range=0..100)
lng_3 = ListLength(List=simplify_19)
pdecon_17 = Deconstruct(Point=simplify_19)  # -> XComponent, YComponent, ZComponent
addition_25 = Addition(A=pdecon_17.ZComponent, B=starting_z_height)
mm_min_18 = Multiplication(A=speed_mm_s_9, B=Slider(60, range=0..100))
g1_18 = Text("G1 ")
F_22 = Text("F")
Z_15 = Text(" Z")
E_7 = Text(" E")
concat_18 = Concatenate(
    FragmentH=g1_18,
    FragmentG=F_22,
    FragmentL=mm_min_18,
    FragmentE=Z_15,
    FragmentF=addition_25,
    FragmentA=E_7,
    FragmentB=extrusion_retraction_mm_4)
z_drop_reprime_3 = Panel(concat_18)
repeat_3 = RepeatData(Data="G92 E0       ;Reset extruder", Length=lng_3)
simplify_22 = SimplifyTree(Tree=repeat_3, Front=False)
merge_10 = Merge(Data1=simplify_22, Data2=z_drop_reprime_3, Data3=simplify_22)
z_drop_reprime_reset_3 = Panel(merge_10)

merge_11 = Merge(Data1=travel_to_the_first_point_3, Data2=z_drop_reprime_reset_3, Data3=panel_17, Data4=retraction_z_hop_4)
panel_18 = Panel(merge_11)

split_4 = SplitList(List=explode_4.Vertices, Index=1)  # -> ListA, ListB

# ----
# paths starting points
simplify_23 = SimplifyTree(Tree=split_4.ListA, Front=False)

# ----
# Circles printing points
simplify_24 = SimplifyTree(Tree=split_4.ListB, Front=False)

# ----
# Travel to first point
speed_mm_s_10 = Slider(50, range=0..200)
pdecon_18 = Deconstruct(Point=simplify_23)  # -> XComponent, YComponent, ZComponent
addition_26 = Addition(A=pdecon_18.ZComponent, B=starting_z_height_mm_4)
addition_27 = Addition(A=addition_26, B=z_hop_2)
mm_min_19 = Multiplication(A=speed_mm_s_10, B=Slider(60, range=0..100))
Z_16 = Text(" Z")
X_11 = Text(" X")
Y_13 = Text(" Y")
g1_19 = Text("G1 ")
F_23 = Text("F")
concat_19 = Concatenate(
    FragmentH=g1_19,
    FragmentG=F_23,
    FragmentL=mm_min_19,
    FragmentA=X_11,
    FragmentB=pdecon_18.XComponent,
    FragmentC=Y_13,
    FragmentD=pdecon_18.YComponent,
    FragmentE=Z_16,
    FragmentF=addition_27)
travel_to_the_first_point_4 = Panel(concat_19)

pdecon_19 = Deconstruct(Point=simplify_24)  # -> XComponent, YComponent, ZComponent
ma_5 = MassAddition(Input=multiplication_9)  # -> Result, PartialResults
simplify_25 = SimplifyTree(Tree=ma_5.PartialResults, Front=False)
addition_28 = Addition(A=pdecon_19.ZComponent, B=starting_z_height_mm_4)
mm_min_20 = Multiplication(A=bottom_layers_print_speed_mm_s, B=Slider(60, range=0..100))
g1_20 = Text("G1 ")
F_24 = Text("F")
X_12 = Text(" X")
Y_14 = Text(" Y")
Z_17 = Text(" Z")
E_8 = Text(" E")
concat_20 = Concatenate(
    FragmentH=g1_20,
    FragmentG=F_24,
    FragmentL=mm_min_20,
    FragmentA=X_12,
    FragmentB=pdecon_19.XComponent,
    FragmentC=Y_14,
    FragmentD=pdecon_19.YComponent,
    FragmentE=Z_17,
    FragmentF=addition_28,
    FragmentJ=E_8,
    FragmentK=simplify_25)
panel_19 = Panel(concat_20)

# ----
# E of last point in circle
lastdex_15 = LastIndex(List=simplify_25)
item_20 = ListItem(List=simplify_25, Index=lastdex_15, Wrap=True)

# ----
# Z of last point in circle
lastdex_16 = LastIndex(List=addition_28)
item_21 = ListItem(List=addition_28, Index=lastdex_16, Wrap=True)

# ----
# Retraction move
retract_peed_mm_s_5 = Slider(25, range=0..100)
extrusion_retraction_mm_5 = Slider(0.05, range=0..5)
mm_min_21 = Multiplication(A=retract_peed_mm_s_5, B=Slider(60, range=0..100))
addition_29 = Addition(A=item_21, B=z_hop_2)
subtraction_8 = Subtraction(A=item_20, B=extrusion_retraction_mm_5)
g1_21 = Text("G1 ")
F_25 = Text("F")
F_26 = Text(" Z")
text_5 = Text(" E")
concat_21 = Concatenate(
    FragmentA=g1_21,
    FragmentB=F_25,
    FragmentC=mm_min_21,
    FragmentF=F_26,
    FragmentG=addition_29,
    FragmentD=text_5,
    FragmentE=subtraction_8)
retraction_z_hop_5 = Panel(concat_21)

# ----
# Drop Z and re-prime filament
speed_mm_s_11 = Slider(25, range=0..100)
lng_4 = ListLength(List=simplify_23)
pdecon_20 = Deconstruct(Point=simplify_23)  # -> XComponent, YComponent, ZComponent
addition_30 = Addition(A=pdecon_20.ZComponent, B=starting_z_height_mm_4)
mm_min_22 = Multiplication(A=speed_mm_s_11, B=Slider(60, range=0..100))
g1_22 = Text("G1 ")
F_27 = Text("F")
E_9 = Text(" E")
Z_18 = Text(" Z")
concat_22 = Concatenate(
    FragmentH=g1_22,
    FragmentG=F_27,
    FragmentL=mm_min_22,
    FragmentE=Z_18,
    FragmentF=addition_30,
    FragmentA=E_9,
    FragmentB=extrusion_retraction_mm_5)
z_drop_reprime_4 = Panel(concat_22)
repeat_4 = RepeatData(Data="G92 E0       ;Reset extruder", Length=lng_4)
simplify_26 = SimplifyTree(Tree=repeat_4, Front=False)
merge_12 = Merge(Data1=simplify_26, Data2=z_drop_reprime_4, Data3=simplify_26)
z_drop_reprime_reset_4 = Panel(merge_12)

merge_13 = Merge(Data1=travel_to_the_first_point_4, Data2=z_drop_reprime_reset_4, Data3=panel_19, Data4=retraction_z_hop_5)
panel_20 = Panel(merge_13)

split_5 = SplitList(List=explode_3.Vertices, Index=1)  # -> ListA, ListB

# ----
# paths starting points
simplify_27 = SimplifyTree(Tree=split_5.ListA, Front=False)

# ----
# Drop Z and re-prime filament
speed_mm_s_12 = Slider(25, range=0..100)
lng_5 = ListLength(List=simplify_27)
pdecon_21 = Deconstruct(Point=simplify_27)  # -> XComponent, YComponent, ZComponent
addition_31 = Addition(A=pdecon_21.ZComponent, B=starting_z_height_mm_3)
mm_min_23 = Multiplication(A=speed_mm_s_12, B=Slider(60, range=0..100))
g1_23 = Text("G1 ")
F_28 = Text("F")
Z_19 = Text(" Z")
E_10 = Text(" E")
concat_23 = Concatenate(
    FragmentH=g1_23,
    FragmentG=F_28,
    FragmentL=mm_min_23,
    FragmentE=Z_19,
    FragmentF=addition_31,
    FragmentA=E_10,
    FragmentB=extrusion_retraction_mm_3)
z_drop_reprime_5 = Panel(concat_23)
repeat_5 = RepeatData(Data="G92 E0       ;Reset extruder", Length=lng_5)
simplify_28 = SimplifyTree(Tree=repeat_5, Front=False)
merge_14 = Merge(Data1=simplify_28, Data2=z_drop_reprime_5, Data3=simplify_28)
z_drop_reprime_reset_5 = Panel(merge_14)

# ----
# Travel to first point
speed_mm_s_13 = Slider(75, range=0..200)
pdecon_22 = Deconstruct(Point=simplify_27)  # -> XComponent, YComponent, ZComponent
addition_32 = Addition(A=pdecon_22.ZComponent, B=starting_z_height_mm_3)
addition_33 = Addition(A=addition_32, B=z_hop)
mm_min_24 = Multiplication(A=speed_mm_s_13, B=Slider(60, range=0..100))
X_13 = Text(" X")
Y_15 = Text(" Y")
Z_20 = Text(" Z")
F_29 = Text("F")
g1_24 = Text("G1 ")
concat_24 = Concatenate(
    FragmentH=g1_24,
    FragmentG=F_29,
    FragmentL=mm_min_24,
    FragmentA=X_13,
    FragmentB=pdecon_22.XComponent,
    FragmentC=Y_15,
    FragmentD=pdecon_22.YComponent,
    FragmentE=Z_20,
    FragmentF=addition_33)
travel_to_the_first_point_5 = Panel(concat_24)

merge_15 = Merge(Data1=travel_to_the_first_point_5, Data2=z_drop_reprime_reset_5, Data3=panel_15, Data4=retraction_z_hop_3)
panel_21 = Panel(merge_15)

# ----
# Lift Z to weaving height + needle offset
speed_mm_s_14 = Slider(20, range=0..200)
needle_z_offset_3 = Panel(needle_z_offset)
clearance_mm = Slider(2, range=0..10)
mm_min_25 = Multiplication(A=speed_mm_s_14, B=Slider(60, range=0..100))
Z_21 = Text(" Z")
g1_25 = Text("G1 ")
F_30 = Text("F")

# ----
# Weaving
item_22 = ListItem(List=flatten(divide_4.Points), Index=0, Wrap=True)
pdecon_23 = Deconstruct(Point=item_22)  # -> XComponent, YComponent, ZComponent

addition_34 = Addition(A=pdecon_23.ZComponent, B=needle_z_offset_3)
addition_35 = Addition(A=addition_34, B=clearance_mm)
concat_25 = Concatenate(FragmentH=g1_25, FragmentG=F_30, FragmentL=mm_min_25, FragmentE=Z_21, FragmentF=addition_35)
z_to_pillar_top_needle_offset = Panel(concat_25)

merge_16 = Merge(
    Data2=flatten(pick_up_blue_planar_weaving),
    Data3=flatten(z_to_pillar_top_needle_offset),
    Data4=flatten(xy_to_weaving_start_2),
    Data5=flatten(xy_to_weaving_start),
    Data6=flatten(weaving_sequence),
    Data7=flatten(z_to_pillar_top_needle_offset),
    Data8=flatten(park_blue_semi_weaving_anchor_wrap),
    Data9=flatten(wipe))
weaving = Panel(merge_16)

# ----
# Final GCode
start_230_50_middle_homing = Panel("""; --- Start G-code for Bambu A1 (No AMS) ---

; Home and prepare printer
G21             ; Set units to milimetres
M82             ; Absolute extrusion
G90             ; Use absolute positioning
G28 Z             ; Home Z
G0 Z120 F500             ; Lift Z to 120mm to avoid station
G28 X Y             ; Home X & Y

; Heat up bed and nozzle gradually
M140 S50         ; Start heating bed to 50°C (non-blocking)
M104 S220        ; Start heating hotend to 220°C (non-blocking)
M190 S50         ; Wait for bed to reach 50°C
M109 S220        ; Wait for hotend to reach 220°C

M106 S128        ; Set part cooling fan to 50% speed (max is S255)

; --- Wipe Strip / Priming Line ---
G92 E0           ; Reset extruder
G1 X50 Y251 F10000  ; Move to purge XY
G1 Z0.3 F500     ; Move close to bed

G1 X150 Y251 E15 F1000 ; Draw purge line up along Y axis
G1 F500 Z1 E13     ; Retract extruder
G92 E0           ; Reset extruder again

; --- Prep for printing ---

G0 X128 Y128 F10000 ; Move to print start position

; --- End of Start G-code ---""")
end_protocol = Panel("""; --- End G-code for Bambu A1 (No AMS) ---

M83               ; Relative extrusion mode
G0 E-3.0 F3000    ; Retract filament to relieve pressure
G92 E0       ; Reset extruder

; Move print head up and away
G91 ; all axes to relative
G0 Z10 F1000 ; Lift nozzle up 10mm

; Turn off fans and heaters
M106 S0           ; Turn off part cooling fan
M104 S0           ; Turn off hotend
M140 S0           ; Turn off bed

; Disable steppers
G4 S5           ; Wait 5 sec
M84               ; Disable all stepper motors

; --- End of End G-code ---""")
merge_17 = Merge(
    Data1=flatten(start_230_50_middle_homing),
    Data2=flatten(panel_20),
    Data3=flatten(panel_18),
    Data4=flatten(panel_12),
    Data5=flatten(weaving),
    Data6=flatten(panel_14),
    Data7=flatten(panel_21),
    Data8=flatten(end_protocol))
final_gcode = Panel(merge_17)

# ==== cluster Flow
filament_diameter = ClusterInput()
layer_height = ClusterInput()
line_width = ClusterInput()
multiplier = ClusterInput()
division = Division(FilamentDiameter=filament_diameter, B=2)
multiplication = Multiplication(LayerHeight=layer_height, LineWidth=line_width, Multiplier=multiplier)
sqr = Square(Value=division)
pi = Pi(Factor=sqr)
division_2 = Division(A=multiplication, B=pi)
R = ClusterOutput(division_2)
