# Grasshopper definition Vertical Woven Objects.gh (Grasshopper 1.0.8)
# plug-ins: Pufferfish

# ----
# Double Station
brep = Brep(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)
preview = CustomPreview(Geometry=brep, Material=ColourSwatch(SwatchColor=RGBA(34, 52, 181, 101)))

# ----
# Print Bed Preview
# Station
brep_2 = Brep(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)
preview_2 = CustomPreview(Geometry=brep_2, Material=ColourSwatch(SwatchColor=RGBA(34, 52, 181, 101)))

# ----
# Clearance:
# no printing or weaving
brep_3 = Brep(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)
preview_3 = CustomPreview(Geometry=brep_3, Material=ColourSwatch(SwatchColor=RGBA(181, 34, 34, 16)))

# ----
# Clearance:
# no weaving
brep_4 = Brep(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)
preview_4 = CustomPreview(Geometry=brep_4, Material=ColourSwatch(SwatchColor=RGBA(0, 178, 181, 16)))

# ----
# Print bed
crv = Curve(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)

# ----
# Custom GCode can cause damage to the printer
# when not careful, use at your own risk.
# 
# Always check whether the toolpaths are within
# bounds of the build volume to avoid issues with
# your printer.
# 
# Thank you!
# Example Surfaces
# Hexagon
srf = Surface(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)

# ----
# Bowl Basket
srf_2 = Surface(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)

# ----
# Rectangle Basket
srf_3 = Surface(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)

# ----
# Handbag
srf_4 = Surface(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)

# ----
# Lampshade
srf_5 = Surface(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)

# ----
# FilaLoom Specifics
bottom_brim_layers = Slider(3, range=0..10)
top_brim_layers = Slider(3, range=0..10)

# ----
# Switch yarn every X layers
# (only with double station)
# Print Parameters
switch_yarn_every_x_layer = Slider(1, range=0..10)

# ----
# Warp (pillar) distance
warp_distance = Slider(7.7, range=0..20)

# ----
# Pillar radius
max_radius = Slider(2.1, range=0..10)
min_radius = Slider(1.7, range=0..10)

# ----
# Weft (yarn) distance
weft_distance = Slider(2.2, range=0..5)

# ----
# Yarn depositor needle tip
# offset from nozzle
needle_y_offset = Slider(40, range=0..100)
needle_z_offset = Slider(11.75, range=0..100)

plain = Panel("""1
-1""")
_3x1_twill = Panel("""1
1
1
-1""")
_2x1_twill = Panel("""1
1
-1""")
satin = Panel("""1
1
1
1
-1""")

# ----
# Weave Pattern
# Offset weave pattern
# at every layer
# Brims
offset_by = Slider(1, range=1..5)
weave_pattern = Panel(satin)

# ----
# Station type
# Single = false
# Double = true
toggle = BooleanToggle(False)

# ----
# Speeds
weaving_speed_mm_s = Slider(25, range=0..100)
pillars_print_speed_mm_s = Slider(15, range=0..100)
top_brim_print_speed_mm_s = Slider(60, range=0..100)
bottom_brim_print_speed_mm_s = Slider(15, range=0..100)

# ----
# Inputs
# Input Base Surface
srf_6 = Surface(srf)

starting_height_mm = Slider(1.1, range=0..200)
filament_diameter = Slider(1.75, range=0..4)
layer_heigth_mm = Slider(0.4, range=0..20)
line_width_mm = Slider(0.6, range=0..1)

# ----
# Body
panel = Panel("2")
multiplication = Multiplication(A=max_radius, B=panel)
subtraction = Subtraction(A=warp_distance, B=multiplication)

# ----
# Gap between pillars
# (for calculating clearance)
panel_2 = Panel(subtraction)

# ----
# Planes at weaving height
crease_distance = Panel(weft_distance)
division = Division(A=Slider(250, range=0..1000), B=crease_distance)
multiplication_2 = Multiplication(A=crease_distance, B=Slider(0.25, range=0..1))
pl = ConstructPlane(Origin=Point(0, 0, 0), XAxis=Vector(1, 0, 0), YAxis=Vector(0, 1, 0))
series = Series(Start=multiplication_2, Step=crease_distance, Count=division)
Z = UnitZ(Factor=series)
move = Move(Geometry=pl, Motion=Z)  # -> Geometry, Transform

crease_distance_2 = Panel(weft_distance)  # disabled
number_slider = Slider(250, range=0..1000)  # disabled
number_slider_2 = Slider(0.25, range=0..1)  # disabled
division_2 = Division(A=number_slider, B=crease_distance_2)  # disabled
multiplication_3 = Multiplication(A=crease_distance_2, B=number_slider_2)  # disabled
pl_2 = ConstructPlane(Origin=Point(0, 0, 0), XAxis=Vector(1, 0, 0), YAxis=Vector(0, 1, 0))  # disabled
series_2 = Series(Start=multiplication_3, Step=crease_distance_2, Count=division_2)  # disabled
Z_2 = UnitZ(Factor=series_2)  # disabled
move_2 = Move(Geometry=pl_2, Motion=Z_2)  # -> Geometry, Transform; disabled

spool_radius = Slider(30, range=10..50)  # disabled
pi = Pi(Factor=1)  # disabled
multiplication_4 = Multiplication(A=pi, B=spool_radius)  # disabled

# ----
# Weaving starting point
# (roughly in front of station)
pt = Point(Point(109, 36, 0))

max_circle_radius = Panel(max_radius)
line_width = Panel(line_width_mm)
division_3 = Division(A=max_circle_radius, B=line_width)
int = Integer(division_3)
# Create Brims
series_3 = Series(Start=line_width, Step=line_width, Count=int)

max_circle_radius_2 = Panel(max_radius)
line_width_2 = Panel(line_width_mm)
division_4 = Division(A=max_circle_radius_2, B=line_width_2)
int_2 = Integer(division_4)
series_4 = Series(Start=line_width_2, Step=line_width_2, Count=int_2)

# ----
# Layers per period
crease_period = Panel(weft_distance)
layer_height = Panel(layer_heigth_mm)
division_5 = Division(A=crease_period, B=layer_height)

# ----
# Z-hop/dip between printing
z_hop_mm = Slider(-0.05, range=-10..200)

# ----
# Printing multiplier
C = Slider(1, range=0..1000)

# ----
# Z-hop
z_hop_mm_2 = Slider(0, range=0..200)

# ----
# Extrusion multiplier
C_2 = Slider(1, range=0..1000)

# ----
# Z-hop
z_hop_mm_3 = Slider(0, range=0..200)

# ----
# Extrusion multiplier
C_3 = Slider(1, range=0..1000)

panel_3 = Panel("pan")

# ----
# Resting point
# (roughly in front of station)
pt_2 = Point(pt)

# ----
# Resting point
# (roughly in front of station)
pt_3 = Point(pt)

# ----
# Resting point
# (roughly in front of station)
pt_4 = Point(pt)

flow = Flow(layer_height=layer_heigth_mm, line_width=line_width_mm, multiplier=C_3, filament_diameter=filament_diameter)
panel_4 = Panel(flow)

# ----
# Create Pillars
edges = BrepEdges(Brep=srf_6)  # -> Naked, Interior, NonManifold
layer_height_2 = Panel(layer_heigth_mm)

# ----
# Sort edges
panel_5 = Panel("0.5")
eval = EvaluateCurve(Curve=reparameterize(edges.Naked), Parameter=panel_5)  # -> Point, Tangent, Angle
pdecon = Deconstruct(Point=eval.Point)  # -> XComponent, YComponent, ZComponent
sort = SortList(Keys=pdecon.ZComponent, ValuesA=edges.Naked)  # -> Keys, ValuesA

# ----
# Bottom edge
panel_6 = Panel("0")
item = ListItem(List=sort.ValuesA, Index=panel_6, Wrap=True)

max_circle_radius_3 = Panel(max_radius)  # disabled
panel_7 = Panel("2")  # disabled
multiplication_5 = Multiplication(A=max_circle_radius_3, B=panel_7)  # disabled
yarn_distance = Panel(multiplication_5)  # disabled
panel_8 = Panel("256")  # disabled
division_6 = Division(A=panel_8, B=yarn_distance)  # disabled
int_3 = Integer(division_6)  # disabled
xz = XZPlane(Origin=Point(0, 0, 0))  # disabled
series_5 = Series(Start=0, Step=yarn_distance, Count=int_3)  # disabled
crv_2 = Curve(flatten(item))  # disabled
Y = UnitY(Factor=series_5)  # disabled
move_3 = Move(Geometry=xz, Motion=Y)  # -> Geometry, Transform; disabled
pcx = CurvePlane(Curve=crv_2, Plane=move_3.Geometry)  # -> Points, ParamsC, ParamsP; disabled

# ----
# Top edge
lastdex = LastIndex(List=sort.ValuesA)
item_2 = ListItem(List=sort.ValuesA, Index=lastdex, Wrap=True)

# ----
# Divide edge curve
len = Length(Curve=item)
division_7 = Division(A=len, B=warp_distance)
int_4 = Integer(division_7)
divide = DivideCurve(Curve=item, Count=int_4, Kinks=False)  # -> Points, Tangents, Parameters

flip = FlipCurve(Curve=item_2, Guide=item)  # -> Curve, Flag
divide_2 = DivideCurve(Curve=flip.Curve, Count=int_4, Kinks=False)  # -> Points, Tangents, Parameters

Y_2 = UnitY(Factor=max_circle_radius_3)  # disabled
move_4 = Move(Geometry=move_3.Geometry, Motion=Y_2)  # -> Geometry, Transform; disabled
pcx_2 = CurvePlane(Curve=crv_2, Plane=move_4.Geometry)  # -> Points, ParamsC, ParamsP; disabled

# ----
# Horizontal plane layers
pdecon_2 = Deconstruct(Point=divide.Points)  # -> XComponent, YComponent, ZComponent
hilonums = HighestLowestNumbers(Numbers=pdecon_2.ZComponent)  # -> Highest, Lowest
pdecon_3 = Deconstruct(Point=divide_2.Points)  # -> XComponent, YComponent, ZComponent
pt_5 = ConstructPoint(XCoordinate=0, YCoordinate=0, ZCoordinate=hilonums.Lowest)
hilonums_2 = HighestLowestNumbers(Numbers=pdecon_3.ZComponent)  # -> Highest, Lowest
pl_3 = ConstructPlane(Origin=pt_5, XAxis=Vector(1, 0, 0), YAxis=Vector(0, 1, 0))
subtraction_2 = Subtraction(A=hilonums_2.Highest, B=hilonums.Lowest)
division_8 = Division(A=subtraction_2, B=layer_height_2)
addition = Addition(A=division_8, B=Slider(1, range=0..1))
series_6 = Series(Start=Slider(0, range=0..100), Step=layer_height_2, Count=addition)  # -> flatten(Series)
Z_3 = UnitZ(Factor=series_6)
move_5 = Move(Geometry=pl_3, Motion=Z_3)  # -> Geometry, Transform

# ----
# Line plane points
range = Range(Domain=Domain(0, 1), Steps=int_4)
lastdex_2 = LastIndex(List=range)
cull_i = CullIndex(List=range, Indices=lastdex_2, Wrap=True)
pt_6 = ConstructPoint(XCoordinate=0, YCoordinate=cull_i, ZCoordinate=0)
iso = IsoCurve(Surface=reparameterize(srf_6), UVPoint=pt_6)  # -> UIsocurve, VIsocurve
crv_3 = Curve(flatten(iso.UIsocurve))
pcx_3 = CurvePlane(Curve=graft(crv_3), Plane=move_5.Geometry)  # -> Points, ParamsC, ParamsP
trim = TrimTree(Tree=pcx_3.Points, Depth=1)
simplify = SimplifyTree(Tree=trim, Front=False)

# ----
# Pillar ‘spine’
crv_4 = Curve(crv_3)

# ----
# Line-plane points for weaving
pcx_4 = CurvePlane(Curve=graft(crv_4), Plane=move.Geometry)  # -> Points, ParamsC, ParamsP
trim_2 = TrimTree(Tree=pcx_4.Points, Depth=1)
simplify_2 = SimplifyTree(Tree=trim_2, Front=False)
flip_2 = FlipMatrix(Data=simplify_2)

dispatch = Dispatch(List=pcx.Points, DispatchPattern=[True, False])  # -> ListA, ListB; disabled
ln = Line(StartPoint=dispatch.ListA, EndPoint=dispatch.ListB)  # disabled

# ----
# Lowest x value first
pdecon_4 = Deconstruct(Point=flip_2)  # -> XComponent, YComponent, ZComponent
sort_2 = SortList(Keys=pdecon_4.XComponent, ValuesA=flip_2)  # -> Keys, ValuesA
item_3 = ListItem(List=sort_2.ValuesA, Index=0, Wrap=True)

# ----
# Pillar closest to needle parking location
cp = ClosestPoint(Point=pt, Cloud=flip_2)  # -> ClosestPoint, CPIndex, Distance
split = SplitList(List=flip_2, Index=cp.CPIndex)  # -> ListA, ListB
merge = Merge(Data1=split.ListB, Data2=split.ListA)

# ----
# Points + Tangents
toggle_2 = BooleanToggle(True)
pline = PolyLine(Vertices=merge, Closed=toggle_2)
explode = Explode(Curve=pline, Recursive=True)  # -> Segments, Vertices
simplify_3 = SimplifyTree(Tree=explode.Segments, Front=False)
eval_2 = EvaluateCurve(Curve=reparameterize(simplify_3), Parameter="0.5")  # -> Point, Tangent, Angle

# ----
# match pillar radii to sine
pdecon_5 = Deconstruct(Point=simplify)  # -> XComponent, YComponent, ZComponent
division_9 = Division(A=pdecon_5.ZComponent, B=weft_distance)
multiplication_6 = Multiplication(A=division_9, B=Slider(2, range=0..10))
pi_2 = Pi(Factor=multiplication_6)
dom = ConstructDomain(DomainStart=min_radius, DomainEnd=max_radius)
dom_2 = ConstructDomain(DomainStart=Slider(1, range=0..1), DomainEnd=Slider(-1, range=-1..0))
sin = Sine(Value=pi_2)
remap = RemapNumbers(Value=sin, Source=dom_2, Target=dom)  # -> Mapped, Clipped

# ----
# Points by pillar
pt_7 = Point(simplify)

# ----
# Top curve
crv_5 = Curve(flatten(flip.Curve))

# ----
# Circles by pillar
cir = Circle(Plane=simplify, Radius=remap.Mapped)

flip_3 = FlipMatrix(Data=pt_7)
flip_4 = FlipMatrix(Data=cir)

# ----
# Points by layer
pt_8 = Point(flip_3)

# ----
# Amount of pillars
panel_9 = Panel("{0}")
branch = TreeBranch(Tree=pt_8, Path=panel_9, MaintainPaths=True)
lng = ListLength(List=branch)

# ----
# Amount of pillars
panel_10 = Panel(lng)

# ----
# Base lines
neg = Negative(Value=series_3)
# Top brim
offset = OffsetCurve(Curve=crv_5, Distance=series_3, Corners=1)  # -> flatten(Curve)
offset_2 = OffsetCurve(Curve=crv_5, Distance=neg, Corners=1)  # -> flatten(Curve)
rev = ReverseList(List=offset)
merge_2 = Merge(Data1=rev, Data2=crv_5, Data3=offset_2)

# ----
# Bottom curve
crv_6 = Curve(flatten(item))

# ----
# Base lines
neg_2 = Negative(Value=series_4)
offset_3 = OffsetCurve(Curve=crv_6, Distance=series_4, Corners=1)  # -> flatten(Curve)
offset_4 = OffsetCurve(Curve=crv_6, Distance=neg_2, Corners=1)  # -> flatten(Curve)
rev_2 = ReverseList(List=offset_3)
merge_3 = Merge(Data1=rev_2, Data2=crv_6, Data3=offset_4)

# ----
# Circles by layer
crv_7 = Curve(flip_4)

# ----
# Adjust circle seams
shift = ShiftList(List=pt_8, Shift=1, Wrap=True)
vec2pt = Vector2Pt(PointA=pt_8, PointB=shift, Unitize=False)  # -> Vector, Length
unit = UnitVector(Vector=vec2pt.Vector)
neg_3 = Negative(Value=unit)
move_6 = Move(Geometry=pt_8, Motion=neg_3)  # -> Geometry, Transform
crv_cp = CurveClosestPoint(Point=move_6.Geometry, Curve=crv_7)  # -> Point, Parameter, Distance
seam = Seam(Curve=crv_7, Seam=crv_cp.Parameter)

# ----
# Base layers
layer_height_3 = Panel(layer_heigth_mm)
series_7 = Series(Start=layer_height_3, Step=layer_height_3, Count=top_brim_layers)
multiplication_7 = Multiplication(A=layer_height_3, B=top_brim_layers)
Z_4 = UnitZ(Factor=series_7)  # -> graft(UnitVector)
move_7 = Move(Geometry=merge_2, Motion=Z_4)  # -> Geometry, Transform

# ----
# Base layers
layer_height_4 = Panel(layer_heigth_mm)
series_8 = Series(Start=0, Step=layer_height_4, Count=bottom_brim_layers)
multiplication_8 = Multiplication(A=layer_height_4, B=bottom_brim_layers)
Z_5 = UnitZ(Factor=series_8)  # -> graft(UnitVector)
move_8 = Move(Geometry=merge_3, Motion=Z_5)  # -> Geometry, Transform

# ----
# Circles seams adjusted (layer)
crv_8 = Curve(seam)

# ----
# Circles seams adjusted (pillar)
flip_5 = FlipMatrix(Data=crv_8)
simplify_4 = SimplifyTree(Tree=flip_5, Front=False)

# ----
# Divide into segments
panel_11 = Panel(division_5)
lng_2 = ListLength(List=simplify_4)
division_10 = Division(A=lng_2, B=division_5)
round = Round(Number=division_10)  # -> Nearest, Floor, Ceiling
repeat = RepeatData(Data=division_5, Length=round.Floor)
simplify_5 = SimplifyTree(Tree=repeat, Front=False)
partition = PartitionList(List=simplify_4, Size=simplify_5)
path_mapper = PathMapper(partition, source="{A;B}", target="{B;A}")

# ----
# Bottom brim
panel_12 = Panel(multiplication_8)

# ----
# Base by layers
simplify_6 = SimplifyTree(Tree=move_7.Geometry, Front=False)

# ----
# Base by layers
simplify_7 = SimplifyTree(Tree=move_8.Geometry, Front=False)

# ----
# Circles per segment
crv_9 = Curve(path_mapper)

# ----
# Retraction travel points
lastdex_3 = LastIndex(List=crv_9)
item_4 = ListItem(List=crv_9, Index=lastdex_3, Wrap=True)
eval_3 = EvaluateCurve(Curve=reparameterize(item_4), Parameter="1")  # -> graft(Point), Tangent, Angle
multiplication_9 = Multiplication(A=eval_3.Tangent, B=Slider(20, range=0..50))  # -> graft(Result)
move_9 = Move(Geometry=eval_3.Point, Motion=multiplication_9)  # -> Geometry, Transform
simplify_8 = SimplifyTree(Tree=move_9.Geometry, Front=False)

# ----
# Divide circles to points
number_slider_3 = Slider(25, range=0..100)
divide_3 = DivideCurve(Curve=crv_9, Count=number_slider_3, Kinks=False)  # -> Points, Tangents, Parameters

# ----
# Starting height pillars
addition_2 = Addition(A=multiplication_8, B=starting_height_mm)

# ----
# Divide brim curves into points
number_slider_4 = Slider(250, range=0..500)
divide_4 = DivideCurve(Curve=simplify_6, Count=number_slider_4, Kinks=False)  # -> Points, Tangents, Parameters

# ----
# Divide brim curves into points
number_slider_5 = Slider(250, range=0..500)
divide_5 = DivideCurve(Curve=simplify_7, Count=number_slider_5, Kinks=False)  # -> Points, Tangents, Parameters

pline_2 = PolyLine(Vertices=divide_4.Points, Closed=True)
explode_2 = Explode(Curve=pline_2, Recursive=True)  # -> Segments, Vertices

# ----
# Starting points
split_2 = SplitList(List=explode_2.Vertices, Index=1)  # -> ListA, ListB
simplify_9 = SimplifyTree(Tree=split_2.ListA, Front=False)

pline_3 = PolyLine(Vertices=divide_5.Points, Closed=True)
explode_3 = Explode(Curve=pline_3, Recursive=True)  # -> Segments, Vertices

# ----
# Starting points
split_3 = SplitList(List=explode_3.Vertices, Index=1)  # -> ListA, ListB
simplify_10 = SimplifyTree(Tree=split_3.ListA, Front=False)

flow_2 = Flow(layer_height=layer_heigth_mm, line_width=line_width_mm, multiplier=C_2, filament_diameter=filament_diameter)
simplify_11 = SimplifyTree(Tree=explode_2.Vertices, Front=False)
panel_13 = Panel(flow_2)

len_2 = Length(Curve=explode_2.Segments)
multiplication_10 = Multiplication(A=len_2, B=flow_2)

len_3 = Length(Curve=explode_3.Segments)
multiplication_11 = Multiplication(A=len_3, B=flow)

# ----
# Brim printing points
simplify_12 = SimplifyTree(Tree=explode_3.Vertices, Front=False)

# ----
# Travel to first point
speed_mm_s = Slider(25, range=0..200)
pdecon_6 = Deconstruct(Point=simplify_10)  # -> XComponent, YComponent, ZComponent
# Bottom brim
number_slider_6 = Slider(60, range=0..100)
addition_3 = Addition(A=pdecon_6.ZComponent, B=starting_height_mm)
addition_4 = Addition(A=addition_3, B=z_hop_mm_3)
mm_min = Multiplication(A=speed_mm_s, B=number_slider_6)
Z_6 = Text(" Z")
X = Text(" X")
Y_3 = Text(" Y")
g1 = Text("G1 ")
F = Text("F")
concat = Concatenate(
    FragmentH=g1,
    FragmentG=F,
    FragmentL=mm_min,
    FragmentA=X,
    FragmentB=pdecon_6.XComponent,
    FragmentC=Y_3,
    FragmentD=pdecon_6.YComponent,
    FragmentE=Z_6,
    FragmentF=addition_4)
travel_to_the_first_point = Panel(concat)

# ----
# Print
pdecon_7 = Deconstruct(Point=simplify_12)  # -> XComponent, YComponent, ZComponent
ma = MassAddition(Input=multiplication_11)  # -> Result, PartialResults
simplify_13 = SimplifyTree(Tree=ma.PartialResults, Front=False)
addition_5 = Addition(A=pdecon_7.ZComponent, B=starting_height_mm)
mm_min_2 = Multiplication(A=bottom_brim_print_speed_mm_s, B=Slider(60, range=0..100))
g1_2 = Text("G1 ")
F_2 = Text("F")
X_2 = Text(" X")
Y_4 = Text(" Y")
Z_7 = Text(" Z")
E = Text(" E")
concat_2 = Concatenate(
    FragmentH=g1_2,
    FragmentG=F_2,
    FragmentL=mm_min_2,
    FragmentA=X_2,
    FragmentB=pdecon_7.XComponent,
    FragmentC=Y_4,
    FragmentD=pdecon_7.YComponent,
    FragmentE=Z_7,
    FragmentF=addition_5,
    FragmentJ=E,
    FragmentK=simplify_13)
panel_14 = Panel(concat_2)

lastdex_4 = LastIndex(List=simplify_13)
item_5 = ListItem(List=simplify_13, Index=lastdex_4, Wrap=True)

lastdex_5 = LastIndex(List=addition_5)
item_6 = ListItem(List=addition_5, Index=lastdex_5, Wrap=True)

# ----
# Retraction move
retract_peed_mm_s = Slider(25, range=0..100)
extrusion_retraction_mm = Slider(0.05, range=0..5)
mm_min_3 = Multiplication(A=retract_peed_mm_s, B=Slider(60, range=0..100))
subtraction_3 = Subtraction(A=item_5, B=extrusion_retraction_mm)
addition_6 = Addition(A=item_6, B=starting_height_mm)
g1_3 = Text("G1 ")
F_3 = Text("F")
F_4 = Text(" Z")
text = Text(" E")
concat_3 = Concatenate(
    FragmentA=g1_3,
    FragmentB=F_3,
    FragmentC=mm_min_3,
    FragmentF=F_4,
    FragmentG=addition_6,
    FragmentD=text,
    FragmentE=subtraction_3)
retraction_z_hop = Panel(concat_3)

# ----
# Drop Z and re-prime filament
speed_mm_s_2 = Slider(25, range=0..100)
lng_3 = ListLength(List=simplify_10)
pdecon_8 = Deconstruct(Point=simplify_10)  # -> XComponent, YComponent, ZComponent
addition_7 = Addition(A=pdecon_8.ZComponent, B=starting_height_mm)
mm_min_4 = Multiplication(A=speed_mm_s_2, B=Slider(60, range=0..100))
g1_4 = Text("G1 ")
F_5 = Text("F")
E_2 = Text(" E")
Z_8 = Text(" Z")
concat_4 = Concatenate(
    FragmentH=g1_4,
    FragmentG=F_5,
    FragmentL=mm_min_4,
    FragmentE=Z_8,
    FragmentF=addition_7,
    FragmentA=E_2,
    FragmentB=extrusion_retraction_mm)
z_drop_reprime = Panel(concat_4)
repeat_2 = RepeatData(Data="G92 E0       ;Reset extruder", Length=lng_3)
simplify_14 = SimplifyTree(Tree=repeat_2, Front=False)
merge_4 = Merge(Data1=simplify_14, Data2=z_drop_reprime, Data3=simplify_14)
z_drop_reprime_reset = Panel(merge_4)

merge_5 = Merge(Data1=travel_to_the_first_point, Data2=z_drop_reprime_reset, Data3=panel_14, Data4=retraction_z_hop)
panel_15 = Panel(merge_5)

pt_9 = Point(<point referenced from the Rhino model>)  # disabled
number_slider_7 = Slider(45, range=0..100)  # disabled
number_slider_8 = Slider(2, range=0..10)  # disabled
panel_16 = Panel("""G1 F2000 x274
G1 F2000 X230""")  # disabled

crease_period_2 = Panel(weft_distance)  # disabled
layer_height_5 = Panel(layer_heigth_mm)  # disabled
panel_17 = Panel("}")  # disabled
panel_18 = Panel("{")  # disabled

crv_10 = Curve(crv_3)  # disabled
pt_10 = Point(<point referenced from the Rhino model>)  # disabled
number_slider_9 = Slider(1, range=0..1)  # disabled

pcx_5 = CurvePlane(Curve=graft(crv_10), Plane=move_2.Geometry)  # -> Points, ParamsC, ParamsP; disabled
trim_3 = TrimTree(Tree=pcx_5.Points, Depth=1)  # disabled
simplify_15 = SimplifyTree(Tree=trim_3, Front=False)  # disabled
flip_6 = FlipMatrix(Data=simplify_15)  # disabled

pdecon_9 = Deconstruct(Point=flip_6)  # -> XComponent, YComponent, ZComponent; disabled
sort_3 = SortList(Keys=pdecon_9.XComponent, ValuesA=flip_6)  # -> Keys, ValuesA; disabled
item_7 = ListItem(List=sort_3.ValuesA, Index=0, Wrap=True)  # disabled

cp_2 = ClosestPoint(Point=pt_10, Cloud=flip_6)  # -> ClosestPoint, CPIndex, Distance; disabled
split_4 = SplitList(List=flip_6, Index=cp_2.CPIndex)  # -> ListA, ListB; disabled
merge_6 = Merge(Data1=split_4.ListB, Data2=split_4.ListA)  # disabled

toggle_3 = BooleanToggle(True)  # disabled
pline_4 = PolyLine(Vertices=merge_6, Closed=toggle_3)  # disabled
explode_4 = Explode(Curve=pline_4, Recursive=True)  # -> Segments, Vertices; disabled
simplify_16 = SimplifyTree(Tree=explode_4.Segments, Front=False)  # disabled
panel_19 = Panel("0.5")  # disabled
eval_4 = EvaluateCurve(Curve=reparameterize(simplify_16), Parameter=panel_19)  # -> Point, Tangent, Angle; disabled

py3 = Python3Script(x=pcx_2.Points)  # -> out, a; inputs x: tree; disabled
# ---------- py3: Python ----------
import rhinoscriptsyntax as rs
from Grasshopper import DataTree
from Grasshopper.Kernel.Data import GH_Path

output = DataTree[object]()

for i, branch in enumerate(x.Branches):
    if len(branch) > 1:
        output.AddRange(branch, x.Path(i))

a = output
# ---------- end py3 ----------
pdecon_10 = Deconstruct(Point=py3.a)  # -> XComponent, YComponent, ZComponent; disabled
sort_4 = SortList(Keys=pdecon_10.XComponent, ValuesA=py3.a)  # -> Keys, ValuesA; disabled
arc = Arc(Plane=PlaneXY(0, 0, 0), Radius=1, Angle=Domain(0, 3.141592654))  # -> Arc, Length; disabled
arc_2 = Arc(Plane=PlaneXY(0, 0, 0), Radius=1, Angle=Domain(0, 3.141592654))  # -> Arc, Length; disabled

clean = CleanTree(RemoveNulls=True, RemoveInvalid=True, RemoveEmpty=True, Tree=sort_4.ValuesA)  # disabled
panel_20 = Panel("0")  # disabled
lastdex_6 = LastIndex(List=clean)  # disabled
item_8 = ListItem(List=clean, Index=panel_20, Wrap=True)  # -> flatten(Item); disabled
item_9 = ListItem(List=clean, Index=lastdex_6, Wrap=True)  # -> flatten(Item); disabled
panel_21 = Panel("""1
0""")  # disabled

dispatch_2 = Dispatch(List=item_9, DispatchPattern=panel_21)  # -> ListA, ListB; disabled
dispatch_3 = Dispatch(List=item_8, DispatchPattern=panel_21)  # -> ListA, ListB; disabled

weave = Weave(Pattern=panel_21, Stream0=dispatch_2.ListB, Stream1=dispatch_3.ListA, NullGaps=False)  # -> graft(Weave); disabled

amount_of_circle_layers = Slider(4, range=0..10)  # disabled
layer_height_6 = Panel(layer_heigth_mm)  # disabled
panel_22 = Panel("1")  # disabled
series_9 = Series(Start=0, Step=layer_height_6, Count=amount_of_circle_layers)  # disabled
multiplication_12 = Multiplication(A=layer_height_6, B=amount_of_circle_layers)  # disabled
subtraction_4 = Subtraction(A=amount_of_circle_layers, B=panel_22)  # disabled
Z_9 = UnitZ(Factor=series_9)  # disabled
domain = Domain(dom)  # disabled
move_10 = Move(Geometry=weave, Motion=Z_9)  # -> Geometry, Transform; disabled
range_2 = Range(Domain=domain, Steps=subtraction_4)  # disabled
cir_2 = Circle(Plane=move_10.Geometry, Radius=range_2)  # disabled

merge_7 = Merge(Data1=dispatch_2.ListA, Data2=dispatch_3.ListB)  # disabled
pdecon_11 = Deconstruct(Point=merge_7)  # -> XComponent, YComponent, ZComponent; disabled
sort_5 = SortList(Keys=pdecon_11.YComponent, ValuesA=merge_7)  # -> Keys, ValuesA; disabled
shift_2 = ShiftList(List=sort_5.ValuesA, Shift=1, Wrap=False)  # disabled
ln_2 = Line(StartPoint=shift_2, EndPoint=sort_5.ValuesA)  # disabled
flip_7 = FlipCurve(Curve=ln_2)  # -> Curve, Flag; disabled

crv_cp_2 = CurveClosestPoint(Point=flatten(weave), Curve=crv_2)  # -> Point, Parameter, Distance; disabled
panel_23 = Panel("270")  # disabled
eval_5 = EvaluateCurve(Curve=crv_2, Parameter=crv_cp_2.Parameter)  # -> Point, Tangent, Angle; disabled
rad = Radians(Degrees=panel_23)  # disabled
max_circle_radius_4 = Panel(max_radius)  # disabled
panel_24 = Panel("2")  # disabled
rotate = Rotate(Geometry=eval_5.Tangent, Angle=rad, Plane=PlaneXY(0, 0, 0))  # -> Geometry, Transform; disabled
multiplication_13 = Multiplication(A=max_circle_radius_4, B=panel_24)  # disabled
unit_2 = UnitVector(Vector=rotate.Geometry)  # disabled
multiplication_14 = Multiplication(A=unit_2, B=multiplication_13)  # disabled
move_11 = Move(Geometry=flatten(weave), Motion=multiplication_14)  # -> Geometry, Transform; disabled
lastdex_7 = LastIndex(List=move_11.Geometry)  # disabled
panel_25 = Panel("0")  # disabled
merge_8 = Merge(Data1=lastdex_7, Data2=panel_25)  # disabled
panel_26 = Panel("2")  # disabled
cull_i_2 = CullIndex(List=move_11.Geometry, Indices=merge_8, Wrap=True)  # disabled
shift_3 = ShiftList(List=sort_5.ValuesA, Shift=panel_26, Wrap=False)  # disabled
arc_3 = Arc3Pt(PointA=sort_5.ValuesA, PointB=cull_i_2, PointC=shift_3)  # -> Arc, Plane, Radius; disabled
panel_27 = Panel("1")  # disabled
lastdex_8 = LastIndex(List=arc_3.Arc)  # disabled
subtraction_5 = Subtraction(A=lastdex_8, B=panel_27)  # disabled
merge_9 = Merge(Data1=lastdex_8, Data2=subtraction_5)  # disabled
cull_i_3 = CullIndex(List=arc_3.Arc, Indices=merge_9, Wrap=True)  # disabled

pt_11 = Point(flatten(weave))  # disabled
lastdex_9 = LastIndex(List=sort_5.ValuesA)  # disabled
panel_28 = Panel("1")  # disabled
lastdex_10 = LastIndex(List=pt_11)  # disabled
panel_29 = Panel("0")  # disabled
panel_30 = Panel("1")  # disabled
subtraction_6 = Subtraction(A=lastdex_9, B=panel_28)  # disabled
item_10 = ListItem(List=pt_11, Index=panel_29, Wrap=True)  # disabled
item_11 = ListItem(List=sort_5.ValuesA, Index=panel_30, Wrap=True)  # disabled
item_12 = ListItem(List=pt_11, Index=lastdex_10, Wrap=True)  # disabled
item_13 = ListItem(List=sort_5.ValuesA, Index=subtraction_6, Wrap=True)  # disabled
dist = Distance(PointA=item_10, PointB=item_11)  # disabled
dist_2 = Distance(PointA=item_12, PointB=item_13)  # disabled
cir_3 = Circle(Plane=item_10, Radius=dist)  # disabled
cir_4 = Circle(Plane=item_12, Radius=dist_2)  # disabled

eval_6 = EvaluateCurve(Curve=reparameterize(simplify_3), Parameter="0")  # -> Point, Tangent, Angle
rad_2 = Radians(Degrees=Slider(90, range=0..100))
rotate_2 = Rotate(Geometry=eval_6.Tangent, Angle=rad_2, Plane=PlaneXY(0, 0, 0))  # -> Geometry, Transform
shift_4 = ShiftList(List=eval_2.Point, Shift=1, Wrap=True)

# ----
# Create Weaving Path
# Weave pattern
weave_pattern_2 = Panel(weave_pattern)
lng_4 = ListLength(List=rotate_2.Geometry)
repeat_3 = RepeatData(Data=weave_pattern_2, Length=lng_4)
simplify_17 = SimplifyTree(Tree=repeat_3, Front=False)
tstat = TreeStatistics(Tree=simplify_17)  # -> Paths, Length, Count
dpath = DeconstructPath(Branch=tstat.Paths)
multiplication_15 = Multiplication(A=dpath, B=offset_by)
simplify_18 = SimplifyTree(Tree=multiplication_15, Front=False)
shift_5 = ShiftList(List=simplify_17, Shift=simplify_18, Wrap=True)
multiplication_16 = Multiplication(A=shift_5, B=rotate_2.Geometry)

arc_4 = ArcSED(Start=eval_2.Point, End=shift_4, Direction=multiplication_16)  # -> Arc, Plane, Radius
join = JoinCurves(Curves=arc_4.Arc, Preserve=Toggle(True))

lng_5 = ListLength(List=flatten(join))  # disabled
amount_of_weaving_layers = Panel(lng_5)  # disabled

series_10 = Series(Start=crease_period_2, Step=crease_period_2, Count=amount_of_weaving_layers)  # disabled
division_11 = Division(A=series_10, B=layer_height_5)  # disabled
int_5 = Integer(division_11)  # disabled
concat_5 = Concatenate(FragmentA=panel_18, FragmentB=int_5, FragmentC=panel_17)  # disabled
trim_4 = TrimTree(Tree=concat_5, Depth=1)  # disabled
panel_31 = Panel(trim_4)  # disabled

# ----
# Weaving path
simplify_19 = SimplifyTree(Tree=join, Front=False)

# ----
# Divide weave path into points
number_slider_10 = Slider(500, range=0..1000)
divide_6 = DivideCurve(Curve=simplify_19, Count=number_slider_10, Kinks=False)  # -> Points, Tangents, Parameters

# ----
# Weaving curve points
simplify_20 = SimplifyTree(Tree=divide_6.Points, Front=False)

number_slider_11 = Slider(90, range=0..100)  # disabled
panel_32 = Panel("0")  # disabled
eval_7 = EvaluateCurve(Curve=reparameterize(simplify_16), Parameter=panel_32)  # -> Point, Tangent, Angle; disabled
rad_3 = Radians(Degrees=number_slider_11)  # disabled
rotate_3 = Rotate(Geometry=eval_7.Tangent, Angle=rad_3, Plane=PlaneXY(0, 0, 0))  # -> Geometry, Transform; disabled
shift_6 = ShiftList(List=eval_4.Point, Shift=1, Wrap=True)  # disabled
toggle_4 = BooleanToggle(True)  # disabled

tstat_2 = TreeStatistics(Tree=rotate_3.Geometry)  # -> Paths, Length, Count; disabled
dpath_2 = DeconstructPath(Branch=tstat_2.Paths)  # -> flatten(Indices); disabled
series_11 = Series(Start=dpath_2, Step=1, Count=tstat_2.Length)  # disabled
panel_33 = Panel("2")  # disabled
mod = Modulus(A=series_11, B=panel_33)  # disabled

dispatch_4 = Dispatch(List=rotate_3.Geometry, DispatchPattern=mod)  # -> ListA, ListB; disabled
neg_4 = Negative(Value=dispatch_4.ListB)  # disabled
weave_2 = Weave(Pattern=mod, Stream0=neg_4, Stream1=dispatch_4.ListA, NullGaps=False)  # disabled
arc_5 = ArcSED(Start=eval_4.Point, End=shift_6, Direction=weave_2)  # -> Arc, Plane, Radius; disabled
join_2 = JoinCurves(Curves=arc_5.Arc, Preserve=toggle_4)  # disabled

lastdex_11 = LastIndex(List=arc_5.Radius)  # disabled
pt_12 = Point(cp_2.ClosestPoint)  # disabled
item_14 = ListItem(List=arc_5.Radius, Index=lastdex_11, Wrap=True)  # disabled
end = EndPoints(Curve=join_2)  # -> Start, End; disabled
cir_5 = Circle(Plane=pt_12, Radius=item_14)  # disabled
crv_cp_3 = CurveClosestPoint(Point=end.Start, Curve=cir_5)  # -> Point, Parameter, Distance; disabled
seam_2 = Seam(Curve=cir_5, Seam=crv_cp_3.Parameter)  # disabled

wraps_around_pillar = Slider(1, range=0..10)  # disabled
repeat_4 = RepeatData(Data=seam_2, Length=wraps_around_pillar)  # disabled

simplify_21 = SimplifyTree(Tree=join_2, Front=False)  # disabled
simplify_22 = SimplifyTree(Tree=repeat_4, Front=False)  # disabled

end_2 = EndPoints(Curve=simplify_21)  # -> Start, End; disabled
crv_cp_4 = CurveClosestPoint(Point=end_2.Start, Curve=simplify_21)  # -> Point, Parameter, Distance; disabled
eval_8 = EvaluateCurve(Curve=simplify_21, Parameter=crv_cp_4.Parameter)  # -> Point, Tangent, Angle; disabled
move_12 = Move(Geometry=crv_cp_4.Point, Motion=eval_8.Tangent)  # -> Geometry, Transform; disabled
circle = Circle3Pt(PointA=end_2.Start, PointB=move_12.Geometry, PointC=pt_12)  # -> Circle, Plane, Radius; disabled
flip_8 = FlipCurve(Curve=simplify_22, Guide=circle.Circle)  # -> Curve, Flag; disabled

eval_9 = EvaluateCurve(Curve=reparameterize(flip_8.Curve), Parameter=number_slider_9)  # -> Point, Tangent, Angle; disabled

# ----
# Pillars GCode
starting_z_height_pillars_mm = Panel(addition_2)
trim_5 = TrimTree(Tree=divide_3.Points, Depth=1)

pline_5 = PolyLine(Vertices=trim_5, Closed=Toggle(False))
explode_5 = Explode(Curve=pline_5, Recursive=True)  # -> Segments, Vertices

split_5 = SplitList(List=explode_5.Vertices, Index=1)  # -> ListA, ListB
flow_3 = Flow(layer_height=layer_heigth_mm, line_width=line_width_mm, multiplier=C, filament_diameter=filament_diameter)
panel_34 = Panel(flow_3)

# ----
# Circles starting points
simplify_23 = SimplifyTree(Tree=split_5.ListA, Front=False)

len_4 = Length(Curve=explode_5.Segments)
multiplication_17 = Multiplication(A=len_4, B=flow_3)

# ----
# Circles printing points
simplify_24 = SimplifyTree(Tree=split_5.ListB, Front=False)

# ----
# Travel to first point
speed_mm_s_3 = Slider(200, range=0..1000)
pdecon_12 = Deconstruct(Point=simplify_23)  # -> XComponent, YComponent, ZComponent
addition_8 = Addition(A=pdecon_12.ZComponent, B=starting_z_height_pillars_mm)
addition_9 = Addition(A=addition_8, B=z_hop_mm)
mm_min_5 = Multiplication(A=speed_mm_s_3, B=Slider(60, range=0..100))
Z_10 = Text(" Z")
X_3 = Text(" X")
Y_5 = Text(" Y")
g1_5 = Text("G1 ")
F_6 = Text("F")
concat_6 = Concatenate(
    FragmentH=g1_5,
    FragmentG=F_6,
    FragmentL=mm_min_5,
    FragmentA=X_3,
    FragmentB=pdecon_12.XComponent,
    FragmentC=Y_5,
    FragmentD=pdecon_12.YComponent,
    FragmentE=Z_10,
    FragmentF=addition_9)
travel_to_the_first_point_2 = Panel(concat_6)

# ----
# Perpendicular retraction travel
speed_mm_s_4 = Slider(100, range=0..1000)
pdecon_13 = Deconstruct(Point=simplify_8)  # -> XComponent, YComponent, ZComponent
addition_10 = Addition(A=pdecon_13.ZComponent, B=starting_z_height_pillars_mm)
addition_11 = Addition(A=addition_10, B=z_hop_mm)
mm_min_6 = Multiplication(A=speed_mm_s_4, B=Slider(60, range=0..100))
Z_11 = Text(" Z")
X_4 = Text(" X")
Y_6 = Text(" Y")
g1_6 = Text("G1 ")
F_7 = Text("F")
concat_7 = Concatenate(
    FragmentH=g1_6,
    FragmentG=F_7,
    FragmentL=mm_min_6,
    FragmentA=X_4,
    FragmentB=pdecon_13.XComponent,
    FragmentC=Y_6,
    FragmentD=pdecon_13.YComponent,
    FragmentE=Z_11,
    FragmentF=addition_11)
perpendicular_retraction_travel = Panel(concat_7)

# ----
# Printing
pdecon_14 = Deconstruct(Point=simplify_24)  # -> XComponent, YComponent, ZComponent
ma_2 = MassAddition(Input=multiplication_17)  # -> Result, PartialResults
simplify_25 = SimplifyTree(Tree=ma_2.PartialResults, Front=False)
addition_12 = Addition(A=pdecon_14.ZComponent, B=starting_z_height_pillars_mm)
mm_min_7 = Multiplication(A=pillars_print_speed_mm_s, B=Slider(60, range=0..100))
g1_7 = Text("G1 ")
F_8 = Text("F")
X_5 = Text(" X")
Y_7 = Text(" Y")
Z_12 = Text(" Z")
E_3 = Text(" E")
concat_8 = Concatenate(
    FragmentH=g1_7,
    FragmentG=F_8,
    FragmentL=mm_min_7,
    FragmentA=X_5,
    FragmentB=pdecon_14.XComponent,
    FragmentC=Y_7,
    FragmentD=pdecon_14.YComponent,
    FragmentE=Z_12,
    FragmentF=addition_12,
    FragmentJ=E_3,
    FragmentK=simplify_25)
panel_35 = Panel(concat_8)

# ----
# E of last point in circle
lastdex_12 = LastIndex(List=simplify_25)
item_15 = ListItem(List=simplify_25, Index=lastdex_12, Wrap=True)

# ----
# Z of last point in circle
lastdex_13 = LastIndex(List=addition_12)
item_16 = ListItem(List=addition_12, Index=lastdex_13, Wrap=True)

# ----
# Retraction move
retract_peed_mm_s_2 = Slider(50, range=0..100)
extrusion_retraction_mm_2 = Slider(1.5, range=0..5)
mm_min_8 = Multiplication(A=retract_peed_mm_s_2, B=Slider(60, range=0..100))
addition_13 = Addition(A=item_16, B=z_hop_mm)
subtraction_7 = Subtraction(A=item_15, B=extrusion_retraction_mm_2)
g1_8 = Text("G1 ")
F_9 = Text("F")
F_10 = Text(" Z")
text_2 = Text(" E")
concat_9 = Concatenate(
    FragmentA=g1_8,
    FragmentB=F_9,
    FragmentC=mm_min_8,
    FragmentF=F_10,
    FragmentG=addition_13,
    FragmentD=text_2,
    FragmentE=subtraction_7)
retraction_z_hop_2 = Panel(concat_9)

# ----
# Drop Z and re-prime filament
speed_mm_s_5 = Slider(20, range=0..100)
lng_6 = ListLength(List=simplify_23)
pdecon_15 = Deconstruct(Point=simplify_23)  # -> XComponent, YComponent, ZComponent
addition_14 = Addition(A=pdecon_15.ZComponent, B=starting_z_height_pillars_mm)
mm_min_9 = Multiplication(A=speed_mm_s_5, B=Slider(60, range=0..100))
g1_9 = Text("G1 ")
F_11 = Text("F")
Z_13 = Text(" Z")
E_4 = Text(" E")
concat_10 = Concatenate(
    FragmentH=g1_9,
    FragmentG=F_11,
    FragmentL=mm_min_9,
    FragmentE=Z_13,
    FragmentF=addition_14,
    FragmentA=E_4,
    FragmentB=extrusion_retraction_mm_2)
z_drop_reprime_2 = Panel(concat_10)
repeat_5 = RepeatData(Data="G92 E0       ;Reset extruder", Length=lng_6)
simplify_26 = SimplifyTree(Tree=repeat_5, Front=False)
merge_10 = Merge(Data1=simplify_26, Data2=z_drop_reprime_2, Data3=simplify_26)
z_drop_reprime_reset_2 = Panel(merge_10)

# ----
# Weave
pdecon_16 = Deconstruct(Point=simplify_20)  # -> XComponent, YComponent, ZComponent
needle_z_offset_2 = Panel(needle_z_offset)
starting_z_height_pillars_mm_2 = Panel(starting_z_height_pillars_mm)
needle_y_offset_2 = Panel(needle_y_offset)
addition_15 = Addition(A=pdecon_16.ZComponent, B=needle_z_offset_2)
addition_16 = Addition(A=pdecon_16.YComponent, B=needle_y_offset_2)
addition_17 = Addition(A=addition_15, B=starting_z_height_pillars_mm_2)
mm_min_10 = Multiplication(A=weaving_speed_mm_s, B=Slider(60, range=0..100))
g1_10 = Text("G1 ")
F_12 = Text("F")
X_6 = Text(" X")
Y_8 = Text(" Y")
Z_14 = Text(" Z")
concat_11 = Concatenate(
    FragmentH=g1_10,
    FragmentG=F_12,
    FragmentL=mm_min_10,
    FragmentA=X_6,
    FragmentB=pdecon_16.XComponent,
    FragmentC=Y_8,
    FragmentD=addition_16,
    FragmentE=Z_14,
    FragmentF=addition_17)
panel_36 = Panel(concat_11)

merge_11 = Merge(
    Data1=travel_to_the_first_point_2,
    Data2=z_drop_reprime_reset_2,
    Data3=panel_35,
    Data4=retraction_z_hop_2,
    Data5=perpendicular_retraction_travel)
panel_37 = Panel(merge_11)

# ----
# Pillars trimmed into just layers
trim_6 = TrimTree(Tree=panel_37, Depth=1)

# ----
# Weaving GCode
simplify_27 = SimplifyTree(Tree=divide_6.Points, Front=False)
pick_up_blue_anchor_wrap = Panel("""; Start of pick up gcode blue
G91 ; relative positioning
G1 F500 Z25 ; Z offset
G90; absolute positioning
G1 F6000 X61.5 Y26 ; to pickup start XY
G1 F500 Z37 ; to pickup start Z
G1 F4000 X61.5 Y6 Z37  ; move to needle
G1 F4000 X42.5 Y6 Z37  ; lock in to needle
G1 F4000 X42.5 Y26 Z37  ; pull away
; end of pick up gcode v2""")
park_blue_anchor_wrap = Panel("""; Start of park gcode blue
G91 ; relative positioning
G1 F500 Z5 ; Z offset
G90; absolute positioning
G1 F4000 X60  ; approach X
G1 F4000 Y26  ; approach Y
G1 F500 Z37 ; approach Z
G1 F4000 X42.5  ; slide X to wrap
G1 F4000 X42.5 Y6 Z37  ; move to station
G1 F4000 X61.5 Y6 Z37  ; decouple needle
G1 F4000 X61.5 Y26 Z37  ; pull away
; end of park gcode v2""")
priming_strip = Panel("""; --- Wipe Strip
G92 E0           ; Reset extruder
G1 X5 Y254 F10000  ; Move to purge XY
G1 Z0.3 F500     ; Move close to bed

G1 X45 Y254 E15 F500 ; Draw purge line up along Y axis
G1 F1000 Z0.8 E14     ; Retract extruder
G92 E0           ; Reset extruder again
; --- End of Priming Line G-code ---""")

# ----
# Weave path starting points
item_17 = ListItem(List=simplify_27, Index=0, Wrap=True)

dist_3 = Distance(PointA=pt_9, PointB=item_17)  # disabled
pdecon_17 = Deconstruct(Point=item_17)  # -> XComponent, YComponent, ZComponent; disabled
addition_18 = Addition(A=pdecon_17.XComponent, B=number_slider_7)  # disabled
subtraction_8 = Subtraction(A=dist_3, B=addition_18)  # disabled
division_12 = Division(A=subtraction_8, B=multiplication_4)  # disabled
round_2 = Round(Number=division_12)  # -> Nearest, Floor, Ceiling; disabled
multiplication_18 = Multiplication(A=round_2.Floor, B=number_slider_8)  # disabled
repeat_6 = RepeatData(Data=panel_16, Length=multiplication_18)  # disabled
panel_38 = Panel(repeat_6)  # disabled

# ----
# XY to resting point
speed_mm_s_6 = Slider(75, range=0..100)
pdecon_18 = Deconstruct(Point=pt_2)  # -> XComponent, YComponent, ZComponent
needle_y_offset_3 = Panel(needle_y_offset)
addition_19 = Addition(A=pdecon_18.YComponent, B=needle_y_offset_3)
mm_min_11 = Multiplication(A=speed_mm_s_6, B=Slider(60, range=0..100))
g1_11 = Text("G1 ")
F_13 = Text("F")
X_7 = Text(" X")
Y_9 = Text(" Y")
lng_7 = ListLength(List=item_17)
concat_12 = Concatenate(
    FragmentH=g1_11,
    FragmentG=F_13,
    FragmentL=mm_min_11,
    FragmentA=X_7,
    FragmentB=pdecon_18.XComponent,
    FragmentC=Y_9,
    FragmentD=addition_19)
repeat_7 = RepeatData(Data=concat_12, Length=lng_7)
simplify_28 = SimplifyTree(Tree=repeat_7, Front=False)
panel_39 = Panel(simplify_28)

# ----
# X to resting point
speed_mm_s_7 = Slider(75, range=0..100)
pdecon_19 = Deconstruct(Point=pt_3)  # -> XComponent, YComponent, ZComponent
mm_min_12 = Multiplication(A=speed_mm_s_7, B=Slider(60, range=0..100))
g1_12 = Text("G1 ")
F_14 = Text("F")
X_8 = Text(" X")
concat_13 = Concatenate(FragmentH=g1_12, FragmentG=F_14, FragmentL=mm_min_12, FragmentA=X_8, FragmentB=pdecon_19.XComponent)
repeat_8 = RepeatData(Data=concat_13, Length=lng_7)
simplify_29 = SimplifyTree(Tree=repeat_8, Front=False)
panel_40 = Panel(simplify_29)

# ----
# Y to resting point
speed_mm_s_8 = Slider(75, range=0..100)
pdecon_20 = Deconstruct(Point=pt_4)  # -> XComponent, YComponent, ZComponent
needle_y_offset_4 = Panel(needle_y_offset)
addition_20 = Addition(A=pdecon_20.YComponent, B=needle_y_offset_4)
mm_min_13 = Multiplication(A=speed_mm_s_8, B=Slider(60, range=0..100))
Y_10 = Text(" Y")
g1_13 = Text("G1 ")
F_15 = Text("F")
concat_14 = Concatenate(FragmentH=g1_13, FragmentG=F_15, FragmentL=mm_min_13, FragmentC=Y_10, FragmentD=addition_20)
repeat_9 = RepeatData(Data=concat_14, Length=lng_7)
simplify_30 = SimplifyTree(Tree=repeat_9, Front=False)
panel_41 = Panel(simplify_30)

# ----
# Z to level with weave + clearance high
speed_mm_s_9 = Slider(10, range=0..200)
needle_z_offset_3 = Panel(needle_z_offset)
pdecon_21 = Deconstruct(Point=item_17)  # -> XComponent, YComponent, ZComponent
starting_z_height_pillars_mm_3 = Panel(starting_z_height_pillars_mm)
addition_21 = Addition(A=pdecon_21.ZComponent, B=needle_z_offset_3)
crease_period_3 = Panel(weft_distance)
addition_22 = Addition(A=addition_21, B=starting_z_height_pillars_mm_3)
mm_min_14 = Multiplication(A=speed_mm_s_9, B=Slider(60, range=0..100))
addition_23 = Addition(A=addition_22, B=Slider(25, range=0..50))
Z_15 = Text(" Z")
g1_14 = Text("G1 ")
F_16 = Text("F")
concat_15 = Concatenate(FragmentH=g1_14, FragmentG=F_16, FragmentL=mm_min_14, FragmentE=Z_15, FragmentF=addition_23)
travel_to_the_first_point_3 = Panel(concat_15)

# ----
# Pickup
pick_up_blue = Panel("""; Start of pick up gcode blue
G91 ; relative positioning
G1 F500 Z25 ; Z offset
G90; absolute positioning
G1 F6000 X61.5 Y26 ; to pickup start XY
G1 F500 Z37 ; to pickup start Z
G1 F4000 X61.5 Y6 Z37  ; move to needle
G1 F4000 X42.5 Y6 Z37  ; lock in to needle
G1 F4000 X42.5 Y26 Z37  ; pull away
; end of pick up gcode v2""")
tstat_3 = TreeStatistics(Tree=item_17)  # -> Paths, Length, Count
py3_2 = Python3Script(paths=tstat_3.Paths, data=pick_up_blue_anchor_wrap)  # -> out, a; inputs paths: list, data: list
# ---------- py3_2: Python ----------
from Grasshopper import DataTree
from Grasshopper.Kernel.Data import GH_Path

output = DataTree[object]()

for i, path in enumerate(paths):
    output.AddRange(data, path)

a = output
# ---------- end py3_2 ----------
panel_42 = Panel(py3_2.a)

# ----
# Park
park_blue = Panel("""; Start of park gcode blue
G91 ; relative positioning
G1 F500 Z20 ; Z offset
G90; absolute positioning
G1 F6000 X42.5  ; approach X
G1 F6000 Y26  ; approach Y
G1 F500 Z37 ; approach Z
G1 F4000 X42.5 Y6 Z37  ; move to station
G1 F4000 X61.5 Y6 Z37  ; decouple needle
G1 F4000 X61.5 Y26 Z37  ; pull away
; end of park gcode v2""")
tstat_4 = TreeStatistics(Tree=item_17)  # -> Paths, Length, Count
py3_3 = Python3Script(paths=tstat_4.Paths, data=park_blue_anchor_wrap)  # -> out, a; inputs paths: list, data: list; same code as py3_2
panel_43 = Panel(py3_3.a)

# ----
# Pickup double station
pick_up_blue_2nd_station = Panel("""; Start of pick up gcode 2nd station
G91 ; relative positioning
G1 F500 Z25 ; Z offset
G90; absolute positioning
G1 F16000 X181.5 Y26 ; to pickup start XY
G1 F500 Z37 ; to pickup start Z
G1 F4000 X181.5 Y6 Z37  ; move to needle
G1 F4000 X162.5 Y6 Z37  ; lock in to needle
G1 F4000 X162.5 Y26 Z37  ; pull away
; end of pick up gcode v2""")
py3_4 = Python3Script(p1=pick_up_blue, p2=pick_up_blue_2nd_station, ref=item_17, step=switch_yarn_every_x_layer)  # -> a_out; inputs p1: list, p2: list, ref: tree
# ---------- py3_4: Python ----------
from Grasshopper import DataTree
from Grasshopper.Kernel.Data import GH_Path

output = DataTree[object]()

n = ref.BranchCount
list_p1 = list(p1)
list_p2 = list(p2)

for i in range(n):
    if (i // step) % 2 == 0:
        for item in list_p1:
            output.Add(item, GH_Path(i))
    else:
        for item in list_p2:
            output.Add(item, GH_Path(i))

a_out = output
# ---------- end py3_4 ----------
panel_44 = Panel(py3_4)

# ----
# Z to level with weave + clearance low
speed_mm_s_10 = Slider(10, range=0..200)
needle_z_offset_4 = Panel(needle_z_offset)
pdecon_22 = Deconstruct(Point=item_17)  # -> XComponent, YComponent, ZComponent
starting_z_height_pillars_mm_4 = Panel(starting_z_height_pillars_mm)
addition_24 = Addition(A=pdecon_22.ZComponent, B=needle_z_offset_4)
addition_25 = Addition(A=addition_24, B=starting_z_height_pillars_mm_4)
mm_min_15 = Multiplication(A=speed_mm_s_10, B=Slider(60, range=0..100))
addition_26 = Addition(A=addition_25, B=Slider(5, range=0..10))
Z_16 = Text(" Z")
g1_15 = Text("G1 ")
F_17 = Text("F")
concat_16 = Concatenate(FragmentH=g1_15, FragmentG=F_17, FragmentL=mm_min_15, FragmentE=Z_16, FragmentF=addition_26)
travel_to_the_first_point_4 = Panel(concat_16)

# ----
# Z to level with weave
speed_mm_s_11 = Slider(10, range=0..200)
needle_z_offset_5 = Panel(needle_z_offset)
pdecon_23 = Deconstruct(Point=item_17)  # -> XComponent, YComponent, ZComponent
starting_z_height_pillars_mm_5 = Panel(starting_z_height_pillars_mm)
addition_27 = Addition(A=pdecon_23.ZComponent, B=needle_z_offset_5)
addition_28 = Addition(A=addition_27, B=starting_z_height_pillars_mm_5)
mm_min_16 = Multiplication(A=speed_mm_s_11, B=Slider(60, range=0..100))
Z_17 = Text(" Z")
g1_16 = Text("G1 ")
F_18 = Text("F")
concat_17 = Concatenate(FragmentH=g1_16, FragmentG=F_18, FragmentL=mm_min_16, FragmentE=Z_17, FragmentF=addition_28)
travel_to_the_first_point_5 = Panel(concat_17)

# ----
# Park double station
park_blue_2nd_station = Panel("""; Start of park gcode 2nd station
G91 ; relative positioning
G1 F500 Z20 ; Z offset
G90; absolute positioning
G1 F6000 X162.5 ; approach X
G1 F6000 Y26  ; approach Y
G1 F500 Z37 ; approach Z
G1 F4000 X162.5 Y6 Z37  ; move to station
G1 F4000 X181.5 Y6 Z37  ; decouple needle
G1 F4000 X181.5 Y26 Z37  ; pull away
; end of park gcode v2""")
py3_5 = Python3Script(p1=park_blue, p2=park_blue_2nd_station, ref=item_17, step=switch_yarn_every_x_layer)  # -> a_out; inputs p1: list, p2: list, ref: tree; same code as py3_4
panel_45 = Panel(py3_5)

# ----
# Pause
panel_46 = Panel("G4 S20     ; (pause and wait 20 sec)")
lng_8 = ListLength(List=item_17)
repeat_10 = RepeatData(Data=panel_46, Length=lng_8)
simplify_31 = SimplifyTree(Tree=repeat_10, Front=False)
panel_47 = Panel(simplify_31)

# ----
# Wipe
wipe = Panel("""; nozzle wipe G92 E0 ; zero extruder G1 E-0.5 F300 ; retract filament
G1 X55 Y262.5 F15000 ; nozzle wipe position start
G1 Z0.4; nozzle down (matching default z height when original wipe happens)
G1 X20 Y262.5 F15000 ; first wipe
G1 X20 Y262 F15000 ; Y down G1 X65 Y262 F15000 ; wipe
G1 X65 Y261.5 F15000 ; Y down G1 X20 Y261.5 F15000 ; wipe
G1 X20 Y261 F15000 ; Y down G1 X65 Y261 F15000 ; wipe
G1 X65 Y260.5 F15000 ; Y down G1 X20 Y260.5 F15000 ; wipe
G1 X20 Y260 F15000 ; Y down G1 X65 Y260 F15000 ; wipe
G1 F500 Z10 ; Lift Z
; end of wipe code""")
tstat_5 = TreeStatistics(Tree=item_17)  # -> Paths, Length, Count
py3_6 = Python3Script(paths=tstat_5.Paths, data=wipe)  # -> out, a; inputs paths: list, data: list; same code as py3_2
panel_48 = Panel(py3_6.a)

# ----
# Prime
tstat_6 = TreeStatistics(Tree=item_17)  # -> Paths, Length, Count
py3_7 = Python3Script(paths=tstat_6.Paths, data=priming_strip)  # -> out, a; inputs paths: list, data: list; same code as py3_2
panel_49 = Panel(py3_7.a)

# ----
# Filter single or double
py3_8 = Python3Script(single=panel_42, double=panel_44, sel=toggle)  # -> a_out; inputs single: list, double: list, sel: Boolean
# ---------- py3_8: Python ----------
a_out = list(double if sel else single)
# ---------- end py3_8 ----------
py3_9 = Python3Script(single=panel_43, double=panel_45, sel=toggle)  # -> a_out; inputs single: list, double: list, sel: Boolean; same code as py3_8
simplify_32 = SimplifyTree(Tree=py3_8, Front=False)
simplify_33 = SimplifyTree(Tree=py3_9, Front=False)
panel_50 = Panel(simplify_33)
panel_51 = Panel(simplify_32)

# ----
# Top brim
starting_z_height_pillars_mm_6 = Panel(starting_z_height_pillars_mm)

# ----
# Brims GCode
# Travel to first point
speed_mm_s_12 = Slider(25, range=0..200)
pdecon_24 = Deconstruct(Point=simplify_9)  # -> XComponent, YComponent, ZComponent
addition_29 = Addition(A=pdecon_24.ZComponent, B=starting_z_height_pillars_mm_6)
addition_30 = Addition(A=addition_29, B=z_hop_mm_2)
mm_min_17 = Multiplication(A=speed_mm_s_12, B=Slider(60, range=0..100))
Z_18 = Text(" Z")
X_9 = Text(" X")
Y_11 = Text(" Y")
g1_17 = Text("G1 ")
F_19 = Text("F")
concat_18 = Concatenate(
    FragmentH=g1_17,
    FragmentG=F_19,
    FragmentL=mm_min_17,
    FragmentA=X_9,
    FragmentB=pdecon_24.XComponent,
    FragmentC=Y_11,
    FragmentD=pdecon_24.YComponent,
    FragmentE=Z_18,
    FragmentF=addition_30)
travel_to_the_first_point_6 = Panel(concat_18)

# ----
# Print
pdecon_25 = Deconstruct(Point=simplify_11)  # -> XComponent, YComponent, ZComponent
ma_3 = MassAddition(Input=multiplication_10)  # -> Result, PartialResults
simplify_34 = SimplifyTree(Tree=ma_3.PartialResults, Front=False)
addition_31 = Addition(A=pdecon_25.ZComponent, B=starting_z_height_pillars_mm_6)
mm_min_18 = Multiplication(A=top_brim_print_speed_mm_s, B=Slider(60, range=0..100))
g1_18 = Text("G1 ")
F_20 = Text("F")
X_10 = Text(" X")
Y_12 = Text(" Y")
Z_19 = Text(" Z")
E_5 = Text(" E")
concat_19 = Concatenate(
    FragmentH=g1_18,
    FragmentG=F_20,
    FragmentL=mm_min_18,
    FragmentA=X_10,
    FragmentB=pdecon_25.XComponent,
    FragmentC=Y_12,
    FragmentD=pdecon_25.YComponent,
    FragmentE=Z_19,
    FragmentF=addition_31,
    FragmentJ=E_5,
    FragmentK=simplify_34)
panel_52 = Panel(concat_19)

lastdex_14 = LastIndex(List=simplify_34)
item_18 = ListItem(List=simplify_34, Index=lastdex_14, Wrap=True)

lastdex_15 = LastIndex(List=addition_31)
item_19 = ListItem(List=addition_31, Index=lastdex_15, Wrap=True)

# ----
# Retraction move
retract_peed_mm_s_3 = Slider(25, range=0..100)
extrusion_retraction_mm_3 = Slider(0.05, range=0..5)
mm_min_19 = Multiplication(A=retract_peed_mm_s_3, B=Slider(60, range=0..100))
addition_32 = Addition(A=item_19, B=z_hop_mm_2)
subtraction_9 = Subtraction(A=item_18, B=extrusion_retraction_mm_3)
g1_19 = Text("G1 ")
F_21 = Text("F")
F_22 = Text(" Z")
text_3 = Text(" E")
concat_20 = Concatenate(
    FragmentA=g1_19,
    FragmentB=F_21,
    FragmentC=mm_min_19,
    FragmentF=F_22,
    FragmentG=addition_32,
    FragmentD=text_3,
    FragmentE=subtraction_9)
retraction_z_hop_3 = Panel(concat_20)

# ----
# Drop Z and re-prime filament
speed_mm_s_13 = Slider(25, range=0..100)
lng_9 = ListLength(List=simplify_9)
pdecon_26 = Deconstruct(Point=simplify_9)  # -> XComponent, YComponent, ZComponent
addition_33 = Addition(A=pdecon_26.ZComponent, B=starting_z_height_pillars_mm_6)
mm_min_20 = Multiplication(A=speed_mm_s_13, B=Slider(60, range=0..100))
g1_20 = Text("G1 ")
F_23 = Text("F")
E_6 = Text(" E")
Z_20 = Text(" Z")
concat_21 = Concatenate(
    FragmentH=g1_20,
    FragmentG=F_23,
    FragmentL=mm_min_20,
    FragmentE=Z_20,
    FragmentF=addition_33,
    FragmentA=E_6,
    FragmentB=extrusion_retraction_mm_3)
z_drop_reprime_3 = Panel(concat_21)
repeat_11 = RepeatData(Data="G92 E0       ;Reset extruder", Length=lng_9)
simplify_35 = SimplifyTree(Tree=repeat_11, Front=False)
merge_12 = Merge(Data1=simplify_35, Data2=z_drop_reprime_3, Data3=simplify_35)
z_drop_reprime_reset_3 = Panel(merge_12)

merge_13 = Merge(Data1=travel_to_the_first_point_6, Data2=z_drop_reprime_reset_3, Data3=panel_52, Data4=retraction_z_hop_3)
panel_53 = Panel(merge_13)

merge_14 = Merge(Data1=panel_51, Data2=travel_to_the_first_point_3, Data3=panel_41, Data4=panel_40, Data5=travel_to_the_first_point_5)
merge_15 = Merge(
    Data1=panel_39,
    Data2=panel_50,
    Data3=travel_to_the_first_point_4,
    Data4=panel_48,
    Data5=panel_49,
    Data6=travel_to_the_first_point_4)

# ----
# Park
panel_54 = Panel(merge_15)

# ----
# Pickup
panel_55 = Panel(merge_14)

merge_16 = Merge(Data1=panel_55, Data2=panel_36, Data3=panel_54)
panel_56 = Panel(merge_16)

tstat_7 = TreeStatistics(Tree=panel_56)  # -> Paths, Length, Count; disabled
panel_57 = Panel(tstat_7.Paths)  # disabled
replace = ReplacePaths(Data=panel_56, Search=tstat_7.Paths, Replace=trim_4)  # disabled

# ----
# Combine pillars + weaving
merge_17 = Merge(Data1=trim_6, Data2=panel_56)
panel_58 = Panel(merge_17)

# ----
# Final GCode
# Start 230, 50 (final): ; --- Start G-code for Bambu A1 (No AMS) ---
# 
# ; Home and prepare printer
# G21             ; Set units to milimetres
# M82             ; Absolute extrusion
# G90             ; Use absolute positioning
# G28 Z             ; Home Z
# G0 Z120 F500             ; Lift Z to 120mm to avoid station
# G28 X Y             ; Home X & Y
# 
# ; Heat up bed and nozzle gradually
# M140 S50         ; Start heating bed to 50°C (non-blocking)
# M104 S230        ; Start heating hotend to 230°C (non-blocking)
# M190 S50         ; Wait for bed to reach 50°C
# M109 S230        ; Wait for hotend to reach 230°C
# 
# M106 S128        ; Set part cooling fan to 50% speed (max is S255)
# 
# ; --- Wipe Strip / Priming Line ---
# G92 E0           ; Reset extruder
# G1 X50 Y251 F10000  ; Move to purge XY
# G1 Z0.3 F500     ; Move close to bed
# 
# G1 X150 Y251 E15 F1000 ; Draw purge line up along Y axis
# G1 F500 Z2 E13     ; Retract extruder
# G92 E0           ; Reset extruder again
# 
# ; --- Prep for printing ---
# 
# G0 X128 Y128 F10000 ; Move to print start position
# 
# ; --- End of Start G-code ---
# Start 220, 50 (final): ; --- Start G-code for Bambu A1 (No AMS) ---
# 
# ; Home and prepare printer
# G21             ; Set units to milimetres
# M82             ; Absolute extrusion
# G90             ; Use absolute positioning
# G28 Z             ; Home Z
# G0 Z120 F500             ; Lift Z to 120mm to avoid station
# G28 X Y             ; Home X & Y
# 
# ; Heat up bed and nozzle gradually
# M140 S50         ; Start heating bed to 50°C (non-blocking)
# M104 S220        ; Start heating hotend to 220°C (non-blocking)
# M190 S50         ; Wait for bed to reach 50°C
# M109 S220        ; Wait for hotend to reach 220°C
# 
# M106 S128        ; Set part cooling fan to 50% speed (max is S255)
# 
# ; --- Wipe Strip / Priming Line ---
# G92 E0           ; Reset extruder
# G1 X50 Y251 F10000  ; Move to purge XY
# G1 Z0.3 F500     ; Move close to bed
# 
# G1 X150 Y251 E15 F1000 ; Draw purge line up along Y axis
# G1 F500 Z2 E13     ; Retract extruder
# G92 E0           ; Reset extruder again
# 
# ; --- Prep for printing ---
# 
# G0 X128 Y128 F10000 ; Move to print start position
# 
# ; --- End of Start G-code ---
start_190_50_final = Panel("""; --- Start G-code for Bambu A1 (No AMS) ---

; Home and prepare printer
G21             ; Set units to milimetres
M82             ; Absolute extrusion
G90             ; Use absolute positioning
G28 Z             ; Home Z
G0 Z120 F500             ; Lift Z to 120mm to avoid station
G28 X Y             ; Home X & Y

; Heat up bed and nozzle gradually
M140 S50         ; Start heating bed to 50°C (non-blocking)
M104 S190        ; Start heating hotend to 190°C (non-blocking)
M190 S50         ; Wait for bed to reach 50°C
M109 S190        ; Wait for hotend to reach 190°C

M106 S128        ; Set part cooling fan to 50% speed (max is S255)

; --- Wipe Strip / Priming Line ---
G92 E0           ; Reset extruder
G1 X50 Y251 F10000  ; Move to purge XY
G1 Z0.3 F500     ; Move close to bed

G1 X150 Y251 E15 F1000 ; Draw purge line up along Y axis
G1 F500 Z2 E13     ; Retract extruder
G92 E0           ; Reset extruder again

; --- Prep for printing ---

G0 X128 Y128 F10000 ; Move to print start position

; --- End of Start G-code ---""")
end_protocol_05_07 = Panel("""; --- End G-code for Bambu A1 (No AMS) ---

M83               ; Relative extrusion mode
G0 E-3.0 F3000    ; Retract filament to relieve pressure
G92 E0       ; Reset extruder

; Move print head up and away
G91 ; all axes to relative
G0 Z10 F1000 ; Lift nozzle up 10mm

; Turn off fans and heaters
M106 S0           ; Turn off part cooling fan
M104 S0           ; Turn off hotend
M140 S0           ; Turn off bed

; Disable steppers
G4 S5           ; Wait 5 sec
M84               ; Disable all stepper motors

; --- End of End G-code ---""")
# Start 200, 50 (final): ; --- Start G-code for Bambu A1 (No AMS) ---
# 
# ; Home and prepare printer
# G21             ; Set units to milimetres
# M82             ; Absolute extrusion
# G90             ; Use absolute positioning
# G28 Z             ; Home Z
# G0 Z120 F500             ; Lift Z to 120mm to avoid station
# G28 X Y             ; Home X & Y
# 
# ; Heat up bed and nozzle gradually
# M140 S50         ; Start heating bed to 50°C (non-blocking)
# M104 S200        ; Start heating hotend to 200°C (non-blocking)
# M190 S50         ; Wait for bed to reach 50°C
# M109 S200        ; Wait for hotend to reach 200°C
# 
# M106 S128        ; Set part cooling fan to 50% speed (max is S255)
# 
# ; --- Wipe Strip / Priming Line ---
# G92 E0           ; Reset extruder
# G1 X50 Y251 F10000  ; Move to purge XY
# G1 Z0.3 F500     ; Move close to bed
# 
# G1 X150 Y251 E15 F1000 ; Draw purge line up along Y axis
# G1 F500 Z2 E13     ; Retract extruder
# G92 E0           ; Reset extruder again
# 
# ; --- Prep for printing ---
# 
# G0 X128 Y128 F10000 ; Move to print start position
# 
# ; --- End of Start G-code ---
merge_18 = Merge(
    Data1=start_190_50_final,
    Data2=flatten(panel_15),
    Data3=flatten(panel_58),
    Data4=flatten(panel_53),
    Data5=end_protocol_05_07)

# ----
# Printing + Weaving GCode
panel_59 = Panel(merge_18)

# ==== cluster Flow
filament_diameter = ClusterInput()
layer_height = ClusterInput()
line_width = ClusterInput()
multiplier = ClusterInput()
division = Division(FilamentDiameter=filament_diameter, B=2)
multiplication = Multiplication(LayerHeight=layer_height, LineWidth=line_width, Multiplier=multiplier)
sqr = Square(Value=division)
pi = Pi(Factor=sqr)
division_2 = Division(A=multiplication, B=pi)
R = ClusterOutput(division_2)
