# Grasshopper definition Yarn Textures.gh (Grasshopper 1.0.8)
# plug-ins: Pufferfish

# ----
# Double Station
brep = Brep(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)
preview = CustomPreview(Geometry=brep, Material=ColourSwatch(SwatchColor=RGBA(34, 52, 181, 101)))

# ----
# Read First
# This script was developped primarily to generate
# GCode for fabricating demonstrators for Filaloom.
# This script in particular is less robust than the
# others seen in this project. Use it as an example
# where to see the principles we used to generate
# FilaLoom GCode, but beware when directly using it
# to generate your own.
# 
# Custom GCode can cause damage to the printer
# when not careful, use at your own risk.
# Always check whether the toolpaths are within
# bounds of the build volume to avoid issues with
# your printer.
# 
# Thank you!
# Print Bed Preview
# Station
brep_2 = Brep(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)
preview_2 = CustomPreview(Geometry=brep_2, Material=ColourSwatch(SwatchColor=RGBA(34, 52, 181, 101)))

# ----
# Clearance:
# no printing or weaving
brep_3 = Brep(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)
preview_3 = CustomPreview(Geometry=brep_3, Material=ColourSwatch(SwatchColor=RGBA(181, 34, 34, 16)))

# ----
# Clearance:
# no weaving
brep_4 = Brep(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)
preview_4 = CustomPreview(Geometry=brep_4, Material=ColourSwatch(SwatchColor=RGBA(0, 178, 181, 16)))

# ----
# Print bed
crv = Curve([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])

# ----
# Example woven texture
# Surface where texture is applied
srf = Surface(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)

# ----
# Geometry
brep_5 = Brep(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)

# ----
# Example Fluffy texture
# Surface where texture is applied
srf_2 = Surface(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)

# ----
# Opposing surface to generate
# sacrificial anchors
srf_3 = Surface(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)

# ----
# Geometry
brep_6 = Brep(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)

# ----
# Example wrapping texture
# Wall where texture is applied
brep_7 = Brep(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)

# ----
# Geometry
brep_8 = Brep(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)

# ----
# Print Parameters
# Input surface
# (Woven texture)
weaving_speed_mm_s = Slider(15, range=0..100)

# ----
# Yarn depositor needle tip
# offset from nozzle
needle_z_offset = Slider(23.75, range=0..100)
needle_y_offset = Slider(41.5, range=0..100)

# ----
# Pillar radii
max_radius = Slider(1.8, range=0..10)
min_radius = Slider(1.4, range=0..10)

# ----
# Base Geometry
brep_9 = Brep(brep_5)

# ----
# Variables
# Body
# Warp distance
warp_distance_pillars = Slider(8, range=0..100)

# ----
# Weft distance
weft_distance = Slider(2.5, range=0..10)

# ----
# Channel radius
# (at least 2x needle radius)
# FilaLoom Specifics
number_slider = Slider(1.4, range=0..10)

# ----
# Create surface at the placement
# you want the texture in the object
# 
# Import this surface here
# 
# Move surface in rhino to align anchors
# Surface where texture is applied
srf_4 = Surface(srf)

# ----
# planes at weaving height
crease_distance = Panel(weft_distance)  # disabled
number_slider_2 = Slider(30, range=0..1000)  # disabled
number_slider_3 = Slider(0.25, range=0..1)  # disabled
division = Division(A=number_slider_2, B=crease_distance)  # disabled
multiplication = Multiplication(A=crease_distance, B=number_slider_3)  # disabled
pl = ConstructPlane(Origin=Point(0, 0, 0), XAxis=Vector(1, 0, 0), YAxis=Vector(0, 1, 0))  # disabled
series = Series(Start=multiplication, Step=crease_distance, Count=division)  # disabled
Z = UnitZ(Factor=series)  # disabled
move = Move(Geometry=pl, Motion=Z)  # -> Geometry, Transform; disabled

# ----
# planes at weaving height
crease_distance_2 = Panel(weft_distance)  # disabled
number_slider_4 = Slider(30, range=0..1000)  # disabled
number_slider_5 = Slider(0.25, range=0..1)  # disabled
division_2 = Division(A=number_slider_4, B=crease_distance_2)  # disabled
multiplication_2 = Multiplication(A=crease_distance_2, B=number_slider_5)  # disabled
pl_2 = ConstructPlane(Origin=Point(0, 0, 0), XAxis=Vector(1, 0, 0), YAxis=Vector(0, 1, 0))  # disabled
series_2 = Series(Start=multiplication_2, Step=crease_distance_2, Count=division_2)  # disabled
Z_2 = UnitZ(Factor=series_2)  # disabled
move_2 = Move(Geometry=pl_2, Motion=Z_2)  # -> Geometry, Transform; disabled

# ----
# Input BRep
# (Wrapping texture)
# Create BRep at the placement
# you want the texture in the object,
# The yarn will wrap around this BRep
# 
# Import this BRep here
# Wall where texture is applied
brep_10 = Brep(brep_7)

# ----
# Base Geometry
brep_11 = Brep(brep_8)

# ----
# Opposing
srf_5 = Surface(srf_3)

# ----
# Base Geometry
brep_12 = Brep(brep_6)

# ----
# Input surfaces
# (Carpet texture)
# Create surface at the placement
# you want the texture in the object
# 
# Then copy the surface and move it
# opposing to the first one
# 
# Import both surface here
# 
# Move surfaces in rhino to align anchors
# Inside
srf_6 = Surface(srf_2)

# ----
# Station anchor
pt = Point(<point referenced from the Rhino model>)  # disabled

# ----
# planes at weaving height
yarn_z_distance = Panel(weft_distance)  # disabled
number_slider_6 = Slider(30, range=0..1000)  # disabled
number_slider_7 = Slider(0.25, range=0..1)  # disabled
division_3 = Division(A=number_slider_6, B=yarn_z_distance)  # disabled
multiplication_3 = Multiplication(A=yarn_z_distance, B=number_slider_7)  # disabled
pl_3 = ConstructPlane(Origin=Point(0, 0, 0), XAxis=Vector(1, 0, 0), YAxis=Vector(0, 1, 0))  # disabled
series_3 = Series(Start=multiplication_3, Step=yarn_z_distance, Count=division_3)  # disabled
Z_3 = UnitZ(Factor=series_3)  # disabled
move_3 = Move(Geometry=pl_3, Motion=Z_3)  # -> Geometry, Transform; disabled

# ----
# planes at weaving height
crease_distance_3 = Panel(weft_distance)  # disabled
number_slider_8 = Slider(30, range=0..1000)  # disabled
number_slider_9 = Slider(0.25, range=0..1)  # disabled
division_4 = Division(A=number_slider_8, B=crease_distance_3)  # disabled
multiplication_4 = Multiplication(A=crease_distance_3, B=number_slider_9)  # disabled
pl_4 = ConstructPlane(Origin=Point(0, 0, 0), XAxis=Vector(1, 0, 0), YAxis=Vector(0, 1, 0))  # disabled
series_4 = Series(Start=multiplication_4, Step=crease_distance_3, Count=division_4)  # disabled
Z_4 = UnitZ(Factor=series_4)  # disabled
move_4 = Move(Geometry=pl_4, Motion=Z_4)  # -> Geometry, Transform; disabled

# ----
# planes at weaving height
yarn_z_distance_2 = Panel(weft_distance)  # disabled
number_slider_10 = Slider(30, range=0..1000)  # disabled
number_slider_11 = Slider(0.25, range=0..1)  # disabled
division_5 = Division(A=number_slider_10, B=yarn_z_distance_2)  # disabled
multiplication_5 = Multiplication(A=yarn_z_distance_2, B=number_slider_11)  # disabled
pl_5 = ConstructPlane(Origin=Point(0, 0, 0), XAxis=Vector(1, 0, 0), YAxis=Vector(0, 1, 0))  # disabled
series_5 = Series(Start=multiplication_5, Step=yarn_z_distance_2, Count=division_5)  # disabled
Z_5 = UnitZ(Factor=series_5)  # disabled
move_5 = Move(Geometry=pl_5, Motion=Z_5)  # -> Geometry, Transform; disabled

# ----
# Wrapping Texture
# Intersection
sec = BrepPlane(Brep=brep_10, Plane=move_5.Geometry)  # -> Curves, Points; disabled
simplify = SimplifyTree(Tree=sec.Curves, Front=False)  # disabled

# ----
# Station anchor
pt_2 = Point(<point referenced from the Rhino model>)  # disabled

number_slider_12 = Slider(0, range=0..100)  # disabled
number_slider_13 = Slider(126, range=0..1000)  # disabled
pt_3 = ConstructPoint(XCoordinate=number_slider_12, YCoordinate=number_slider_13, ZCoordinate=number_slider_12)  # disabled

# ----
# Station anchor
pt_4 = Point(<point referenced from the Rhino model>)  # disabled

# ----
# Station anchor
pt_5 = Point(pt_4)  # disabled

# ----
# OLD
# weaving points
number_slider_14 = Slider(100, range=0..100)  # disabled
divide = DivideCurve(Count=number_slider_14, Kinks=False)  # -> Points, Tangents, Parameters; disabled

needle_z_offset_2 = Slider(24.5, range=0..100)  # disabled
needle_y_offset_2 = Slider(41.5, range=0..100)  # disabled

needle_z_offset_3 = Slider(24.5, range=0..100)  # disabled
needle_y_offset_3 = Slider(41.5, range=0..100)  # disabled

# ----
# Wrapping texture anchors
brep_13 = Brep(brep_10)  # disabled

# ----
# Base Geometry Woven
brep_14 = Brep(brep_5)

# ----
# Base Geometry Wrapping
brep_15 = Brep(brep_11)

# ----
# Wrapping texture anchors
# (booleanUnion)
brep_16 = Brep(brep_10)  # disabled

# ----
# XY to weaving start
item = ListItem(List=flatten(divide.Points), Index=0, Wrap=True)  # disabled
speed_mm_s = Slider(100, range=0..500)  # disabled
pdecon = Deconstruct(Point=item)  # -> XComponent, YComponent, ZComponent; disabled
number_slider_15 = Slider(60, range=0..100)  # disabled
needle_y_offset_4 = Panel(needle_y_offset_2)  # disabled
addition = Addition(A=pdecon.YComponent, B=needle_y_offset_4)  # disabled
mm_min = Multiplication(A=speed_mm_s, B=number_slider_15)  # disabled
g1 = Text("G1 ")  # disabled
X = Text(" X")  # disabled
F = Text("F")  # disabled
Y = Text(" Y")  # disabled
concat = Concatenate(FragmentH=g1, FragmentG=F, FragmentL=mm_min, FragmentA=X, FragmentB=pdecon.XComponent, FragmentC=Y, FragmentD=addition)  # disabled
xy_to_weaving_start = Panel(concat)  # disabled

# ----
# Weaving path
speed_mm_s_2 = Slider(15, range=0..100)  # disabled
needle_y_offset_5 = Panel(needle_y_offset_2)  # disabled
needle_z_offset_4 = Panel(needle_z_offset_2)  # disabled
pdecon_2 = Deconstruct(Point=divide.Points)  # -> XComponent, YComponent, ZComponent; disabled
number_slider_16 = Slider(60, range=0..100)  # disabled
addition_2 = Addition(A=pdecon_2.YComponent, B=needle_y_offset_5)  # disabled
addition_3 = Addition(A=pdecon_2.ZComponent, B=needle_z_offset_4)  # disabled
mm_min_2 = Multiplication(A=speed_mm_s_2, B=number_slider_16)  # disabled
g1_2 = Text("G1 ")  # disabled
F_2 = Text("F")  # disabled
X_2 = Text(" X")  # disabled
Y_2 = Text(" Y")  # disabled
Z_6 = Text(" Z")  # disabled
concat_2 = Concatenate(
    FragmentH=g1_2,
    FragmentG=F_2,
    FragmentL=mm_min_2,
    FragmentA=X_2,
    FragmentB=pdecon_2.XComponent,
    FragmentC=Y_2,
    FragmentD=addition_2,
    FragmentE=Z_6,
    FragmentF=addition_3)  # disabled
weaving_sequence = Panel(concat_2)  # disabled

needle_z_offset_5 = Slider(24.5, range=0..100)  # disabled
needle_y_offset_6 = Slider(41.5, range=0..100)  # disabled

# ----
# Base geometry
brep_17 = Brep(brep_12)  # disabled

# ----
# Station anchor
pt_6 = Point(<point referenced from the Rhino model>)  # disabled

# ----
# Station anchor
pt_7 = Point(pt_6)  # disabled

# ----
# pickup
pick_up_clearance_lifts = Panel("""; Start of pick up gcode v2
G1 F16000 X25 Y74 ; to pickup start XY
G1 F3000 Z37 ; to pickup start Z
G1 F8000 X25 Y4 Z37  ; move to needle
G1 F8000 X6 Y4 Z37  ; lock in to needle
G1 F8000 X6 Y74 Z37  ; pull away
; end of pick up gcode v2""")  # disabled

# ----
# park
park_wipe = Panel("""; Start of park + wipe gcode
G1 F16000 X6 Y74  ; XY to park start
G1 F1000 Z37 Z to park start
G1 F8000 X6 Y4 Z37  ; move to station
G1 F8000 X25 Y4 Z37  ; decouple needle
G1 F8000 X25 Y74 Z37  ; pull away

; nozzle wipe G92 E0 ; zero extruder G1 E-0.5 F300 ; retract filament
G1 F1000 Z100 ; lift Z
G1 X55 Y262.5 F15000 ; nozzle wipe position start
G1 Z0.4; nozzle down (matching default z height when original wipe happens)
G1 X20 Y262.5 F15000 ; first wipe
G1 X20 Y262 F15000 ; Y down G1 X65 Y262 F15000 ; wipe
G1 X65 Y261.5 F15000 ; Y down G1 X20 Y261.5 F15000 ; wipe
G1 X20 Y261 F15000 ; Y down G1 X65 Y261 F15000 ; wipe
G1 X65 Y260.5 F15000 ; Y down G1 X20 Y260.5 F15000 ; wipe
G1 X20 Y260 F15000 ; Y down G1 X65 Y260 F15000 ; wipe
; X-cross wipe Start G1 X20 Y262.5 F15000 ; starting position G1 X20 Y260 F15000 ; down \ wipe G1 X65 Y262.5 F15000 ; / wipe G1 X65 Y260 F15000 ; down G1 X20 Y262.5 F15000 ; \ wipe G1 X20 Y260 F15000 ; down G1 X65 Y262.5 F15000 ; / wipe G1 X65 Y260 F15000 ; down 
G1 F1000 Z100 ; Lift Z
; end of park + wipe code""")  # disabled

# ----
# park
park_wipe_avoid_slow = Panel("""; Start of park + wipe gcode
G1 F1000 X6  ; X to park start
G1 F1000 Y74  ; y to park start
G1 F1000 Z37 ; Z to park start
G1 F1000 X6 Y4 Z37  ; move to station
G1 F1000 X25 Y4 Z37  ; decouple needle
G1 F1000 X25 Y74 Z37  ; pull away

; nozzle wipe G92 E0 ; zero extruder G1 E-0.5 F300 ; retract filament
G1 F1000 Z100 ; lift Z
G1 X55 Y262.5 F15000 ; nozzle wipe position start
G1 Z0.4; nozzle down (matching default z height when original wipe happens)
G1 X20 Y262.5 F15000 ; first wipe
G1 X20 Y262 F15000 ; Y down G1 X65 Y262 F15000 ; wipe
G1 X65 Y261.5 F15000 ; Y down G1 X20 Y261.5 F15000 ; wipe
G1 X20 Y261 F15000 ; Y down G1 X65 Y261 F15000 ; wipe
G1 X65 Y260.5 F15000 ; Y down G1 X20 Y260.5 F15000 ; wipe
G1 X20 Y260 F15000 ; Y down G1 X65 Y260 F15000 ; wipe
; end of park + wipe code""")  # disabled

# ----
# Pick-up
pick_up_blue_anchor_wrap_more_back_movem = Panel("""; Start of pick up gcode blue
G91 ; relative positioning
G1 F500 Z25 ; Z offset
G90; absolute positioning
G1 F6000 X61.5 Y26 ; to pickup start XY
G1 F500 Z37 ; to pickup start Z
G1 F4000 X61.5 Y6 Z37  ; move to needle
G1 F4000 X42.5 Y6 Z37  ; lock in to needle
G1 F4000 X42.5 Y56 Z37  ; pull away
; end of pick up gcode v2""")  # "Pick Up Blue, anchor wrap (more back movement"; disabled

# ----
# park
park_blue_anchor_wrap = Panel("""; Start of park gcode blue
G91 ; relative positioning
G1 F500 Z5 ; Z offset
G90; absolute positioning
G1 F4000 X60  ; approach X
G1 F4000 Y26  ; approach Y
G1 F500 Z37 ; approach Z
G1 F4000 X42.5  ; slide X to wrap
G1 F4000 X42.5 Y6 Z37  ; move to station
G1 F4000 X61.5 Y6 Z37  ; decouple needle
G1 F4000 X61.5 Y26 Z37  ; pull away
; end of park gcode v2""")  # disabled

# ----
# pickup
# Pick Up + clearance lifts: ; Start of pick up gcode v2
# G1 F16000 X25 Y74 ; to pickup start XY
# G1 F3000 Z37 ; to pickup start Z
# G1 F8000 X25 Y4 Z37  ; move to needle
# G1 F8000 X6 Y4 Z37  ; lock in to needle
# G1 F8000 X6 Y74 Z37  ; pull away
# ; end of pick up gcode v2
pick_up_clearance_lifts_slow = Panel("""; Start of pick up gcode v2
G91 ;   Relative positioning
G1 Z1 ;   Lift Z 1mm
G90 ; Absolute positioning
M83 ; Relative extrusion
G1 F1000 X25 Y74 ; to pickup start XY
G1 F1000 Z37 ; to pickup start Z
G1 F1000 X25 Y4 Z37  ; move to needle
G1 F1000 X6 Y4 Z37  ; lock in to needle
G1 F1000 X6 Y74 Z37  ; pull away
; end of pick up gcode v2""")  # disabled

# ----
# Slice Object
# (make sure the plaement in the slicer is the same
#  as that in rhino by copying the rhino coordinates of the midpoint)
# Copy coordinates
# Insert modified geometry
# Insert GCode
# (insert the custom Gcode in the slicer at the layers
# where the channels have been printed to 3/4 their height, insert for both top and bottom channels, first GCode at the bottom channel, second GCode at the top channel)
brep_18 = Brep([<brep referenced from the Rhino model> x2])  # disabled
import_rhino_geometry_as_rg_combined_box = Python3Script(breps=brep_18)  # -> out, a_out; "import Rhino.Geometry as rg combined_box = rg.BoundingBox.Empty for brep in breps: box = brep.GetBoundingBox(True) combined_box = rg.BoundingBox.Union(combined_box, box) a_out = combined_box.Center"; inputs breps: list of Brep; disabled
# ---------- import_rhino_geometry_as_rg_combined_box: Python ----------
import Rhino.Geometry as rg

combined_box = rg.BoundingBox.Empty

for brep in breps:
    box = brep.GetBoundingBox(True)
    combined_box = rg.BoundingBox.Union(combined_box, box)

a_out = combined_box.Center
# ---------- end import_rhino_geometry_as_rg_combined_box ----------
pt_8 = Point(import_rhino_geometry_as_rg_combined_box.a_out)  # disabled
pdecon_3 = Deconstruct(Point=pt_8)  # -> XComponent, YComponent, ZComponent; disabled
panel = Panel(pdecon_3.YComponent)  # disabled
panel_2 = Panel(pdecon_3.XComponent)  # disabled
panel_3 = Panel(pdecon_3.ZComponent)  # disabled

# ----
# Station anchor
# circle - loop 1st try
pt_9 = Point(<point referenced from the Rhino model>)  # disabled
number_slider_17 = Slider(2, range=0..10)  # disabled
panel_4 = Panel("""G1 Y250
G4 S120""")  # disabled

# ----
# Create pillar anchors
merge = Merge(Data1=srf_6, Data2=srf_5)  # disabled
srf_7 = Surface(merge)  # disabled
edges = BrepEdges(Brep=srf_7)  # -> Naked, Interior, NonManifold; disabled
number_slider_18 = Slider(0.5, range=0..1)  # disabled
layer_height = Panel(number_slider_18)  # disabled

panel_5 = Panel("0.5")  # disabled
eval = EvaluateCurve(Curve=reparameterize(edges.Naked), Parameter=panel_5)  # -> Point, Tangent, Angle; disabled
pdecon_4 = Deconstruct(Point=eval.Point)  # -> XComponent, YComponent, ZComponent; disabled
sort = SortList(Keys=pdecon_4.ZComponent, ValuesA=edges.Naked)  # -> Keys, ValuesA; disabled

panel_6 = Panel("0")  # disabled
item_2 = ListItem(List=sort.ValuesA, Index=panel_6, Wrap=True)  # disabled

lastdex = LastIndex(List=sort.ValuesA)  # disabled
item_3 = ListItem(List=sort.ValuesA, Index=lastdex, Wrap=True)  # disabled

len = Length(Curve=item_2)  # disabled
# Fluffy Texture
division_6 = Division(A=len, B=warp_distance_pillars)  # disabled
int = Integer(division_6)  # disabled
divide_2 = DivideCurve(Curve=item_2, Count=int, Kinks=False)  # -> Points, Tangents, Parameters; disabled

flip = FlipCurve(Curve=item_3, Guide=item_2)  # -> Curve, Flag; disabled
divide_3 = DivideCurve(Curve=flip.Curve, Count=int, Kinks=False)  # -> Points, Tangents, Parameters; disabled

pdecon_5 = Deconstruct(Point=flatten(divide_2.Points))  # -> XComponent, YComponent, ZComponent; disabled
hilonums = HighestLowestNumbers(Numbers=pdecon_5.ZComponent)  # -> Highest, Lowest; disabled
pdecon_6 = Deconstruct(Point=flatten(divide_3.Points))  # -> XComponent, YComponent, ZComponent; disabled
pt_10 = ConstructPoint(XCoordinate=0, YCoordinate=0, ZCoordinate=hilonums.Lowest)  # disabled
hilonums_2 = HighestLowestNumbers(Numbers=pdecon_6.ZComponent)  # -> flatten(Highest), Lowest; disabled
pl_6 = ConstructPlane(Origin=pt_10, XAxis=Vector(1, 0, 0), YAxis=Vector(0, 1, 0))  # disabled
subtraction = Subtraction(A=hilonums_2.Highest, B=hilonums.Lowest)  # disabled
number_slider_19 = Slider(1, range=0..1)  # disabled
number_slider_20 = Slider(0, range=0..100)  # disabled
division_7 = Division(A=subtraction, B=layer_height)  # disabled
addition_4 = Addition(A=division_7)  # disabled
series_6 = Series(Start=number_slider_20, Step=layer_height, Count=addition_4)  # -> flatten(Series); disabled
Z_7 = UnitZ(Factor=series_6)  # disabled
move_6 = Move(Geometry=pl_6, Motion=Z_7)  # -> Geometry, Transform; disabled

ln = Line(StartPoint=divide_2.Points, EndPoint=divide_3.Points)  # disabled
pull = PullCurve(Curve=ln, Surface=graft(srf_7))  # disabled
pcx = CurvePlane(Curve=pull, Plane=move_6.Geometry)  # -> Points, ParamsC, ParamsP; disabled
trim = TrimTree(Tree=pcx.Points, Depth=1)  # disabled
simplify_2 = SimplifyTree(Tree=trim, Front=False)  # disabled

# ----
# surface skeleton curves
crv_2 = Curve(flatten(pull))  # disabled

# ----
# Intersection
pcx_2 = CurvePlane(Curve=graft(crv_2), Plane=move_3.Geometry)  # -> Points, ParamsC, ParamsP; disabled
trim_2 = TrimTree(Tree=pcx_2.Points, Depth=1)  # disabled
simplify_3 = SimplifyTree(Tree=trim_2, Front=False)  # disabled
flip_2 = FlipMatrix(Data=simplify_3)  # disabled

# ----
# Points by layer
pt_11 = Point(flip_2)  # disabled

# ----
# Sort points
number_slider_21 = Slider(10, range=0..10)  # disabled
pdecon_7 = Deconstruct(Point=pt_11)  # -> XComponent, YComponent, ZComponent; disabled
sort_2 = SortList(Keys=pdecon_7.XComponent, ValuesA=pt_11)  # -> Keys, ValuesA; disabled

pdecon_8 = Deconstruct(Point=simplify_2)  # -> XComponent, YComponent, ZComponent; disabled
division_8 = Division(A=pdecon_8.ZComponent, B=weft_distance)  # disabled
number_slider_22 = Slider(2, range=0..10)  # disabled
multiplication_6 = Multiplication(A=division_8, B=number_slider_22)  # disabled
number_slider_23 = Slider(1, range=0..1)  # disabled
number_slider_24 = Slider(-1, range=-1..0)  # disabled
pi = Pi(Factor=multiplication_6)  # disabled
dom = ConstructDomain(DomainStart=min_radius, DomainEnd=max_radius)  # disabled
dom_2 = ConstructDomain(DomainStart=number_slider_23, DomainEnd=number_slider_24)  # disabled
sin = Sine(Value=pi)  # disabled
remap = RemapNumbers(Value=sin, Source=dom_2, Target=dom)  # -> Mapped, Clipped; disabled

cir = Circle(Plane=simplify_2, Radius=remap.Mapped)  # disabled

# ----
# Bake this loft & union
loft = Loft(Curves=cir, Options={Adjust=False, Closed=False, LoftEnds=0, LoftSimp=0, LoftType=0, Rebuild=10, Refit=0.01})  # disabled
cap = CapHoles(Brep=loft)  # disabled

# ----
# Carpet texture anchors
# (booleanUnion)
group = Group(Geometry=cap)  # disabled

# ----
# Anchors
brep_19 = Brep(cap)  # disabled

# ----
# Create pillar anchors
edges_2 = BrepEdges(Brep=srf_4)  # -> Naked, Interior, NonManifold; disabled
number_slider_25 = Slider(0.5, range=0..1)  # disabled
layer_height_2 = Panel(number_slider_25)  # disabled

panel_7 = Panel("0.5")  # disabled
eval_2 = EvaluateCurve(Curve=reparameterize(edges_2.Naked), Parameter=panel_7)  # -> Point, Tangent, Angle; disabled
pdecon_9 = Deconstruct(Point=eval_2.Point)  # -> XComponent, YComponent, ZComponent; disabled
sort_3 = SortList(Keys=pdecon_9.ZComponent, ValuesA=edges_2.Naked)  # -> Keys, ValuesA; disabled

panel_8 = Panel("0")  # disabled
item_4 = ListItem(List=sort_3.ValuesA, Index=panel_8, Wrap=True)  # disabled

lastdex_2 = LastIndex(List=sort_3.ValuesA)  # disabled
item_5 = ListItem(List=sort_3.ValuesA, Index=lastdex_2, Wrap=True)  # disabled

len_2 = Length(Curve=item_4)  # disabled
division_9 = Division(A=len_2, B=warp_distance_pillars)  # disabled
int_2 = Integer(division_9)  # disabled
# Woven Texture
divide_4 = DivideCurve(Curve=item_4, Count=int_2, Kinks=False)  # -> Points, Tangents, Parameters; disabled

flip_3 = FlipCurve(Curve=item_5, Guide=item_4)  # -> Curve, Flag; disabled
divide_5 = DivideCurve(Curve=flip_3.Curve, Count=int_2, Kinks=False)  # -> Points, Tangents, Parameters; disabled

pdecon_10 = Deconstruct(Point=flatten(divide_4.Points))  # -> XComponent, YComponent, ZComponent; disabled
hilonums_3 = HighestLowestNumbers(Numbers=pdecon_10.ZComponent)  # -> Highest, Lowest; disabled
pdecon_11 = Deconstruct(Point=flatten(divide_5.Points))  # -> XComponent, YComponent, ZComponent; disabled
pt_12 = ConstructPoint(XCoordinate=0, YCoordinate=0, ZCoordinate=hilonums_3.Lowest)  # disabled
hilonums_4 = HighestLowestNumbers(Numbers=pdecon_11.ZComponent)  # -> flatten(Highest), Lowest; disabled
pl_7 = ConstructPlane(Origin=pt_12, XAxis=Vector(1, 0, 0), YAxis=Vector(0, 1, 0))  # disabled
subtraction_2 = Subtraction(A=hilonums_4.Highest, B=hilonums_3.Lowest)  # disabled
number_slider_26 = Slider(1, range=0..1)  # disabled
number_slider_27 = Slider(0, range=0..100)  # disabled
division_10 = Division(A=subtraction_2, B=layer_height_2)  # disabled
addition_5 = Addition(A=division_10)  # disabled
series_7 = Series(Start=number_slider_27, Step=layer_height_2, Count=addition_5)  # -> flatten(Series); disabled
Z_8 = UnitZ(Factor=series_7)  # disabled
move_7 = Move(Geometry=pl_7, Motion=Z_8)  # -> Geometry, Transform; disabled

ln_2 = Line(StartPoint=divide_4.Points, EndPoint=divide_5.Points)  # disabled
pull_2 = PullCurve(Curve=ln_2, Surface=srf_4, UseTasks=True)  # disabled
pcx_3 = CurvePlane(Curve=pull_2, Plane=move_7.Geometry)  # -> Points, ParamsC, ParamsP; disabled
trim_3 = TrimTree(Tree=pcx_3.Points, Depth=1)  # disabled
simplify_4 = SimplifyTree(Tree=trim_3, Front=False)  # disabled

# ----
# surface skeleton curves
crv_3 = Curve(pull_2)  # disabled

# ----
# surface skeleton curves
crv_4 = Curve(pull_2)  # disabled

# ----
# Intersection
pcx_4 = CurvePlane(Curve=graft(crv_3), Plane=move.Geometry)  # -> Points, ParamsC, ParamsP; disabled
trim_4 = TrimTree(Tree=pcx_4.Points, Depth=1)  # disabled
simplify_5 = SimplifyTree(Tree=trim_4, Front=False)  # disabled
flip_4 = FlipMatrix(Data=simplify_5)  # disabled

# ----
# Intersection
pcx_5 = CurvePlane(Curve=graft(crv_4), Plane=move_2.Geometry)  # -> Points, ParamsC, ParamsP; disabled
trim_5 = TrimTree(Tree=pcx_5.Points, Depth=1)  # disabled
simplify_6 = SimplifyTree(Tree=trim_5, Front=False)  # disabled
flip_5 = FlipMatrix(Data=simplify_6)  # disabled

# ----
# Points by layer
pt_13 = Point(flip_4)  # disabled

# ----
# Points by layer
pt_14 = Point(flip_5)  # disabled

# ----
# Anchor order
dist = Distance(PointA=pt_14, PointB=pt)  # disabled
sort_4 = SortList(Keys=dist, ValuesA=pt_14)  # -> Keys, ValuesA; disabled

pt_15 = Point(sort_4.ValuesA)  # disabled
arc_radius = Slider(4.5, range=0..10)  # disabled
shift = ShiftList(List=pt_15, Shift=1, Wrap=True)  # disabled
cir_2 = Circle(Plane=pt_15, Radius=arc_radius)  # disabled
crv_cp = CurveClosestPoint(Point=shift, Curve=cir_2)  # -> Point, Parameter, Distance; disabled
number_slider_28 = Slider(0.5, range=0..1)  # disabled
toggle = BooleanToggle(True)  # disabled
number_slider_29 = Slider(0, range=0..100)  # disabled
seam = Seam(Curve=cir_2, Seam=crv_cp.Parameter)  # disabled
py3 = Python3Script(curves=seam, flip_first=toggle)  # -> out, out_curves; inputs curves: tree; disabled
# ---------- py3: Python ----------
import Rhino.Geometry as rg
from Grasshopper import DataTree
from Grasshopper.Kernel.Data import GH_Path
 
out_curves = DataTree[object]()
 
for i in range(curves.BranchCount):
    branch = curves.Branch(i)
    path = curves.Path(i)
 
    for j, crv in enumerate(branch):
        dup = crv.DuplicateCurve()
 
        if flip_first:
            should_flip = (j % 2 == 0)
        else:
            should_flip = (j % 2 == 1)
 
        if should_flip:
            dup.Reverse()
 
        out_curves.Add(dup, path)
# ---------- end py3 ----------
merge_2 = Merge(Data1=number_slider_29, Data2=number_slider_28)  # disabled
number_slider_30 = Slider(1, range=0..1)  # disabled
shatter = Shatter(Curve=reparameterize(py3.out_curves), Parameters=merge_2)  # disabled
number_slider_31 = Slider(0, range=0..1)  # disabled
item_6 = ListItem(List=shatter, Index=0, Wrap=True)  # disabled
merge_3 = Merge(Data1=number_slider_31, Data2=number_slider_30)  # disabled
number_slider_32 = Slider(10, range=0..100)  # disabled
eval_3 = EvaluateCurve(Curve=reparameterize(item_6), Parameter=merge_3)  # -> Point, Tangent, Angle; disabled
multiplication_7 = Multiplication(A=eval_3.Tangent, B=number_slider_32)  # disabled
dispatch = Dispatch(List=multiplication_7, DispatchPattern=[True, False])  # -> ListA, ListB; disabled
neg = Negative(Value=dispatch.ListA)  # disabled
merge_4 = Merge(Data1=neg, Data2=dispatch.ListB)  # disabled
move_8 = Move(Geometry=eval_3.Point, Motion=merge_4)  # -> Geometry, Transform; disabled

# ----
# surface skeleton curves
crv_5 = Curve(pull_2)  # disabled

# ----
# Intersection
pcx_6 = CurvePlane(Curve=crv_5, Plane=move_4.Geometry)  # -> Points, ParamsC, ParamsP; disabled
trim_6 = TrimTree(Tree=pcx_6.Points, Depth=1)  # disabled
simplify_7 = SimplifyTree(Tree=trim_6, Front=False)  # disabled
flip_6 = FlipMatrix(Data=simplify_7)  # disabled

# ----
# Points by layer
pt_16 = Point(flip_6)  # disabled

# ----
# Anchor order
dist_2 = Distance(PointA=pt_16, PointB=pt_2)  # disabled
sort_5 = SortList(Keys=dist_2, ValuesA=pt_16)  # -> Keys, ValuesA; disabled

# ----
# external point to travel
pt_17 = Point(move_8.Geometry)  # disabled

# ----
# arc curves
crv_6 = Curve(item_6)  # disabled

# ----
# reverse every 2nd list
py3_2 = Python3Script(x=sort_5.ValuesA)  # -> out, a; inputs x: tree; disabled
# ---------- py3_2: Python ----------
from Grasshopper import DataTree
from Grasshopper.Kernel.Data import GH_Path

output = DataTree[object]()

for i, branch in enumerate(x.Branches):
    items = list(branch)
    if i % 2 == 0:
        items = items[::-1]  # reverse the list
    output.AddRange(items, x.Path(i))

a = output
# ---------- end py3_2 ----------

# ----
# compute farside vectors
shift_2 = ShiftList(List=py3_2.a, Shift=1, Wrap=True)  # disabled
vec2pt = Vector2Pt(PointA=py3_2.a, PointB=shift_2, Unitize=False)  # -> Vector, Length; disabled
unit = UnitVector(Vector=vec2pt.Vector)  # disabled
lastdex_3 = LastIndex(List=unit)  # disabled
split = SplitList(List=unit, Index=lastdex_3)  # -> ListA, ListB; disabled
neg_2 = Negative(Value=split.ListB)  # disabled
merge_5 = Merge(Data1=split.ListA, Data2=neg_2)  # disabled

# ----
# compute nearside vectors
shift_3 = ShiftList(List=py3_2.a, Shift=1, Wrap=True)  # disabled
vec2pt_2 = Vector2Pt(PointA=shift_3, PointB=py3_2.a, Unitize=False)  # -> Vector, Length; disabled
unit_2 = UnitVector(Vector=vec2pt_2.Vector)  # disabled
lastdex_4 = LastIndex(List=unit_2)  # disabled
split_2 = SplitList(List=unit_2, Index=lastdex_4)  # -> ListA, ListB; disabled
neg_3 = Negative(Value=split_2.ListB)  # disabled
merge_6 = Merge(Data1=split_2.ListA, Data2=neg_3)  # disabled

# ----
# Compute directions
panel_9 = Panel("90")  # disabled
rad = Radians(Degrees=panel_9)  # disabled
rotate = Rotate(Geometry=merge_5, Angle=rad, Plane=PlaneXY(0, 0, 0))  # -> Geometry, Transform; disabled
panel_10 = Panel("""0
1""")  # disabled
dispatch_2 = Dispatch(List=rotate.Geometry, DispatchPattern=panel_10)  # -> ListA, ListB; disabled
neg_4 = Negative(Value=dispatch_2.ListA)  # disabled
weave = Weave(Pattern=panel_10, Stream0=dispatch_2.ListB, Stream1=neg_4, NullGaps=False)  # disabled

# ----
# Lift Z to pillar top height + needle offset
speed_mm_s_3 = Slider(15, range=0..200)  # disabled
pillars_max_height = Panel(hilonums_4.Highest)  # disabled
needle_z_offset_6 = Panel(needle_z_offset_2)  # disabled
clearance_mm = Slider(2, range=0..10)  # disabled
number_slider_33 = Slider(60, range=0..100)  # disabled
addition_6 = Addition(A=pillars_max_height, B=needle_z_offset_6)  # disabled
mm_min_3 = Multiplication(A=speed_mm_s_3, B=number_slider_33)  # disabled
addition_7 = Addition(A=addition_6, B=clearance_mm)  # disabled
g1_3 = Text("G1 ")  # disabled
F_3 = Text("F")  # disabled
Z_9 = Text(" Z")  # disabled
concat_3 = Concatenate(FragmentH=g1_3, FragmentG=F_3, FragmentL=mm_min_3, FragmentE=Z_9, FragmentF=addition_7)  # disabled
z_to_pillar_top_needle_offset = Panel(concat_3)  # disabled

# ----
# Lift Z to pillar top height
speed_mm_s_4 = Slider(15, range=0..200)  # disabled
pillars_max_height_2 = Panel(hilonums_4.Highest)  # disabled
clearance_mm_2 = Slider(2, range=0..10)  # disabled
number_slider_34 = Slider(60, range=0..100)  # disabled
mm_min_4 = Multiplication(A=speed_mm_s_4, B=number_slider_34)  # disabled
addition_8 = Addition(A=pillars_max_height_2, B=clearance_mm_2)  # disabled
Z_10 = Text(" Z")  # disabled
g1_4 = Text("G1 ")  # disabled
F_4 = Text("F")  # disabled
concat_4 = Concatenate(FragmentH=g1_4, FragmentG=F_4, FragmentL=mm_min_4, FragmentE=Z_10, FragmentF=addition_8)  # disabled
z_to_pillar_top = Panel(concat_4)  # disabled

# ----
# Lift Z to pillar top height + needle offset
speed_mm_s_5 = Slider(15, range=0..200)  # disabled
pillars_max_height_3 = Panel(hilonums_4.Highest)  # disabled
needle_z_offset_7 = Panel(needle_z_offset_3)  # disabled
clearance_mm_3 = Slider(2, range=0..10)  # disabled
number_slider_35 = Slider(60, range=0..100)  # disabled
addition_9 = Addition(A=pillars_max_height_3, B=needle_z_offset_7)  # disabled
mm_min_5 = Multiplication(A=speed_mm_s_5, B=number_slider_35)  # disabled
addition_10 = Addition(A=addition_9, B=clearance_mm_3)  # disabled
g1_5 = Text("G1 ")  # disabled
F_5 = Text("F")  # disabled
Z_11 = Text(" Z")  # disabled
concat_5 = Concatenate(FragmentH=g1_5, FragmentG=F_5, FragmentL=mm_min_5, FragmentE=Z_11, FragmentF=addition_10)  # disabled
z_to_pillar_top_needle_offset_2 = Panel(concat_5)  # disabled

# ----
# Lift Z to pillar top height
speed_mm_s_6 = Slider(15, range=0..200)  # disabled
pillars_max_height_4 = Panel(hilonums_4.Highest)  # disabled
clearance_mm_4 = Slider(2, range=0..10)  # disabled
number_slider_36 = Slider(60, range=0..100)  # disabled
mm_min_6 = Multiplication(A=speed_mm_s_6, B=number_slider_36)  # disabled
addition_11 = Addition(A=pillars_max_height_4, B=clearance_mm_4)  # disabled
Z_12 = Text(" Z")  # disabled
g1_6 = Text("G1 ")  # disabled
F_6 = Text("F")  # disabled
concat_6 = Concatenate(FragmentH=g1_6, FragmentG=F_6, FragmentL=mm_min_6, FragmentE=Z_12, FragmentF=addition_11)  # disabled
z_to_pillar_top_2 = Panel(concat_6)  # disabled

# ----
# Pick Up v4: ; Start of pick up gcode v2
# G1 F16000 X25 Y74 Z37  ; approach
# G1 F8000 X25 Y4 Z37  ; move to needle
# G1 F8000 X6 Y4 Z37  ; lock in to needle
# G1 F8000 X6 Y74 Z37  ; pull away
# ; end of pick up gcode v2
panel_11 = Panel("M82   ; Absolute extrusion")  # disabled
# park
# Park + wipe: ; Start of park + wipe gcode
# G1 F16000 X6 Y74  ; XY to park start
# G1 F1000 Z37 Z to park start
# G1 F8000 X6 Y4 Z37  ; move to station
# G1 F8000 X25 Y4 Z37  ; decouple needle
# G1 F8000 X25 Y74 Z37  ; pull away
# 
# ; nozzle wipe G92 E0 ; zero extruder G1 E-0.5 F300 ; retract filament
# G1 F1000 Z100 ; lift Z
# G1 X55 Y262.5 F15000 ; nozzle wipe position start
# G1 Z0.4; nozzle down (matching default z height when original wipe happens)
# G1 X20 Y262.5 F15000 ; first wipe
# G1 X20 Y262 F15000 ; Y down G1 X65 Y262 F15000 ; wipe
# G1 X65 Y261.5 F15000 ; Y down G1 X20 Y261.5 F15000 ; wipe
# G1 X20 Y261 F15000 ; Y down G1 X65 Y261 F15000 ; wipe
# G1 X65 Y260.5 F15000 ; Y down G1 X20 Y260.5 F15000 ; wipe
# G1 X20 Y260 F15000 ; Y down G1 X65 Y260 F15000 ; wipe
# ; X-cross wipe Start G1 X20 Y262.5 F15000 ; starting position G1 X20 Y260 F15000 ; down \ wipe G1 X65 Y262.5 F15000 ; / wipe G1 X65 Y260 F15000 ; down G1 X20 Y262.5 F15000 ; \ wipe G1 X20 Y260 F15000 ; down G1 X65 Y262.5 F15000 ; / wipe G1 X65 Y260 F15000 ; down
# G1 F1000 Z100 ; Lift Z
# ; end of park + wipe code
panel_12 = Panel("M83   ; Relative extrusion")  # disabled
# pickup
pick_up_clearance_lifts_slow_2 = Panel("""; Start of pick up gcode v2
G1 F1000 X25 Y74 ; to pickup start XY
G1 F1000 Z37 ; to pickup start Z
G1 F1000 X25 Y4 Z37  ; move to needle
G1 F1000 X6 Y4 Z37  ; lock in to needle
G1 F1000 X6 Y74 Z37  ; pull away
; end of pick up gcode v2""")  # disabled
merge_7 = Merge(
    Data1=flatten(panel_11),
    Data2=flatten(z_to_pillar_top),
    Data3=flatten(pick_up_clearance_lifts_slow_2),
    Data4=flatten(z_to_pillar_top_needle_offset),
    Data5=flatten(xy_to_weaving_start),
    Data6=flatten(weaving_sequence),
    Data7=flatten(z_to_pillar_top_needle_offset),
    Data9=flatten(panel_12))  # disabled
carpet_texture_full_gcode = Panel(merge_7)  # disabled

# ----
# Lift Z to pillar top height + needle offset
speed_mm_s_7 = Slider(20, range=0..200)  # disabled
pillars_max_height_5 = Panel(hilonums_4.Highest)  # disabled
needle_z_offset_8 = Panel(needle_z_offset_5)  # disabled
clearance_mm_5 = Slider(2, range=0..10)  # disabled
number_slider_37 = Slider(60, range=0..100)  # disabled
addition_12 = Addition(A=pillars_max_height_5, B=needle_z_offset_8)  # disabled
mm_min_7 = Multiplication(A=speed_mm_s_7, B=number_slider_37)  # disabled
addition_13 = Addition(A=addition_12, B=clearance_mm_5)  # disabled
Z_13 = Text(" Z")  # disabled
g1_7 = Text("G1 ")  # disabled
F_7 = Text("F")  # disabled
concat_7 = Concatenate(FragmentH=g1_7, FragmentG=F_7, FragmentL=mm_min_7, FragmentE=Z_13, FragmentF=addition_13)  # disabled
z_to_pillar_top_needle_offset_3 = Panel(concat_7)  # disabled

# ----
# Lift Z to pillar top height
speed_mm_s_8 = Slider(20, range=0..200)  # disabled
pillars_max_height_6 = Panel(hilonums_4.Highest)  # disabled
clearance_mm_6 = Slider(2, range=0..10)  # disabled
number_slider_38 = Slider(60, range=0..100)  # disabled
mm_min_8 = Multiplication(A=speed_mm_s_8, B=number_slider_38)  # disabled
addition_14 = Addition(A=pillars_max_height_6, B=clearance_mm_6)  # disabled
Z_14 = Text(" Z")  # disabled
g1_8 = Text("G1 ")  # disabled
F_8 = Text("F")  # disabled
concat_8 = Concatenate(FragmentH=g1_8, FragmentG=F_8, FragmentL=mm_min_8, FragmentE=Z_14, FragmentF=addition_14)  # disabled
z_to_pillar_top_3 = Panel(concat_8)  # disabled

dist_3 = Distance(PointA=pt_13, PointB=pt_9)  # disabled
sort_6 = SortList(Keys=dist_3, ValuesA=pt_13)  # -> Keys, ValuesA; disabled

# ----
# reverse every 2nd list
py3_3 = Python3Script(x=sort_6.ValuesA)  # -> out, a; inputs x: tree; disabled
# ---------- py3_3: Python ----------
from Grasshopper import DataTree
from Grasshopper.Kernel.Data import GH_Path

output = DataTree[object]()

for i, branch in enumerate(x.Branches):
    items = list(branch)
    if i % 2 == 1:
        items = items[::-1]  # reverse the list
    output.AddRange(items, x.Path(i))

a = output
# ---------- end py3_3 ----------

# ----
# compute farside vectors
shift_4 = ShiftList(List=py3_3.a, Shift=1, Wrap=True)  # disabled
vec2pt_3 = Vector2Pt(PointA=py3_3.a, PointB=shift_4, Unitize=False)  # -> Vector, Length; disabled
unit_3 = UnitVector(Vector=vec2pt_3.Vector)  # disabled
lastdex_5 = LastIndex(List=unit_3)  # disabled
split_3 = SplitList(List=unit_3, Index=lastdex_5)  # -> ListA, ListB; disabled
neg_5 = Negative(Value=split_3.ListA)  # disabled
merge_8 = Merge(Data1=neg_5, Data2=split_3.ListB)  # disabled

# ----
# tan X Y of vectors
devec = DeconstructVector(Vector=merge_8)  # -> XComponent, YComponent, ZComponent; disabled
py3_4 = Python3Script(x=devec.XComponent, y=devec.YComponent)  # -> out, a; disabled
# ---------- py3_4: Python ----------
import math
a = math.atan2(y, x)
# ---------- end py3_4 ----------

# ----
# add pi to every 2nd branch
toggle_2 = BooleanToggle(False)  # disabled
py3_5 = Python3Script(x=py3_4.a, toggle=toggle_2)  # -> out, a; inputs x: tree, toggle: Boolean; disabled
# ---------- py3_5: Python ----------
import math
from Grasshopper import DataTree
from Grasshopper.Kernel.Data import GH_Path

output = DataTree[object]()

target = 1 if toggle else 0

for i, branch in enumerate(x.Branches):
    items = list(branch)
    if i % 2 == target:
        items = [v + math.pi for v in items if v is not None]
    output.AddRange(items, x.Path(i))

a = output
# ---------- end py3_5 ----------

# ----
# compute farside vectors
number_slider_39 = Slider(2, range=0..10)  # disabled
pi_2 = Pi(Factor=1)  # disabled
multiplication_8 = Multiplication(A=pi_2, B=number_slider_39)  # disabled
addition_15 = Addition(A=py3_5.a, B=pi_2)  # disabled
addition_16 = Addition(A=py3_4.a, B=multiplication_8)  # disabled
dom_3 = ConstructDomain(DomainStart=py3_5.a, DomainEnd=addition_15)  # disabled
dom_4 = ConstructDomain(DomainStart=py3_4.a, DomainEnd=addition_16)  # disabled

# ----
# create arcs
pillar_distance = Panel(warp_distance_pillars)  # disabled
panel_13 = Panel("2")  # disabled
division_11 = Division(A=pillar_distance, B=panel_13)  # disabled
arc = Arc(Plane=py3_3.a, Radius=division_11, Angle=dom_3)  # -> Arc, Length; disabled
arc_2 = Arc(Plane=py3_3.a, Radius=division_11, Angle=dom_4)  # -> Arc, Length; disabled
py3_6 = Python3Script(x=arc_2.Arc)  # -> out, a; inputs x: tree; disabled
# ---------- py3_6: Python ----------
from Grasshopper import DataTree
from Grasshopper.Kernel.Data import GH_Path
import Rhino.Geometry as rg

output = DataTree[object]()

for i, branch in enumerate(x.Branches):
    items = []
    for crv in branch:
        # convert to NurbsCurve first
        nurbs = rg.NurbsCurve.CreateFromArc(crv)
        if i % 2 == 0:
            nurbs.Reverse()
        items.append(nurbs)
    output.AddRange(items, x.Path(i))

a = output
# ---------- end py3_6 ----------
py3_7 = Python3Script(x=arc.Arc)  # -> out, a; inputs x: tree; disabled; same code as py3_6

# ----
# create loop travel points
number_slider_40 = Slider(1, range=0..1)  # disabled
yarn_pull_loop_length_2 = Slider(40, range=0..100)  # disabled
eval_4 = EvaluateCurve(Curve=reparameterize(py3_7.a), Parameter=number_slider_40)  # -> Point, Tangent, Angle; disabled
multiplication_9 = Multiplication(A=eval_4.Tangent, B=yarn_pull_loop_length_2)  # disabled
move_9 = Move(Geometry=eval_4.Point, Motion=multiplication_9)  # -> Geometry, Transform; disabled

# ----
# full turn
crv_7 = Curve(py3_6.a)  # disabled

# ----
# half turn
crv_8 = Curve(py3_7.a)  # disabled

# ----
# half circle points
number_slider_41 = Slider(25, range=0..100)  # disabled
divide_6 = DivideCurve(Curve=crv_8, Count=number_slider_41, Kinks=False)  # -> Points, Tangents, Parameters; disabled

# ----
# Create weaving path
panel_14 = Panel(simplify_3)  # disabled
pt_18 = Point(sort_2.ValuesA)  # disabled
number_slider_42 = Slider(1, range=0..1)  # disabled

toggle_3 = BooleanToggle(False)  # disabled
shift_5 = ShiftList(List=pt_18, Shift=1, Wrap=toggle_3)  # disabled
vec2pt_4 = Vector2Pt(PointA=pt_18, PointB=shift_5, Unitize=True)  # -> Vector, Length; disabled
lastdex_6 = LastIndex(List=vec2pt_4.Vector)  # disabled
x_minus_one = XMinusOne(NumberX=lastdex_6)  # disabled
cull_i = CullIndex(List=vec2pt_4.Vector, Indices=lastdex_6, Wrap=True)  # disabled
x_minus_one_2 = XMinusOne(NumberX=x_minus_one)  # disabled
item_7 = ListItem(List=cull_i, Index=x_minus_one_2, Wrap=True)  # disabled
merge_9 = Merge(Data1=cull_i, Data2=item_7)  # disabled
move_10 = Move(Geometry=pt_18, Motion=merge_9)  # -> Geometry, Transform; disabled

number_slider_43 = Slider(4, range=0..10)  # disabled
cir_3 = Circle(Plane=pt_18, Radius=number_slider_43)  # disabled
number_slider_44 = Slider(0.75, range=0..1)  # disabled
number_slider_45 = Slider(0.25, range=0..1)  # disabled
crv_cp_2 = CurveClosestPoint(Point=move_10.Geometry, Curve=cir_3)  # -> Point, Parameter, Distance; disabled
merge_10 = Merge(Data1=number_slider_45, Data2=number_slider_44)  # disabled
seam_2 = Seam(Curve=cir_3, Seam=crv_cp_2.Parameter)  # disabled
shatter_2 = Shatter(Curve=reparameterize(seam_2), Parameters=merge_10)  # disabled
number_slider_46 = Slider(0, range=0..1)  # disabled
item_8 = ListItem(List=shatter_2, Index=number_slider_46, Wrap=True)  # disabled
trim_7 = TrimTree(Tree=item_8, Depth=1)  # disabled
simplify_8 = SimplifyTree(Tree=trim_7, Front=False)  # disabled
panel_15 = Panel("""0
1""")  # disabled
dispatch_3 = Dispatch(List=simplify_8, DispatchPattern=panel_15)  # -> ListA, ListB; disabled
flip_7 = FlipCurve(Curve=dispatch_3.ListA)  # -> Curve, Flag; disabled
weave_2 = Weave(Pattern=panel_15, Stream0=dispatch_3.ListB, Stream1=flip_7.Curve, NullGaps=False)  # disabled

crv_9 = Curve(weave_2)  # disabled
flip_8 = FlipCurve(Curve=crv_9)  # -> Curve, Flag; disabled
eval_5 = EvaluateCurve(Curve=reparameterize(flip_8.Curve), Parameter=number_slider_42)  # -> Point, Tangent, Angle; disabled

# ----
# weaving points
number_slider_47 = Slider(25, range=0..100)  # disabled
divide_7 = DivideCurve(Curve=flip_8.Curve, Count=number_slider_47, Kinks=False)  # -> Points, Tangents, Parameters; disabled

# ----
# Carpet GCode
trim_8 = TrimTree(Tree=divide_7.Points, Depth=1)  # disabled

lastdex_7 = LastIndex(List=flatten(trim_8))  # disabled
item_9 = ListItem(List=trim_8, Index=lastdex_7, Wrap=True)  # disabled

# ----
# last weaving point
pt_19 = Point(item_9)  # disabled

pdecon_12 = Deconstruct(Point=pt_19)  # -> XComponent, YComponent, ZComponent; disabled
pdecon_13 = Deconstruct(Point=pt_5)  # -> XComponent, YComponent, ZComponent; disabled
pt_20 = ConstructPoint(XCoordinate=pdecon_13.XComponent, YCoordinate=pdecon_13.YComponent, ZCoordinate=pdecon_12.ZComponent)  # disabled
ln_3 = Line(StartPoint=pt_20, EndPoint=pt_19)  # disabled

# ----
# last Blob point
number_slider_48 = Slider(0.864, range=0..1)  # disabled
eval_6 = EvaluateCurve(Curve=reparameterize(ln_3), Parameter=number_slider_48)  # -> Point, Tangent, Angle; disabled
Z_15 = UnitZ(Factor=number_slider)  # disabled
move_11 = Move(Geometry=eval_6.Point, Motion=Z_15)  # -> Geometry, Transform; disabled

# ----
# last channel (to boolean)
pipe = Pipe(Curve=ln_3, Radius=number_slider, Caps=0)  # disabled
cap_2 = CapHoles(Brep=pipe)  # disabled

# ----
# 1st weaving points
item_10 = ListItem(List=trim_8, Index=0, Wrap=True)  # disabled

# ----
# 1st weaving point
pt_21 = Point(item_10)  # disabled

pdecon_14 = Deconstruct(Point=pt_21)  # -> XComponent, YComponent, ZComponent; disabled
pdecon_15 = Deconstruct(Point=pt_4)  # -> XComponent, YComponent, ZComponent; disabled
pt_22 = ConstructPoint(XCoordinate=pdecon_15.XComponent, YCoordinate=pdecon_15.YComponent, ZCoordinate=pdecon_14.ZComponent)  # disabled
ln_4 = Line(StartPoint=pt_22, EndPoint=pt_21)  # disabled

# ----
# 1st channel (to boolean)
number_slider_49 = Slider(1.4, range=0..10)  # disabled
pipe_2 = Pipe(Curve=ln_4, Radius=number_slider, Caps=0)  # disabled
cap_3 = CapHoles(Brep=pipe_2)  # disabled

# ----
# 1st Blob point
number_slider_50 = Slider(0.878, range=0..1)  # disabled
eval_7 = EvaluateCurve(Curve=reparameterize(ln_4), Parameter=number_slider_50)  # -> Point, Tangent, Angle; disabled
Z_16 = UnitZ(Factor=number_slider)  # disabled
move_12 = Move(Geometry=eval_7.Point, Motion=Z_16)  # -> Geometry, Transform; disabled

# ----
# Create Channels
merge_11 = Merge(Data1=cap_3, Data2=cap_2)  # disabled

# ----
# Channels
# (booleanDiff)
group_2 = Group(Geometry=merge_11)  # disabled

# ----
# Modify Geometry
merge_12 = Merge(Data1=flatten(brep_17), Data2=flatten(brep_19))  # disabled
sunion = SolidUnion(Breps=merge_12)  # disabled
sdiff = SolidDifference(BrepsA=sunion, BrepsB=flatten(merge_11))  # disabled

# ----
# Clamping lines
vec = VectorXYZ(XComponent=0, YComponent=0, ZComponent=pdecon_14.ZComponent)  # -> Vector, Length; disabled
crv_10 = Curve(<curve referenced from the Rhino model>)  # disabled
move_13 = Move(Geometry=crv_10, Motion=vec.Vector)  # -> Geometry, Transform; disabled
end = EndPoints(Curve=move_13.Geometry)  # -> Start, End; disabled

# ----
# last Blob point
pt_23 = Point(move_11.Geometry)  # disabled

# ----
# 1st Blob point
pt_24 = Point(move_12.Geometry)  # disabled

# ----
# XY to line start
speed_mm_s_9 = Slider(25, range=0..500)  # disabled
pdecon_16 = Deconstruct(Point=end.Start)  # -> XComponent, YComponent, ZComponent; disabled
number_slider_51 = Slider(60, range=0..100)  # disabled
mm_min_9 = Multiplication(A=speed_mm_s_9, B=number_slider_51)  # disabled
X_3 = Text(" X")  # disabled
g1_9 = Text("G1 ")  # disabled
F_9 = Text("F")  # disabled
Y_3 = Text(" Y")  # disabled
concat_9 = Concatenate(
    FragmentH=g1_9,
    FragmentG=F_9,
    FragmentL=mm_min_9,
    FragmentA=X_3,
    FragmentB=pdecon_16.XComponent,
    FragmentC=Y_3,
    FragmentD=pdecon_16.YComponent)  # disabled
xy_to_blob = Panel(concat_9)  # disabled

# ----
# Z to line start
speed_mm_s_10 = Slider(15, range=0..200)  # disabled
z_line_start = Panel(pdecon_16.ZComponent)  # disabled
number_slider_52 = Slider(60, range=0..100)  # disabled
mm_min_10 = Multiplication(A=speed_mm_s_10, B=number_slider_52)  # disabled
g1_10 = Text("G1 ")  # disabled
F_10 = Text("F")  # disabled
Z_17 = Text(" Z")  # disabled
concat_10 = Concatenate(FragmentH=g1_10, FragmentG=F_10, FragmentL=mm_min_10, FragmentE=Z_17, FragmentF=z_line_start)  # disabled
z_to_blob = Panel(concat_10)  # disabled

# ----
# XY to high blob 2
speed_mm_s_11 = Slider(25, range=0..500)  # disabled
pdecon_17 = Deconstruct(Point=pt_23)  # -> XComponent, YComponent, ZComponent; disabled
number_slider_53 = Slider(60, range=0..100)  # disabled
mm_min_11 = Multiplication(A=speed_mm_s_11, B=number_slider_53)  # disabled
X_4 = Text(" X")  # disabled
g1_11 = Text("G1 ")  # disabled
F_11 = Text("F")  # disabled
Y_4 = Text(" Y")  # disabled
concat_11 = Concatenate(
    FragmentH=g1_11,
    FragmentG=F_11,
    FragmentL=mm_min_11,
    FragmentA=X_4,
    FragmentB=pdecon_17.XComponent,
    FragmentC=Y_4,
    FragmentD=pdecon_17.YComponent)  # disabled
xy_to_blob_2 = Panel(concat_11)  # disabled

# ----
# Z to clearance
speed_mm_s_12 = Slider(5, range=0..200)  # disabled
z_high_blob_point = Panel(pdecon_17.ZComponent)  # disabled
number_slider_54 = Slider(60, range=0..100)  # disabled
mm_min_12 = Multiplication(A=speed_mm_s_12, B=number_slider_54)  # disabled
g1_12 = Text("G1 ")  # disabled
F_12 = Text("F")  # disabled
Z_18 = Text(" Z")  # disabled
concat_12 = Concatenate(FragmentH=g1_12, FragmentG=F_12, FragmentL=mm_min_12, FragmentE=Z_18, FragmentF=z_high_blob_point)  # disabled
z_to_blob_2 = Panel(concat_12)  # disabled

# ----
# Z to clearance
speed_mm_s_13 = Slider(5, range=0..200)  # disabled
z_high_blob_point_2 = Panel(pdecon_17.ZComponent)  # disabled
number_slider_55 = Slider(60, range=0..100)  # disabled
mm_min_13 = Multiplication(A=speed_mm_s_13, B=number_slider_55)  # disabled
g1_13 = Text("G1 ")  # disabled
F_13 = Text("F")  # disabled
Z_19 = Text(" Z")  # disabled
concat_13 = Concatenate(FragmentH=g1_13, FragmentG=F_13, FragmentL=mm_min_13, FragmentE=Z_19, FragmentF=z_high_blob_point_2)  # disabled
z_to_blob_3 = Panel(concat_13)  # disabled

# ----
# Pickup
pick_up_blue_anchor_wrap_more_back_movem_2 = Panel("""; Start of pick up gcode blue
G91 ; relative positioning
G1 F500 Z25 ; Z offset
G90; absolute positioning
M83 ; relative extrusion

G1 F6000 X61.5 Y26 ; to pickup start XY
G1 F500 Z37 ; to pickup start Z
G1 F4000 X61.5 Y6 Z37  ; move to needle
G1 F4000 X42.5 Y6 Z37  ; lock in to needle
G1 F4000 X42.5 Y56 Z37  ; pull away
; end of pick up gcode v2""")  # "Pick Up Blue, anchor wrap (more back movement"; disabled
tstat = TreeStatistics(Tree=item_10)  # -> Paths, Length, Count; disabled
py3_8 = Python3Script(paths=tstat.Paths, data=pick_up_blue_anchor_wrap_more_back_movem_2)  # -> out, a; inputs paths: list, data: list; disabled
# ---------- py3_8: Python ----------
from Grasshopper import DataTree
from Grasshopper.Kernel.Data import GH_Path

output = DataTree[object]()

for i, path in enumerate(paths):
    output.AddRange(data, path)

a = output
# ---------- end py3_8 ----------
panel_16 = Panel(py3_8.a)  # disabled

# ----
# XY to blob
speed_mm_s_14 = Slider(25, range=0..500)  # disabled
pdecon_18 = Deconstruct(Point=pt_24)  # -> XComponent, YComponent, ZComponent; disabled
number_slider_56 = Slider(60, range=0..100)  # disabled
mm_min_14 = Multiplication(A=speed_mm_s_14, B=number_slider_56)  # disabled
g1_14 = Text("G1 ")  # disabled
X_5 = Text(" X")  # disabled
F_14 = Text("F")  # disabled
Y_5 = Text(" Y")  # disabled
concat_14 = Concatenate(
    FragmentH=g1_14,
    FragmentG=F_14,
    FragmentL=mm_min_14,
    FragmentA=X_5,
    FragmentB=pdecon_18.XComponent,
    FragmentC=Y_5,
    FragmentD=pdecon_18.YComponent)  # disabled
xy_to_blob_3 = Panel(concat_14)  # disabled

# ----
# Move to start of channel
speed_mm_s_15 = Slider(15, range=0..100)  # disabled
needle_y_offset_7 = Panel(needle_y_offset)  # disabled
needle_z_offset_9 = Panel(needle_z_offset)  # disabled
pdecon_19 = Deconstruct(Point=pt_22)  # -> XComponent, YComponent, ZComponent; disabled
number_slider_57 = Slider(60, range=0..100)  # disabled
addition_17 = Addition(A=pdecon_19.YComponent, B=needle_y_offset_7)  # disabled
addition_18 = Addition(A=pdecon_19.ZComponent, B=needle_z_offset_9)  # disabled
mm_min_15 = Multiplication(A=speed_mm_s_15, B=number_slider_57)  # disabled
Z_20 = Text(" Z")  # disabled
g1_15 = Text("G1 ")  # disabled
F_15 = Text("F")  # disabled
X_6 = Text(" X")  # disabled
Y_6 = Text(" Y")  # disabled
concat_15 = Concatenate(
    FragmentH=g1_15,
    FragmentG=F_15,
    FragmentL=mm_min_15,
    FragmentA=X_6,
    FragmentB=pdecon_19.XComponent,
    FragmentC=Y_6,
    FragmentD=addition_17,
    FragmentE=Z_20,
    FragmentF=addition_18)  # disabled
weaving_sequence_2 = Panel(concat_15)  # disabled

# ----
# Move to end of channel
speed_mm_s_16 = Slider(15, range=0..100)  # disabled
needle_y_offset_8 = Panel(needle_y_offset)  # disabled
needle_z_offset_10 = Panel(needle_z_offset)  # disabled
pdecon_20 = Deconstruct(Point=pt_20)  # -> XComponent, YComponent, ZComponent; disabled
number_slider_58 = Slider(60, range=0..100)  # disabled
addition_19 = Addition(A=pdecon_20.YComponent, B=needle_y_offset_8)  # disabled
addition_20 = Addition(A=pdecon_20.ZComponent, B=needle_z_offset_10)  # disabled
mm_min_16 = Multiplication(A=speed_mm_s_16, B=number_slider_58)  # disabled
Z_21 = Text(" Z")  # disabled
g1_16 = Text("G1 ")  # disabled
F_16 = Text("F")  # disabled
X_7 = Text(" X")  # disabled
Y_7 = Text(" Y")  # disabled
concat_16 = Concatenate(
    FragmentH=g1_16,
    FragmentG=F_16,
    FragmentL=mm_min_16,
    FragmentA=X_7,
    FragmentB=pdecon_20.XComponent,
    FragmentC=Y_7,
    FragmentD=addition_19,
    FragmentE=Z_21,
    FragmentF=addition_20)  # disabled
weaving_sequence_3 = Panel(concat_16)  # disabled

# ----
# Park
park_blue_anchor_wrap_2 = Panel("""; Start of park gcode blue
G91 ; relative positioning
G1 F500 Z5 ; Z offset
G90; absolute positioning
G1 F4000 X60  ; approach X
G1 F4000 Y26  ; approach Y
G1 F500 Z37 ; approach Z
G1 F4000 X42.5  ; slide X to wrap
G1 F4000 X42.5 Y6 Z37  ; move to station
G1 F4000 X61.5 Y6 Z37  ; decouple needle
G1 F4000 X61.5 Y26 Z37  ; pull away
; end of park gcode v2""")  # disabled
tstat_2 = TreeStatistics(Tree=item_10)  # -> Paths, Length, Count; disabled
py3_9 = Python3Script(paths=tstat_2.Paths, data=park_blue_anchor_wrap_2)  # -> out, a; inputs paths: list, data: list; disabled; same code as py3_8
panel_17 = Panel(py3_9.a)  # disabled

# ----
# Z to high blob 2
speed_mm_s_17 = Slider(5, range=0..200)  # disabled
z_blob_point = Panel(pdecon_17.ZComponent)  # disabled
number_slider_59 = Slider(60, range=0..100)  # disabled
mm_min_17 = Multiplication(A=speed_mm_s_17, B=number_slider_59)  # disabled
g1_17 = Text("G1 ")  # disabled
F_17 = Text("F")  # disabled
Z_22 = Text(" Z")  # disabled
concat_17 = Concatenate(FragmentH=g1_17, FragmentG=F_17, FragmentL=mm_min_17, FragmentE=Z_22, FragmentF=z_blob_point)  # disabled
z_to_blob_4 = Panel(concat_17)  # disabled

# ----
# Wipe
wipe = Panel("""; nozzle wipe G92 E0 ; zero extruder G1 E-0.5 F300 ; retract filament
G1 X55 Y262.5 F15000 ; nozzle wipe position start
G1 Z0.4; nozzle down (matching default z height when original wipe happens)
G1 X20 Y262.5 F15000 ; first wipe
G1 X20 Y262 F15000 ; Y down G1 X65 Y262 F15000 ; wipe
G1 X65 Y261.5 F15000 ; Y down G1 X20 Y261.5 F15000 ; wipe
G1 X20 Y261 F15000 ; Y down G1 X65 Y261 F15000 ; wipe
G1 X65 Y260.5 F15000 ; Y down G1 X20 Y260.5 F15000 ; wipe
G1 X20 Y260 F15000 ; Y down G1 X65 Y260 F15000 ; wipe
G1 F500 Z10 ; Lift Z
; end of wipe code""")  # disabled
tstat_3 = TreeStatistics(Tree=item_10)  # -> Paths, Length, Count; disabled
py3_10 = Python3Script(paths=tstat_3.Paths, data=wipe)  # -> out, a; inputs paths: list, data: list; disabled; same code as py3_8
panel_18 = Panel(py3_10.a)  # disabled

# ----
# Prime
priming_strip = Panel("""; --- Wipe Strip
G92 E0           ; Reset extruder
G1 X50 Y251 F10000  ; Move to purge XY
G1 Z0.3 F500     ; Move close to bed

G1 X150 Y251 E15 F1000 ; Draw purge line up along Y axis
G1 F1000 Z0.8 E-1     ; Retract extruder
G92 E0           ; Reset extruder again
; --- End of Priming Line G-code ---""")  # disabled
tstat_4 = TreeStatistics(Tree=item_10)  # -> Paths, Length, Count; disabled
py3_11 = Python3Script(paths=tstat_4.Paths, data=priming_strip)  # -> out, a; inputs paths: list, data: list; disabled; same code as py3_8
panel_19 = Panel(py3_11.a)  # disabled

# ----
# Z to low blob
speed_mm_s_18 = Slider(5, range=0..200)  # disabled
z_high_blob_point_3 = Panel(pdecon_18.ZComponent)  # disabled
number_slider_60 = Slider(1.7, range=0..2)  # disabled
channel_radius = Panel(number_slider)  # disabled
number_slider_61 = Slider(60, range=0..100)  # disabled
multiplication_10 = Multiplication(A=channel_radius, B=number_slider_60)  # disabled
subtraction_3 = Subtraction(A=z_high_blob_point_3, B=multiplication_10)  # disabled
mm_min_18 = Multiplication(A=speed_mm_s_18, B=number_slider_61)  # disabled
g1_18 = Text("G1 ")  # disabled
F_18 = Text("F")  # disabled
Z_23 = Text(" Z")  # disabled
concat_18 = Concatenate(FragmentH=g1_18, FragmentG=F_18, FragmentL=mm_min_18, FragmentE=Z_23, FragmentF=subtraction_3)  # disabled
z_to_blob_5 = Panel(concat_18)  # disabled

# ----
# Z to low blob 2
speed_mm_s_19 = Slider(5, range=0..200)  # disabled
z_blob_point_2 = Panel(pdecon_17.ZComponent)  # disabled
number_slider_62 = Slider(60, range=0..100)  # disabled
subtraction_4 = Subtraction(A=z_blob_point_2, B=multiplication_10)  # disabled
mm_min_19 = Multiplication(A=speed_mm_s_19, B=number_slider_62)  # disabled
Z_24 = Text(" Z")  # disabled
g1_19 = Text("G1 ")  # disabled
F_19 = Text("F")  # disabled
concat_19 = Concatenate(FragmentH=g1_19, FragmentG=F_19, FragmentL=mm_min_19, FragmentE=Z_24, FragmentF=subtraction_4)  # disabled
z_to_blob_6 = Panel(concat_19)  # disabled

# ----
# Lift Z to high blob
speed_mm_s_20 = Slider(5, range=0..200)  # disabled
z_high_blob_point_4 = Panel(pdecon_18.ZComponent)  # disabled
number_slider_63 = Slider(60, range=0..100)  # disabled
mm_min_20 = Multiplication(A=speed_mm_s_20, B=number_slider_63)  # disabled
g1_20 = Text("G1 ")  # disabled
F_20 = Text("F")  # disabled
Z_25 = Text(" Z")  # disabled
concat_20 = Concatenate(FragmentH=g1_20, FragmentG=F_20, FragmentL=mm_min_20, FragmentE=Z_25, FragmentF=z_high_blob_point_4)  # disabled
z_to_blob_7 = Panel(concat_20)  # disabled

# ----
# Weaving path
needle_y_offset_9 = Panel(needle_y_offset)  # disabled
needle_z_offset_11 = Panel(needle_z_offset)  # disabled
pdecon_21 = Deconstruct(Point=trim_8)  # -> XComponent, YComponent, ZComponent; disabled
number_slider_64 = Slider(60, range=0..100)  # disabled
addition_21 = Addition(A=pdecon_21.YComponent, B=needle_y_offset_9)  # disabled
addition_22 = Addition(A=pdecon_21.ZComponent, B=needle_z_offset_11)  # disabled
mm_min_21 = Multiplication(A=weaving_speed_mm_s, B=number_slider_64)  # disabled
Z_26 = Text(" Z")  # disabled
g1_21 = Text("G1 ")  # disabled
F_21 = Text("F")  # disabled
X_8 = Text(" X")  # disabled
Y_8 = Text(" Y")  # disabled
concat_21 = Concatenate(
    FragmentH=g1_21,
    FragmentG=F_21,
    FragmentL=mm_min_21,
    FragmentA=X_8,
    FragmentB=pdecon_21.XComponent,
    FragmentC=Y_8,
    FragmentD=addition_21,
    FragmentE=Z_26,
    FragmentF=addition_22)  # disabled
weaving_sequence_4 = Panel(concat_21)  # disabled

# ----
# Instructions
# Geometry modifications
# (bake geometry and export)
# modified geometry
# Slice Object
brep_20 = Brep(sdiff)  # disabled

# ----
# (make sure the plaement in the slicer is the same
#  as that in rhino by copying the rhino coordinates of the midpoint)
# Copy coordinates
# Insert GCode
# (insert the custom Gcode in the slicer at the layers
# where the channels have been printed to 3/4 their height,
# insert for all weaving layers)
brep_21 = Brep(brep_20)  # disabled
import_rhino_geometry_as_rg_combined_box_2 = Python3Script(breps=brep_21)  # -> out, a_out; "import Rhino.Geometry as rg combined_box = rg.BoundingBox.Empty for brep in breps: box = brep.GetBoundingBox(True) combined_box = rg.BoundingBox.Union(combined_box, box) a_out = combined_box.Center"; inputs breps: list of Brep; disabled; same code as import_rhino_geometry_as_rg_combined_box
pt_25 = Point(import_rhino_geometry_as_rg_combined_box_2.a_out)  # disabled
pdecon_22 = Deconstruct(Point=pt_25)  # -> XComponent, YComponent, ZComponent; disabled
panel_20 = Panel(pdecon_22.YComponent)  # disabled
panel_21 = Panel(pdecon_22.XComponent)  # disabled
panel_22 = Panel(pdecon_22.ZComponent)  # disabled

vdis = VectorDisplay(Anchor=py3_3.a, Vector=merge_8)  # disabled
panel_23 = Panel(dom_4)  # disabled
simplify_9 = SimplifyTree(Tree=crv_7, Front=False)  # -> graft(Tree); disabled
simplify_10 = SimplifyTree(Tree=move_9.Geometry, Front=False)  # -> graft(Tree); disabled
repeat = RepeatData(Data=simplify_9, Length=number_slider_17)  # disabled
simplify_11 = SimplifyTree(Tree=repeat, Front=False)  # disabled

# ----
# Full circle points
number_slider_65 = Slider(25, range=0..100)  # disabled
divide_8 = DivideCurve(Curve=simplify_11, Count=number_slider_65, Kinks=False)  # -> Points, Tangents, Parameters; disabled

# ----
# yarn pull travel points
pt_26 = Point(simplify_10)  # disabled

# ----
# XY to weaving start
item_11 = ListItem(List=flatten(divide_8.Points), Index=0, Wrap=True)  # disabled
speed_mm_s_21 = Slider(200, range=0..500)  # disabled
pdecon_23 = Deconstruct(Point=item_11)  # -> XComponent, YComponent, ZComponent; disabled
number_slider_66 = Slider(60, range=0..100)  # disabled
needle_y_offset_10 = Panel(needle_y_offset_6)  # disabled
addition_23 = Addition(A=pdecon_23.YComponent, B=needle_y_offset_10)  # disabled
mm_min_22 = Multiplication(A=speed_mm_s_21, B=number_slider_66)  # disabled
g1_22 = Text("G1 ")  # disabled
X_9 = Text(" X")  # disabled
F_22 = Text("F")  # disabled
Y_9 = Text(" Y")  # disabled
concat_22 = Concatenate(
    FragmentH=g1_22,
    FragmentG=F_22,
    FragmentL=mm_min_22,
    FragmentA=X_9,
    FragmentB=pdecon_23.XComponent,
    FragmentC=Y_9,
    FragmentD=addition_23)  # disabled
xy_to_weaving_start_2 = Panel(concat_22)  # disabled

# ----
# Create wrapping path
travel_offset = Slider(2, range=0..10)  # disabled
offset = OffsetCurve(Curve=simplify, Distance=travel_offset, Corners=1)  # disabled

# ----
# Smooth cover lines
crv_11 = Curve(offset)  # disabled

# ----
# Curve seam
crv_cp_3 = CurveClosestPoint(Point=pt_3, Curve=crv_11)  # -> Point, Parameter, Distance; disabled
seam_3 = Seam(Curve=crv_11, Seam=crv_cp_3.Parameter)  # disabled

clean = CleanTree(RemoveNulls=True, RemoveInvalid=True, RemoveEmpty=True, Tree=seam_3)  # disabled

# ----
# Smooth wrapping path
crv_12 = Curve(clean)  # disabled

# ----
# Wrapping Texture
crv_13 = Curve(crv_12)  # disabled

# ----
# Switch between Wrapping & Woven
# by  switching the input
crv_14 = Curve(crv_13)  # disabled

# ----
# weaving points
number_slider_67 = Slider(50, range=0..100)  # disabled
divide_9 = DivideCurve(Curve=crv_14, Count=number_slider_67, Kinks=False)  # -> Points, Tangents, Parameters; disabled

lastdex_8 = LastIndex(List=flatten(divide_9.Points))  # disabled
item_12 = ListItem(List=flatten(divide_9.Points), Index=lastdex_8, Wrap=True)  # disabled

# ----
# last weaving point
pt_27 = Point(item_12)  # disabled

pdecon_24 = Deconstruct(Point=pt_27)  # -> XComponent, YComponent, ZComponent; disabled
pdecon_25 = Deconstruct(Point=pt_7)  # -> XComponent, YComponent, ZComponent; disabled
pt_28 = ConstructPoint(XCoordinate=pdecon_25.XComponent, YCoordinate=pdecon_25.YComponent, ZCoordinate=pdecon_24.ZComponent)  # disabled
ln_5 = Line(StartPoint=pt_28, EndPoint=pt_27)  # disabled

# ----
# last Blob point
number_slider_68 = Slider(0.94, range=0..1)  # disabled
eval_8 = EvaluateCurve(Curve=reparameterize(ln_5), Parameter=number_slider_68)  # -> Point, Tangent, Angle; disabled
Z_27 = UnitZ(Factor=number_slider)  # disabled
move_14 = Move(Geometry=eval_8.Point, Motion=Z_27)  # -> Geometry, Transform; disabled

# ----
# last channel (to boolean)
pipe_3 = Pipe(Curve=ln_5, Radius=number_slider, Caps=0)  # disabled
cap_4 = CapHoles(Brep=pipe_3)  # disabled

# ----
# last Blob point
pt_29 = Point(move_14.Geometry)  # disabled

# ----
# XY to weaving start
item_13 = ListItem(List=flatten(divide_9.Points), Index=0, Wrap=True)  # disabled
speed_mm_s_22 = Slider(25, range=0..500)  # disabled
pdecon_26 = Deconstruct(Point=item_13)  # -> XComponent, YComponent, ZComponent; disabled
number_slider_69 = Slider(60, range=0..100)  # disabled
needle_y_offset_11 = Panel(needle_y_offset)  # disabled
addition_24 = Addition(A=pdecon_26.YComponent, B=needle_y_offset_11)  # disabled
mm_min_23 = Multiplication(A=speed_mm_s_22, B=number_slider_69)  # disabled
g1_23 = Text("G1 ")  # disabled
X_10 = Text(" X")  # disabled
F_23 = Text("F")  # disabled
Y_10 = Text(" Y")  # disabled
concat_23 = Concatenate(
    FragmentH=g1_23,
    FragmentG=F_23,
    FragmentL=mm_min_23,
    FragmentA=X_10,
    FragmentB=pdecon_26.XComponent,
    FragmentC=Y_10,
    FragmentD=addition_24)  # disabled
xy_to_weaving_start_3 = Panel(concat_23)  # disabled

# ----
# 1st weaving point
pt_30 = Point(item_13)  # disabled

# ----
# 1st channel (to boolean)
pdecon_27 = Deconstruct(Point=pt_30)  # -> XComponent, YComponent, ZComponent; disabled
pdecon_28 = Deconstruct(Point=pt_6)  # -> XComponent, YComponent, ZComponent; disabled
pt_31 = ConstructPoint(XCoordinate=pdecon_28.XComponent, YCoordinate=pdecon_28.YComponent, ZCoordinate=pdecon_27.ZComponent)  # disabled
ln_6 = Line(StartPoint=pt_31, EndPoint=pt_30)  # disabled
pipe_4 = Pipe(Curve=ln_6, Radius=number_slider, Caps=0)  # disabled
cap_5 = CapHoles(Brep=pipe_4)  # disabled

# ----
# 1st Blob point
number_slider_70 = Slider(0.95, range=0..1)  # disabled
eval_9 = EvaluateCurve(Curve=reparameterize(ln_6), Parameter=number_slider_70)  # -> Point, Tangent, Angle; disabled
Z_28 = UnitZ(Factor=number_slider)  # disabled
move_15 = Move(Geometry=eval_9.Point, Motion=Z_28)  # -> Geometry, Transform; disabled

# ----
# Cutting Channels
merge_13 = Merge(Data1=cap_5, Data2=cap_4)  # disabled

# ----
# Channels
brep_22 = Brep(merge_13)

# ----
# Channels
# (booleanDiff)
group_3 = Group(Geometry=merge_13)  # disabled

# ----
# 1st Blob point
pt_32 = Point(move_15.Geometry)  # disabled

# ----
# Y pull away
item_14 = ListItem(List=flatten(divide_9.Points), Index=0, Wrap=True)  # disabled
speed_mm_s_23 = Slider(25, range=0..500)  # disabled
clearance_mm_7 = Slider(30, range=0..100)  # disabled
pdecon_29 = Deconstruct(Point=item_14)  # -> XComponent, YComponent, ZComponent; disabled
number_slider_71 = Slider(60, range=0..100)  # disabled
needle_y_offset_12 = Panel(needle_y_offset)  # disabled
addition_25 = Addition(A=pdecon_29.YComponent, B=clearance_mm_7)  # disabled
mm_min_24 = Multiplication(A=speed_mm_s_23, B=number_slider_71)  # disabled
addition_26 = Addition(A=addition_25, B=needle_y_offset_12)  # disabled
g1_24 = Text("G1 ")  # disabled
Y_11 = Text(" Y")  # disabled
F_24 = Text("F")  # disabled
concat_24 = Concatenate(FragmentH=g1_24, FragmentG=F_24, FragmentL=mm_min_24, FragmentC=Y_11, FragmentD=addition_26)  # disabled
y_pull_away = Panel(concat_24)  # disabled

# ----
# XY to blob
speed_mm_s_24 = Slider(25, range=0..500)  # disabled
pdecon_30 = Deconstruct(Point=pt_32)  # -> XComponent, YComponent, ZComponent; disabled
number_slider_72 = Slider(60, range=0..100)  # disabled
mm_min_25 = Multiplication(A=speed_mm_s_24, B=number_slider_72)  # disabled
g1_25 = Text("G1 ")  # disabled
X_11 = Text(" X")  # disabled
F_25 = Text("F")  # disabled
Y_12 = Text(" Y")  # disabled
concat_25 = Concatenate(
    FragmentH=g1_25,
    FragmentG=F_25,
    FragmentL=mm_min_25,
    FragmentA=X_11,
    FragmentB=pdecon_30.XComponent,
    FragmentC=Y_12,
    FragmentD=pdecon_30.YComponent)  # disabled
xy_to_blob_4 = Panel(concat_25)  # disabled

# ----
# Lift Z and blob
speed_mm_s_25 = Slider(1, range=0..200)  # disabled
z_blob_point_3 = Panel(pdecon_30.ZComponent)  # disabled
number_slider_73 = Slider(60, range=0..100)  # disabled
blob_extrusion = Slider(15, range=0..100)  # disabled
mm_min_26 = Multiplication(A=speed_mm_s_25, B=number_slider_73)  # disabled
blob = Panel("G92 E0 ;   Reset Extruder")  # disabled
blob_2 = Panel("""G92 E0 ;   Reset Extruder
; End of 1st yarn insertion""")  # disabled
g1_26 = Text("G1 ")  # disabled
F_26 = Text("F")  # disabled
Z_29 = Text(" Z")  # disabled
E = Text(" E")  # disabled
concat_26 = Concatenate(
    FragmentH=g1_26,
    FragmentG=F_26,
    FragmentL=mm_min_26,
    FragmentE=Z_29,
    FragmentF=z_blob_point_3,
    FragmentA=E,
    FragmentB=blob_extrusion)  # disabled
merge_14 = Merge(Data1=blob, Data2=concat_26, Data3=blob_2)  # disabled
z_to_blob_8 = Panel(merge_14)  # disabled

# ----
# Wrapping/Woven GCode
# Lift Z to weaving start
speed_mm_s_26 = Slider(15, range=0..200)  # disabled
z_1st_point = Panel(pdecon_27.ZComponent)  # disabled
needle_z_offset_12 = Panel(needle_z_offset)  # disabled
number_slider_74 = Slider(60, range=0..100)  # disabled
addition_27 = Addition(A=z_1st_point, B=needle_z_offset_12)  # disabled
mm_min_27 = Multiplication(A=speed_mm_s_26, B=number_slider_74)  # disabled
g1_27 = Text("G1 ")  # disabled
F_27 = Text("F")  # disabled
Z_30 = Text(" Z")  # disabled
concat_27 = Concatenate(FragmentH=g1_27, FragmentG=F_27, FragmentL=mm_min_27, FragmentE=Z_30, FragmentF=addition_27)  # disabled
z_to_pillar_top_needle_offset_4 = Panel(concat_27)  # disabled

# ----
# Lift Z to blob
speed_mm_s_27 = Slider(15, range=0..200)  # disabled
z_blob_point_4 = Panel(pdecon_30.ZComponent)  # disabled
number_slider_75 = Slider(60, range=0..100)  # disabled
mm_min_28 = Multiplication(A=speed_mm_s_27, B=number_slider_75)  # disabled
g1_28 = Text("G1 ")  # disabled
F_28 = Text("F")  # disabled
Z_31 = Text(" Z")  # disabled
concat_28 = Concatenate(FragmentH=g1_28, FragmentG=F_28, FragmentL=mm_min_28, FragmentE=Z_31, FragmentF=z_blob_point_4)  # disabled
z_to_blob_9 = Panel(concat_28)  # disabled

# ----
# Lower Z to blob
speed_mm_s_28 = Slider(15, range=0..200)  # disabled
z_lower_blob_point = Panel(pdecon_27.ZComponent)  # disabled
number_slider_76 = Slider(60, range=0..100)  # disabled
mm_min_29 = Multiplication(A=speed_mm_s_28, B=number_slider_76)  # disabled
g1_29 = Text("G1 ")  # disabled
F_29 = Text("F")  # disabled
Z_32 = Text(" Z")  # disabled
concat_29 = Concatenate(FragmentH=g1_29, FragmentG=F_29, FragmentL=mm_min_29, FragmentE=Z_32, FragmentF=z_lower_blob_point)  # disabled
z_to_blob_10 = Panel(concat_29)  # disabled

# ----
# Y pull away
clearance_mm_8 = Slider(30, range=0..100)  # disabled
speed_mm_s_29 = Slider(25, range=0..500)  # disabled
item_15 = ListItem(List=flatten(divide_9.Points), Index=0, Wrap=True)  # disabled
pdecon_31 = Deconstruct(Point=item_15)  # -> XComponent, YComponent, ZComponent; disabled
number_slider_77 = Slider(60, range=0..100)  # disabled
needle_y_offset_13 = Panel(needle_y_offset)  # disabled
addition_28 = Addition(A=pdecon_31.YComponent, B=clearance_mm_8)  # disabled
mm_min_30 = Multiplication(A=speed_mm_s_29, B=number_slider_77)  # disabled
addition_29 = Addition(A=addition_28, B=needle_y_offset_13)  # disabled
g1_30 = Text("G1 ")  # disabled
Y_13 = Text(" Y")  # disabled
F_30 = Text("F")  # disabled
concat_30 = Concatenate(FragmentH=g1_30, FragmentG=F_30, FragmentL=mm_min_30, FragmentC=Y_13, FragmentD=addition_29)  # disabled
y_pull_away_2 = Panel(concat_30)  # disabled

# ----
# X to weaving start
speed_mm_s_30 = Slider(25, range=0..500)  # disabled
pdecon_32 = Deconstruct(Point=item_15)  # -> XComponent, YComponent, ZComponent; disabled
number_slider_78 = Slider(60, range=0..100)  # disabled
mm_min_31 = Multiplication(A=speed_mm_s_30, B=number_slider_78)  # disabled
X_12 = Text(" X")  # disabled
g1_31 = Text("G1 ")  # disabled
F_31 = Text("F")  # disabled
concat_31 = Concatenate(FragmentH=g1_31, FragmentG=F_31, FragmentL=mm_min_31, FragmentA=X_12, FragmentB=pdecon_32.XComponent)  # disabled
x_to_weaving_start = Panel(concat_31)  # disabled

# ----
# Lift Z to weaving start
speed_mm_s_31 = Slider(15, range=0..200)  # disabled
z_1st_point_2 = Panel(pdecon_27.ZComponent)  # disabled
needle_z_offset_13 = Panel(needle_z_offset)  # disabled
number_slider_79 = Slider(60, range=0..100)  # disabled
addition_30 = Addition(A=z_1st_point_2, B=needle_z_offset_13)  # disabled
mm_min_32 = Multiplication(A=speed_mm_s_31, B=number_slider_79)  # disabled
g1_32 = Text("G1 ")  # disabled
F_32 = Text("F")  # disabled
Z_33 = Text(" Z")  # disabled
concat_32 = Concatenate(FragmentH=g1_32, FragmentG=F_32, FragmentL=mm_min_32, FragmentE=Z_33, FragmentF=addition_30)  # disabled
z_to_weaving_start = Panel(concat_32)  # disabled

# ----
# XY to blob
speed_mm_s_32 = Slider(25, range=0..500)  # disabled
pdecon_33 = Deconstruct(Point=pt_29)  # -> XComponent, YComponent, ZComponent; disabled
number_slider_80 = Slider(60, range=0..100)  # disabled
mm_min_33 = Multiplication(A=speed_mm_s_32, B=number_slider_80)  # disabled
g1_33 = Text("G1 ")  # disabled
X_13 = Text(" X")  # disabled
F_33 = Text("F")  # disabled
Y_14 = Text(" Y")  # disabled
concat_33 = Concatenate(
    FragmentH=g1_33,
    FragmentG=F_33,
    FragmentL=mm_min_33,
    FragmentA=X_13,
    FragmentB=pdecon_33.XComponent,
    FragmentC=Y_14,
    FragmentD=pdecon_33.YComponent)  # disabled
xy_to_blob_5 = Panel(concat_33)  # disabled

# ----
# Lift Z and blob
speed_mm_s_33 = Slider(1, range=0..200)  # disabled
z_blob_point_5 = Panel(pdecon_33.ZComponent)  # disabled
number_slider_81 = Slider(60, range=0..100)  # disabled
blob_extrusion_2 = Slider(15, range=0..100)  # disabled
mm_min_34 = Multiplication(A=speed_mm_s_33, B=number_slider_81)  # disabled
blob_3 = Panel("G92 E0 ;   Reset Extruder")  # disabled
blob_4 = Panel("""G92 E0 ;   Reset Extruder
; End of 2nd yarn insertion""")  # disabled
g1_34 = Text("G1 ")  # disabled
F_34 = Text("F")  # disabled
Z_34 = Text(" Z")  # disabled
E_2 = Text(" E")  # disabled
concat_34 = Concatenate(
    FragmentH=g1_34,
    FragmentG=F_34,
    FragmentL=mm_min_34,
    FragmentE=Z_34,
    FragmentF=z_blob_point_5,
    FragmentA=E_2,
    FragmentB=blob_extrusion_2)  # disabled
merge_15 = Merge(Data1=blob_3, Data2=concat_34, Data3=blob_4)  # disabled
z_to_blob_11 = Panel(merge_15)  # disabled

# ----
# Lift Z to blob
speed_mm_s_34 = Slider(15, range=0..200)  # disabled
z_blob_point_6 = Panel(pdecon_33.ZComponent)  # disabled
number_slider_82 = Slider(60, range=0..100)  # disabled
mm_min_35 = Multiplication(A=speed_mm_s_34, B=number_slider_82)  # disabled
g1_35 = Text("G1 ")  # disabled
F_35 = Text("F")  # disabled
Z_35 = Text(" Z")  # disabled
concat_35 = Concatenate(FragmentH=g1_35, FragmentG=F_35, FragmentL=mm_min_35, FragmentE=Z_35, FragmentF=z_blob_point_6)  # disabled
z_to_blob_12 = Panel(concat_35)  # disabled

# ----
# Lower Z to blob
speed_mm_s_35 = Slider(15, range=0..200)  # disabled
z_lower_blob_point_2 = Panel(pdecon_24.ZComponent)  # disabled
number_slider_83 = Slider(60, range=0..100)  # disabled
mm_min_36 = Multiplication(A=speed_mm_s_35, B=number_slider_83)  # disabled
g1_36 = Text("G1 ")  # disabled
F_36 = Text("F")  # disabled
Z_36 = Text(" Z")  # disabled
concat_36 = Concatenate(FragmentH=g1_36, FragmentG=F_36, FragmentL=mm_min_36, FragmentE=Z_36, FragmentF=z_lower_blob_point_2)  # disabled
z_to_blob_13 = Panel(concat_36)  # disabled

# ----
# Weaving path
needle_y_offset_14 = Panel(needle_y_offset)  # disabled
needle_z_offset_14 = Panel(needle_z_offset)  # disabled
pdecon_34 = Deconstruct(Point=divide_9.Points)  # -> XComponent, YComponent, ZComponent; disabled
number_slider_84 = Slider(60, range=0..100)  # disabled
addition_31 = Addition(A=pdecon_34.YComponent, B=needle_y_offset_14)  # disabled
addition_32 = Addition(A=pdecon_34.ZComponent, B=needle_z_offset_14)  # disabled
mm_min_37 = Multiplication(A=weaving_speed_mm_s, B=number_slider_84)  # disabled
Z_37 = Text(" Z")  # disabled
g1_37 = Text("G1 ")  # disabled
F_37 = Text("F")  # disabled
X_14 = Text(" X")  # disabled
Y_15 = Text(" Y")  # disabled
concat_37 = Concatenate(
    FragmentH=g1_37,
    FragmentG=F_37,
    FragmentL=mm_min_37,
    FragmentA=X_14,
    FragmentB=pdecon_34.XComponent,
    FragmentC=Y_15,
    FragmentD=addition_31,
    FragmentE=Z_37,
    FragmentF=addition_32)  # disabled
weaving_sequence_5 = Panel(concat_37)  # disabled

# ----
# Final GCode Wrapping/Woven
merge_16 = Merge(
    Data1=flatten(pick_up_blue_anchor_wrap_more_back_movem),
    Data2=flatten(z_to_weaving_start),
    Data3=flatten(y_pull_away_2),
    Data4=flatten(x_to_weaving_start),
    Data5=flatten(weaving_sequence_5),
    Data6=flatten(park_blue_anchor_wrap),
    Data7=flatten(z_to_blob_12),
    Data8=flatten(xy_to_blob_5),
    Data9=flatten(z_to_blob_13),
    Data10=flatten(z_to_blob_11))  # disabled
merge_17 = Merge(
    Data2=flatten(pick_up_clearance_lifts_slow),
    Data3=flatten(z_to_pillar_top_needle_offset_4),
    Data4=flatten(xy_to_weaving_start_3),
    Data5=flatten(y_pull_away),
    Data6=flatten(park_wipe_avoid_slow),
    Data7=flatten(z_to_blob_9),
    Data8=flatten(xy_to_blob_4),
    Data9=flatten(z_to_blob_10),
    Data10=flatten(z_to_blob_8))  # disabled

# ----
# 2nd insertion
woven_wrapping_2nd_insertion_top_channel = Panel(merge_16)  # "Woven/Wrapping 2nd insertion (top channels)"; disabled

# ----
# 1st insertion
wrapping_woven_texture_1st_insertion_bot = Panel(merge_17)  # "Wrapping/Woven Texture 1st insertion (bottom channels)"; disabled

# ----
# Smooth surface 1
simplify_12 = SimplifyTree(Tree=crv_6, Front=False)  # disabled
simplify_13 = SimplifyTree(Tree=pt_17, Front=False)  # disabled
dispatch_4 = Dispatch(List=simplify_13, DispatchPattern=[True, False])  # -> ListA, ListB; disabled
# pickup
pick_up_clearance_lifts_slow_3 = Panel("""; Start of pick up gcode v2
G1 F1000 X25 Y74 ; to pickup start XY
G1 F1000 Z37 ; to pickup start Z
G1 F1000 X25 Y4 Z37  ; move to needle
G1 F1000 X6 Y4 Z37  ; lock in to needle
G1 F1000 X6 Y74 Z37  ; pull away
; end of pick up gcode v2""")  # disabled
# park
park_wipe_slow = Panel("""; Start of park + wipe gcode
G1 F1000 X6 Y74  ; XY to park start
G1 F1000 Z37 Z to park start
G1 F1000 X6 Y4 Z37  ; move to station
G1 F1000 X25 Y4 Z37  ; decouple needle
G1 F1000 X25 Y74 Z37  ; pull away

; nozzle wipe G92 E0 ; zero extruder G1 E-0.5 F300 ; retract filament
G1 F1000 Z100 ; lift Z
G1 X55 Y262.5 F15000 ; nozzle wipe position start
G1 Z0.4; nozzle down (matching default z height when original wipe happens)
G1 X20 Y262.5 F15000 ; first wipe
G1 X20 Y262 F15000 ; Y down G1 X65 Y262 F15000 ; wipe
G1 X65 Y261.5 F15000 ; Y down G1 X20 Y261.5 F15000 ; wipe
G1 X20 Y261 F15000 ; Y down G1 X65 Y261 F15000 ; wipe
G1 X65 Y260.5 F15000 ; Y down G1 X20 Y260.5 F15000 ; wipe
G1 X20 Y260 F15000 ; Y down G1 X65 Y260 F15000 ; wipe
; end of park + wipe code""")  # disabled

# ----
# half circle points
number_slider_85 = Slider(25, range=0..100)  # disabled
divide_10 = DivideCurve(Curve=simplify_12, Count=number_slider_85, Kinks=False)  # -> Points, Tangents, Parameters; disabled

pdecon_35 = Deconstruct(Point=simplify_4)  # -> XComponent, YComponent, ZComponent; disabled

division_12 = Division(A=pdecon_35.ZComponent, B=weft_distance)  # disabled
number_slider_86 = Slider(2, range=0..10)  # disabled
multiplication_11 = Multiplication(A=division_12, B=number_slider_86)  # disabled
number_slider_87 = Slider(1, range=0..1)  # disabled
number_slider_88 = Slider(-1, range=-1..0)  # disabled
pi_3 = Pi(Factor=multiplication_11)  # disabled
dom_5 = ConstructDomain(DomainStart=min_radius, DomainEnd=max_radius)  # disabled
dom_6 = ConstructDomain(DomainStart=number_slider_87, DomainEnd=number_slider_88)  # disabled
sin_2 = Sine(Value=pi_3)  # disabled
remap_2 = RemapNumbers(Value=sin_2, Source=dom_6, Target=dom_5)  # -> Mapped, Clipped; disabled

cir_4 = Circle(Plane=simplify_4, Radius=remap_2.Mapped)  # disabled

# ----
# Bake this loft & union
loft_2 = Loft(Curves=cir_4, Options={Adjust=False, Closed=False, LoftEnds=0, LoftSimp=0, LoftType=0, Rebuild=10, Refit=0.01})  # disabled
cap_6 = CapHoles(Brep=loft_2)  # disabled

# ----
# Woven texture anchors
brep_23 = Brep(cap_6)

# ----
# Modify Geometry
merge_18 = Merge(Data1=brep_15, Data2=brep_13)
merge_19 = Merge(Data1=brep_14, Data2=brep_23)
sunion_2 = SolidUnion(Breps=merge_18)
sunion_3 = SolidUnion(Breps=merge_19)
sdiff_2 = SolidDifference(BrepsA=sunion_2, BrepsB=brep_22)
sdiff_3 = SolidDifference(BrepsA=sunion_3, BrepsB=brep_22)

# ----
# Woven texture anchors
# (booleanUnion)
group_4 = Group(Geometry=cap_6)  # disabled

# ----
# Wrapping geometry
# modified
brep_24 = Brep(sdiff_2)

# ----
# Woven geometry
# modified
brep_25 = Brep(sdiff_3)

# ----
# Instructions
# Geometry modifications
# (modify from geometry in Rhino)
# Wrapping geometry modified
brep_26 = Brep(brep_24)

# ----
# Woven geometry modified
brep_27 = Brep(brep_25)

# ----
# Create weaving path
# compute distances
dist_4 = Distance(PointA=py3_2.a, PointB=shift_2)  # disabled
panel_24 = Panel("2")  # disabled
division_13 = Division(A=dist_4, B=panel_24)  # disabled
lastdex_9 = LastIndex(List=division_13)  # disabled
cull_i_2 = CullIndex(List=division_13, Indices=lastdex_9, Wrap=True)  # disabled
lastdex_10 = LastIndex(List=cull_i_2)  # disabled
item_16 = ListItem(List=cull_i_2, Index=lastdex_10, Wrap=True)  # disabled
merge_20 = Merge(Data1=cull_i_2, Data2=item_16)  # disabled

# ----
# End points
multiplication_12 = Multiplication(A=merge_6, B=merge_20)  # disabled
move_16 = Move(Geometry=py3_2.a, Motion=multiplication_12)  # -> Geometry, Transform; disabled

# ----
# Start points
multiplication_13 = Multiplication(A=merge_5, B=merge_20)  # disabled
move_17 = Move(Geometry=py3_2.a, Motion=multiplication_13)  # -> Geometry, Transform; disabled

arc_3 = ArcSED(Start=move_17.Geometry, End=move_16.Geometry, Direction=weave)  # -> Arc, Plane, Radius; disabled
join = JoinCurves(Curves=arc_3.Arc, Preserve=False)  # disabled

# ----
# Weaving lines
simplify_14 = SimplifyTree(Tree=join, Front=False)  # disabled

# ----
# Woven texture
crv_15 = Curve(simplify_14)  # disabled

simplify_15 = SimplifyTree(Tree=divide_10.Points, Front=False)  # disabled
merge_21 = Merge(Data1=dispatch_4.ListA, Data2=simplify_15, Data3=dispatch_4.ListB)  # disabled

# ----
# XY to weaving start
item_17 = ListItem(List=flatten(merge_21), Index=0, Wrap=True)  # disabled
speed_mm_s_36 = Slider(100, range=0..500)  # disabled
pdecon_36 = Deconstruct(Point=item_17)  # -> XComponent, YComponent, ZComponent; disabled
number_slider_89 = Slider(60, range=0..100)  # disabled
needle_y_offset_15 = Panel(needle_y_offset_3)  # disabled
addition_33 = Addition(A=pdecon_36.YComponent, B=needle_y_offset_15)  # disabled
mm_min_38 = Multiplication(A=speed_mm_s_36, B=number_slider_89)  # disabled
g1_38 = Text("G1 ")  # disabled
X_15 = Text(" X")  # disabled
F_38 = Text("F")  # disabled
Y_16 = Text(" Y")  # disabled
concat_38 = Concatenate(
    FragmentH=g1_38,
    FragmentG=F_38,
    FragmentL=mm_min_38,
    FragmentA=X_15,
    FragmentB=pdecon_36.XComponent,
    FragmentC=Y_16,
    FragmentD=addition_33)  # disabled
xy_to_weaving_start_4 = Panel(concat_38)  # disabled

# ----
# Weaving path
speed_mm_s_37 = Slider(15, range=0..100)  # disabled
needle_y_offset_16 = Panel(needle_y_offset_3)  # disabled
needle_z_offset_15 = Panel(needle_z_offset_3)  # disabled
pdecon_37 = Deconstruct(Point=merge_21)  # -> XComponent, YComponent, ZComponent; disabled
number_slider_90 = Slider(60, range=0..100)  # disabled
addition_34 = Addition(A=pdecon_37.YComponent, B=needle_y_offset_16)  # disabled
addition_35 = Addition(A=pdecon_37.ZComponent, B=needle_z_offset_15)  # disabled
mm_min_39 = Multiplication(A=speed_mm_s_37, B=number_slider_90)  # disabled
g1_39 = Text("G1 ")  # disabled
F_39 = Text("F")  # disabled
X_16 = Text(" X")  # disabled
Y_17 = Text(" Y")  # disabled
Z_38 = Text(" Z")  # disabled
concat_39 = Concatenate(
    FragmentH=g1_39,
    FragmentG=F_39,
    FragmentL=mm_min_39,
    FragmentA=X_16,
    FragmentB=pdecon_37.XComponent,
    FragmentC=Y_17,
    FragmentD=addition_34,
    FragmentE=Z_38,
    FragmentF=addition_35)  # disabled
weaving_sequence_6 = Panel(concat_39)  # disabled

merge_22 = Merge(
    Data1=flatten(z_to_pillar_top_2),
    Data2=flatten(pick_up_clearance_lifts_slow_3),
    Data3=flatten(z_to_pillar_top_needle_offset_2),
    Data4=flatten(xy_to_weaving_start_4),
    Data5=flatten(weaving_sequence_6),
    Data6=flatten(z_to_pillar_top_needle_offset_2),
    Data7=flatten(park_wipe_slow),
    Data8=flatten(z_to_pillar_top_2))  # disabled
carpet_texture_full_gcode_2 = Panel(merge_22)  # disabled

simplify_16 = SimplifyTree(Tree=pt_26, Front=False)  # disabled
simplify_17 = SimplifyTree(Tree=divide_8.Points, Front=False)  # disabled
simplify_18 = SimplifyTree(Tree=divide_6.Points, Front=False)  # disabled

trim_9 = TrimTree(Tree=simplify_17, Depth=1)  # disabled

merge_23 = Merge(Data1=trim_9, Data2=simplify_18, Data3=simplify_16)  # disabled

# ----
# Weaving path
speed_mm_s_38 = Slider(25, range=0..100)  # disabled
needle_y_offset_17 = Panel(needle_y_offset_6)  # disabled
needle_z_offset_16 = Panel(needle_z_offset_5)  # disabled
pdecon_38 = Deconstruct(Point=merge_23)  # -> XComponent, YComponent, ZComponent; disabled
number_slider_91 = Slider(60, range=0..100)  # disabled
addition_36 = Addition(A=pdecon_38.YComponent, B=needle_y_offset_17)  # disabled
addition_37 = Addition(A=pdecon_38.ZComponent, B=needle_z_offset_16)  # disabled
mm_min_40 = Multiplication(A=speed_mm_s_38, B=number_slider_91)  # disabled
g1_40 = Text("G1 ")  # disabled
F_40 = Text("F")  # disabled
X_17 = Text(" X")  # disabled
Y_18 = Text(" Y")  # disabled
Z_39 = Text(" Z")  # disabled
concat_40 = Concatenate(
    FragmentH=g1_40,
    FragmentG=F_40,
    FragmentL=mm_min_40,
    FragmentA=X_17,
    FragmentB=pdecon_38.XComponent,
    FragmentC=Y_18,
    FragmentD=addition_36,
    FragmentE=Z_39,
    FragmentF=addition_37)  # disabled
weaving_sequence_7 = Panel(concat_40)  # disabled

merge_24 = Merge(
    Data1=flatten(panel_4),
    Data2=flatten(z_to_pillar_top_3),
    Data3=flatten(pick_up_clearance_lifts),
    Data4=flatten(z_to_pillar_top_needle_offset_3),
    Data5=flatten(xy_to_weaving_start_2),
    Data6=flatten(weaving_sequence_7),
    Data7=flatten(z_to_pillar_top_needle_offset_3),
    Data8=flatten(park_wipe),
    Data9=flatten(z_to_pillar_top_3))  # disabled
carpet_texture_full_gcode_3 = Panel(merge_24)  # disabled

# ----
# Draw line
speed_mm_s_39 = Slider(1, range=0..200)  # disabled
pdecon_39 = Deconstruct(Point=end.End)  # -> XComponent, YComponent, ZComponent; disabled
number_slider_92 = Slider(60, range=0..100)  # disabled
line_extrusion = Slider(80, range=0..100)  # disabled
mm_min_41 = Multiplication(A=speed_mm_s_39, B=number_slider_92)  # disabled
X_18 = Text(" X")  # disabled
Y_19 = Text(" Y")  # disabled
E_3 = Text(" E")  # disabled
F_41 = Text("F")  # disabled
g1_41 = Text("G1 ")  # disabled
concat_41 = Concatenate(
    FragmentH=g1_41,
    FragmentG=F_41,
    FragmentL=mm_min_41,
    FragmentE=X_18,
    FragmentF=pdecon_39.XComponent,
    FragmentC=Y_19,
    FragmentD=pdecon_39.YComponent,
    FragmentA=E_3,
    FragmentB=line_extrusion)  # disabled

reset_extruder = Panel("G92 E0 ;   Reset Extruder")  # disabled
lng = ListLength(List=pdecon_39.XComponent)  # disabled
repeat_2 = RepeatData(Data=reset_extruder, Length=lng)  # disabled
simplify_19 = SimplifyTree(Tree=repeat_2, Front=False)  # disabled

merge_25 = Merge(Data1=simplify_19, Data2=concat_41, Data3=simplify_19)  # disabled
z_to_blob_14 = Panel(merge_25)  # disabled

# ----
# Lift Z and blob
speed_mm_s_40 = Slider(0.5, range=0..200)  # disabled
z_blob_point_7 = Panel(pdecon_18.ZComponent)  # disabled
number_slider_93 = Slider(60, range=0..100)  # disabled
blob_extrusion_3 = Slider(8, range=0..100)  # disabled
mm_min_42 = Multiplication(A=speed_mm_s_40, B=number_slider_93)  # disabled
g1_42 = Text("G1 ")  # disabled
F_42 = Text("F")  # disabled
Z_40 = Text(" Z")  # disabled
E_4 = Text(" E")  # disabled
concat_42 = Concatenate(
    FragmentH=g1_42,
    FragmentG=F_42,
    FragmentL=mm_min_42,
    FragmentE=Z_40,
    FragmentF=z_blob_point_7,
    FragmentA=E_4,
    FragmentB=blob_extrusion_3)  # disabled

reset_extruder_2 = Panel("G92 E0 ;   Reset Extruder")  # disabled
lng_2 = ListLength(List=z_blob_point_7)  # disabled
repeat_3 = RepeatData(Data=reset_extruder_2, Length=lng_2)  # disabled
simplify_20 = SimplifyTree(Tree=repeat_3, Front=False)  # disabled

merge_26 = Merge(Data1=simplify_20, Data2=concat_42, Data3=simplify_20)  # disabled
z_to_blob_15 = Panel(merge_26)  # disabled

# ----
# Lift Z and blob 2
speed_mm_s_41 = Slider(0.5, range=0..200)  # disabled
z_blob_point_8 = Panel(pdecon_17.ZComponent)  # disabled
number_slider_94 = Slider(60, range=0..100)  # disabled
blob_extrusion_4 = Slider(8, range=0..100)  # disabled
mm_min_43 = Multiplication(A=speed_mm_s_41, B=number_slider_94)  # disabled
g1_43 = Text("G1 ")  # disabled
F_43 = Text("F")  # disabled
Z_41 = Text(" Z")  # disabled
E_5 = Text(" E")  # disabled
concat_43 = Concatenate(
    FragmentH=g1_43,
    FragmentG=F_43,
    FragmentL=mm_min_43,
    FragmentE=Z_41,
    FragmentF=z_blob_point_8,
    FragmentA=E_5,
    FragmentB=blob_extrusion_4)  # disabled

reset_extruder_3 = Panel("G92 E0 ;   Reset Extruder")  # disabled
lng_3 = ListLength(List=z_blob_point_8)  # disabled
repeat_4 = RepeatData(Data=reset_extruder_3, Length=lng_3)  # disabled
simplify_21 = SimplifyTree(Tree=repeat_4, Front=False)  # disabled

merge_27 = Merge(Data1=simplify_21, Data2=concat_43, Data3=simplify_21)  # disabled
z_to_blob_16 = Panel(merge_27)  # disabled

# ----
# Final GCode Carpet Texture
merge_28 = Merge(
    Data1=z_to_blob_3,
    Data2=panel_16,
    Data3=weaving_sequence_2,
    Data4=weaving_sequence_4,
    Data5=weaving_sequence_3,
    Data6=panel_17,
    Data7=panel_18,
    Data8=panel_19,
    Data9=z_to_blob_7,
    Data10=xy_to_blob_3,
    Data11=z_to_blob_5,
    Data12=z_to_blob_15,
    Data13=z_to_blob_4,
    Data14=xy_to_blob_2,
    Data15=z_to_blob_6,
    Data16=z_to_blob_16,
    Data17=xy_to_blob,
    Data18=z_to_blob,
    Data19=z_to_blob_14,
    Data20=z_to_blob_2)  # disabled

# ----
# Switch between weaving layers
tstat_5 = TreeStatistics(Tree=merge_28)  # -> Paths, Length, Count; disabled
number_slider_95 = Slider(5, range=0..10)  # disabled
x_minus_one_3 = XMinusOne(NumberX=tstat_5.Count)  # disabled
item_18 = ListItem(List=tstat_5.Paths, Index=number_slider_95, Wrap=False)  # disabled
branch = TreeBranch(Tree=merge_28, Path=item_18, MaintainPaths=True)  # disabled

# ----
# last index to insert
amount_of_layers = Panel(x_minus_one_3)  # disabled

carpet_texture_1st_insertion = Panel(branch)  # disabled
